# Dynamo graph Curve.PointAtParameter.dyn (Dynamo 2.10.1.3976)

select_model_elements = DSModelElementsSelection()  # 4 picked in the model
param = DoubleSlider(0.2, range=0..1 step 0.1)
pointAtParameter = Python(IN[0]=select_model_elements, IN[1]=param)  # "Curve.PointAtParameter"; IronPython2
# ---------- pointAtParameter.python (38 lines) ----------
"""Copyright(c) 2019 by: duengocnguyen@gmail.com"""
'https://www.youtube.com/channel/UCt2JhCDDFxpYho575WTMZ4g'
"""________________Welcome to BIM3DM-DYNAMO API___________________"""
import clr 
import sys
import math 
from System.Collections.Generic import *

clr.AddReference("ProtoGeometry")
from Autodesk.DesignScript.Geometry import *

clr.AddReference('RevitAPI')
import Autodesk
from Autodesk.Revit.DB import *

clr.AddReference("RevitNodes")
import Revit
clr.ImportExtensions(Revit.Elements)
clr.ImportExtensions(Revit.GeometryConversion)



#Preparing input from dynamo to revit
element = UnwrapElement(IN[0])

def getDBLineByLines(elements):
    re = []
    for i in elements:
        crv = i.GeometryCurve
        re.append(crv)
    return re

factor = IN[1]
dbLines = getDBLineByLines(element)

points = [dbLine.Evaluate(factor, True).ToPoint() for dbLine in dbLines]

OUT = points
# ----------------------------------------
