# Dynamo graph DesignScript.dyn (Dynamo 2.10.1.3976)
# packages: BIM3DM 2.1.26

python_script = Python()  # IronPython2; unwired: IN[0]
# ---------- python_script.python (47 lines) ----------
"""Copyright(c) 2019 by: duengocnguyen@gmail.com"""
'https://www.youtube.com/channel/UCt2JhCDDFxpYho575WTMZ4g'
"""________________Welcome to BIM3DM-DYNAMO API___________________"""
import clr 
import sys
sys.path.append(r'C:\Program Files\Autodesk\Revit 2020\AddIns\DynamoForRevit\IronPython.StdLib.2.7.8')
import math 
from System.Collections.Generic import *

clr.AddReference("ProtoGeometry")
from Autodesk.DesignScript.Geometry import *

clr.AddReference('RevitAPI')
import Autodesk
from Autodesk.Revit.DB import *

clr.AddReference('RevitAPIUI')
from Autodesk.Revit.UI import*
from  Autodesk.Revit.UI.Selection import*

clr.AddReference("RevitNodes")
import Revit
clr.ImportExtensions(Revit.Elements)
clr.ImportExtensions(Revit.GeometryConversion)

clr.AddReference("RevitServices")
import RevitServices
from RevitServices.Persistence import DocumentManager
from RevitServices.Transactions import TransactionManager

doc = DocumentManager.Instance.CurrentDBDocument
view = doc.ActiveView
uidoc = DocumentManager.Instance.CurrentUIApplication.ActiveUIDocument

#Preparing input from dynamo to revit
element = UnwrapElement(IN[0])

#Do some action in a Transaction
#TransactionManager.Instance.EnsureInTransaction(doc)
"""Now, You Can Code """




#TransactionManager.Instance.TransactionTaskDone()

OUT = "hello world"
# ----------------------------------------
python_script_from_string = PythonStringNode()  # IronPython2; unwired: script, IN[0]
byARGB = Color.ByARGB()
conditionalFlattenArray = Custom[ConditionalFlattenArray]()  # package BIM3DM; This function selectively flattens nested lists in the input list based on the specified level, leaving other elements unchanged. Input Parameters: +objects: This is a list of elements (possibly nested lists) that you want to flatten. + level: This is the level at which you want to flatten the nested lists. If the rank of a sublist is greater than or equal to this level, it will be flattened.; unwired: objects
code = Custom[Code]()  # package BIM3DM; Let me coding. haha

# group: Design Script
boolean = BoolSelector(false)
python_script_2 = Python(IN[0]=boolean)  # IronPython2
# ---------- python_script_2.python (3 lines) ----------
f = open(r"U:\17_TraningAdvanceDynamo\2_WORKING\Tool\Dynamo\Traning-Dynamo-2024\DesignScript.py", "r")

OUT = f.read() 
# ----------------------------------------
python_script_from_string_2 = PythonStringNode(script=python_script_2)  # IronPython2; unwired: IN[0], IN[1]

select_model_elements = DSModelElementsSelection()  # 4 picked in the model
number_slider = DoubleSlider(0.2, range=0..1 step 0.1)
python_script_3 = Python(IN[0]=select_model_elements, IN[1]=number_slider)  # IronPython2
# ---------- python_script_3.python (38 lines) ----------
"""Copyright(c) 2019 by: duengocnguyen@gmail.com"""
'https://www.youtube.com/channel/UCt2JhCDDFxpYho575WTMZ4g'
"""________________Welcome to BIM3DM-DYNAMO API___________________"""
import clr 
import sys
import math 
from System.Collections.Generic import *

clr.AddReference("ProtoGeometry")
from Autodesk.DesignScript.Geometry import *

clr.AddReference('RevitAPI')
import Autodesk
from Autodesk.Revit.DB import *

clr.AddReference("RevitNodes")
import Revit
clr.ImportExtensions(Revit.Elements)
clr.ImportExtensions(Revit.GeometryConversion)



#Preparing input from dynamo to revit
element = UnwrapElement(IN[0])

def getDBLineByLines(elements):
    re = []
    for i in elements:
        crv = i.GeometryCurve
        re.append(crv)
    return re

factor = IN[1]
dbLines = getDBLineByLines(element)

points = [dbLine.Evaluate(factor, True).ToPoint() for dbLine in dbLines]

OUT = points
# ----------------------------------------
python_script_4 = Python()  # IronPython2; unwired: IN[0]
# ---------- python_script_4.python (7 lines) ----------
objects = ['a', 'b', 'c',500,600,501,'500', 'd', 'e', 'f']

lstStr=  []
for obj in objects:
    if isinstance(obj,int):
        lstStr.append(obj)
OUT = lstStr
# ----------------------------------------
python_script_5 = Python()  # IronPython2; unwired: IN[0]
# ---------- python_script_5.python (2 lines) ----------
objects = ['text_a-a-3000', 'text_b-4000', 'text_c-4000', 'text_d-8000']
OUT = [num.split('-')[-1]  for num in objects]
# ----------------------------------------
code_block = CodeBlock { 0..10; }
code_block_2 = CodeBlock { 10..20; }
code_block_3 = CodeBlock(x=code_block, y=code_block_2) { Point.ByCoordinates(x+2.5,y,0); }
python_script_6 = Python(IN[0]=code_block_3)  # IronPython2
# ---------- python_script_6.python (22 lines) ----------
"""Copyright(c) 2019 by: duengocnguyen@gmail.com"""
'https://www.youtube.com/channel/UCt2JhCDDFxpYho575WTMZ4g'
"""________________Welcome to BIM3DM-DYNAMO API___________________"""
import clr 
import sys
from System.Collections.Generic import *

clr.AddReference("RevitNodes")
import Revit
clr.ImportExtensions(Revit.Elements)
clr.ImportExtensions(Revit.GeometryConversion)


def getPositivePointByX(elements):
	points = [point for point in elements if  point.X % 2 != 1 and point.X != 0]
	return points

#Preparing input from dynamo to revit
inputs = UnwrapElement(IN[0])


OUT = getPositivePointByX(inputs)
# ----------------------------------------
python_script_7 = Python(IN[1]=code_block_3)  # IronPython2; unwired: IN[0]
# ---------- python_script_7.python (23 lines) ----------
"""Copyright(c) 2019 by: duengocnguyen@gmail.com"""
'https://www.youtube.com/channel/UCt2JhCDDFxpYho575WTMZ4g'
"""________________Welcome to BIM3DM-DYNAMO API___________________"""
import clr 
import sys
from System.Collections.Generic import *

clr.AddReference("RevitNodes")
import Revit
clr.ImportExtensions(Revit.Elements)
clr.ImportExtensions(Revit.GeometryConversion)


def getPositivePointByX(objects):
    result = []
    for p in objects:
        if p.X % 2 != 1:
            result.append(p)
    return result

input = IN[1] # tat cac diem ma can filter
points = getPositivePointByX(input)
OUT = points
# ----------------------------------------
python_script_8 = Python(IN[0]=code_block_3)  # IronPython2
# ---------- python_script_8.python (23 lines) ----------
"""Copyright(c) 2019 by: duengocnguyen@gmail.com"""
'https://www.youtube.com/channel/UCt2JhCDDFxpYho575WTMZ4g'
"""________________Welcome to BIM3DM-DYNAMO API___________________"""
import clr 
import sys
sys.path.append(r'U:\17_TraningAdvanceDynamo\2_WORKING\Tool\Dynamo\Traning-Dynamo-2024')
import math 
from System.Collections.Generic import *

from Utils import*

clr.AddReference("RevitNodes")
import Revit
clr.ImportExtensions(Revit.Elements)
clr.ImportExtensions(Revit.GeometryConversion)

#Preparing input from dynamo to revit
elements = UnwrapElement(IN[0])

points = getPositivePointByX(elements)

#OUT = points
OUT = points
# ----------------------------------------
code_block_4 = CodeBlock { 0..20; }
code_block_5 = CodeBlock(z=code_block_4) { Point.ByCoordinates(0,0,z); }
code_block_6 = CodeBlock { "Z"; }
getPositivePointByField = Custom[getPositivePointByField](points=code_block_5, field=code_block_6)  # package BIM3DM; filter points by X, Y, or Z
