# Dynamo graph Home.dyn (Dynamo 2.19.3.6394)

boolean = BoolSelector(false)
python_script = Python(IN[0]=boolean)  # CPython3
# ---------- python_script.python (50 lines) ----------
"""Copyright(c) 2019 by: duengocnguyen@gmail.com"""
'https://www.youtube.com/channel/UCt2JhCDDFxpYho575WTMZ4g'
"""________________Welcome to BIM3DM-DYNAMO API___________________"""
import clr 
import sys
sys.path.append(r'C:\Program Files\Autodesk\Revit 2020\AddIns\DynamoForRevit\IronPython.StdLib.2.7.8')
import math 
from System.Collections.Generic import *

clr.AddReference("ProtoGeometry")
from Autodesk.DesignScript.Geometry import *

clr.AddReference('RevitAPI')
import Autodesk
from Autodesk.Revit.DB import *

clr.AddReference('RevitAPIUI')
from Autodesk.Revit.UI import*
from  Autodesk.Revit.UI.Selection import*

clr.AddReference("RevitNodes")
import Revit
clr.ImportExtensions(Revit.Elements)
clr.ImportExtensions(Revit.GeometryConversion)

clr.AddReference("RevitServices")
import RevitServices
from RevitServices.Persistence import DocumentManager
from RevitServices.Transactions import TransactionManager

doc = DocumentManager.Instance.CurrentDBDocument
view = doc.ActiveView
uidoc = DocumentManager.Instance.CurrentUIApplication.ActiveUIDocument

#Preparing input from dynamo to revit
element = UnwrapElement(IN[0])
path_file = "Q:\DO VIDEO DYNAMO\ExcelToDetailLine\Excel.xlsx"

from openpyxl import load_workbook
import pandas as pd
import matplotlib.pyplot as plt

wb = load_workbook(path_file)
ws = wb.active  # Hoặc ws = wb['Tên Sheet'] nếu bạn muốn truy cập một sheet cụ thể
cell = ws['G2']
# Lấy chiều cao và chiều rộng của hàng và cột mà ô đó thuộc về
row_height = ws.row_dimensions[cell.row].height
column_width = ws.column_dimensions[cell.column_letter].width

OUT = ws
# ----------------------------------------
