# Dynamo graph Tao Y truc_script.dyn "Tao Y truc" (Dynamo 2.18.1.5096)
# packages: MEPover 2022.10.30, archi-lab.net 2024.217.1024, Orchid 3.0.1.6276

boolean = BoolSelector(true)
select_branch = Python(IN[0]=boolean)  # IronPython2
# ---------- select_branch.python (36 lines) ----------
"""Copyright by: duengocnguyen@gmail.com"""
import clr 
import System
import math 
from System.Collections.Generic import *

clr.AddReference("ProtoGeometry")
from Autodesk.DesignScript.Geometry import *

clr.AddReference('RevitAPI')
import Autodesk
from Autodesk.Revit.DB import *

clr.AddReference('RevitAPIUI')
from Autodesk.Revit.UI import*
from  Autodesk.Revit.UI.Selection import*

clr.AddReference("RevitNodes")
import Revit
clr.ImportExtensions(Revit.Elements)
clr.ImportExtensions(Revit.GeometryConversion)

clr.AddReference("RevitServices")
import RevitServices
from RevitServices.Persistence import DocumentManager
from RevitServices.Transactions import TransactionManager

doc = DocumentManager.Instance.CurrentDBDocument
view = doc.ActiveView
uidoc = DocumentManager.Instance.CurrentUIApplication.ActiveUIDocument

sel = uidoc.Selection
obType= ObjectType.Element
ref = sel.PickObject(obType,"pls, slect branch")
element= doc.GetElement(ref.ElementId)
OUT = element
# ----------------------------------------
getLocation = Element.GetLocation(element=select_branch)
code_block = CodeBlock { 0..1; }
pointAtParameter = Curve.PointAtParameter(curve=getLocation, param=code_block)
select_main = Python(IN[0]=boolean)  # IronPython2
# ---------- select_main.python (36 lines) ----------
"""Copyright by: duengocnguyen@gmail.com"""
import clr 
import System
import math 
from System.Collections.Generic import *

clr.AddReference("ProtoGeometry")
from Autodesk.DesignScript.Geometry import *

clr.AddReference('RevitAPI')
import Autodesk
from Autodesk.Revit.DB import *

clr.AddReference('RevitAPIUI')
from Autodesk.Revit.UI import*
from  Autodesk.Revit.UI.Selection import*

clr.AddReference("RevitNodes")
import Revit
clr.ImportExtensions(Revit.Elements)
clr.ImportExtensions(Revit.GeometryConversion)

clr.AddReference("RevitServices")
import RevitServices
from RevitServices.Persistence import DocumentManager
from RevitServices.Transactions import TransactionManager

doc = DocumentManager.Instance.CurrentDBDocument
view = doc.ActiveView
uidoc = DocumentManager.Instance.CurrentUIApplication.ActiveUIDocument

sel = uidoc.Selection
obType= ObjectType.Element
ref = sel.PickObject(obType,"pls, slect main")
element= doc.GetElement(ref.ElementId)
OUT = element
# ----------------------------------------
getLocation_2 = Element.GetLocation(element=select_main)
distanceTo = Geometry.DistanceTo(geometry=pointAtParameter@L1, other=getLocation_2)
sortByKey = List.SortByKey(list=pointAtParameter, keys=distanceTo)
code_block_2 = CodeBlock(a=sortByKey.sortedList) { a[0]; }
ZAxis = Vector.ZAxis()
byOriginNormal = Plane.ByOriginNormal(origin=code_block_2, normal=ZAxis)
code_block_3 = CodeBlock { 5000; }
byWidthLength = Rectangle.ByWidthLength(plane=byOriginNormal, width=code_block_3, length=code_block_3)
pointAtParameter_2 = Curve.PointAtParameter(curve=getLocation_2, param=code_block)
Z = Point.Z()  # unwired: point
sortByFunction = List.SortByFunction(list=pointAtParameter_2, sortFunction=Z)
code_block_4 = CodeBlock(a=sortByFunction) { a[1]; }
code_block_5 = CodeBlock(a=sortByFunction) { a[0]; }
byStartPointEndPoint = Line.ByStartPointEndPoint(startPoint=code_block_4, endPoint=code_block_5)
intersect = Geometry.Intersect(geometry=byOriginNormal, other=byStartPointEndPoint)
code_block_6 = CodeBlock(a=sortByKey.sortedList) { a[1]; }
byStartPointEndPoint_2 = Line.ByStartPointEndPoint(startPoint=code_block_2, endPoint=code_block_6)
pullOntoPlane = Curve.PullOntoPlane(curve=byStartPointEndPoint_2, plane=byOriginNormal)
code_block_7 = CodeBlock { 1; }
tangentAtParameter = Curve.TangentAtParameter(curve=pullOntoPlane, param=code_block_7)
code_block_8 = CodeBlock { 150; }
translate = Geometry.Translate(geometry=intersect, direction=tangentAtParameter, distance=code_block_8)
byStartPointEndPoint_3 = Line.ByStartPointEndPoint(startPoint=intersect, endPoint=translate)
type = archilab.Revit.Elements.Elements.Type(element=select_branch)
code_block_9 = CodeBlock { "System Type"; }
getParameterValueByName = Element.GetParameterValueByName(element=select_branch, parameterName=code_block_9)
code_block_10 = CodeBlock { "Reference Level"; }
getParameterValueByName_2 = Element.GetParameterValueByName(element=select_branch, parameterName=code_block_10)
code_block_11 = CodeBlock { "Diameter"; }
getParameterValueByName_3 = Element.GetParameterValueByName(element=select_branch, parameterName=code_block_11)
byLines = Custom[Pipe.ByLines](Lines=byStartPointEndPoint_3, pipeType=type, SystemType=getParameterValueByName, level=getParameterValueByName_2, Diameter=getParameterValueByName_3)  # package MEPover; Creates a pipe by Line, PipeType, SystemType, Level and Diameter
start = Revit.Transaction.Transaction.Start(input=byLines)
by2MEPCurves = Custom[Tee.By2MEPCurves](Main_MEPCurve=select_main, Branch_MEPCurve=start)  # package MEPover; Creates a tee by a main curve and a branch MEP curve (duct, pipe, conduit, cable tray). Only works with perpendicular brand curves
await_ = Orchid.Common.DataStream.Await(pass=byLines, waitFor=by2MEPCurves)
delete = archilab.Revit.Elements.Elements.Delete(element=await_)
end = Revit.Transaction.Transaction.End(input=delete)
join = List.Join(list0=by2MEPCurves, list1=end)
code_block_12 = CodeBlock(a=join) { a[0]; }
start_2 = Revit.Transaction.Transaction.Start(input=code_block_12)
direction = Line.Direction(line=byStartPointEndPoint)
number = DoubleInput(300)  # graph input
translate_2 = Geometry.Translate(geometry=intersect, direction=direction, distance=number)
setLocation = Element.SetLocation(element=code_block_12, geometry=translate_2)
await_2 = Orchid.Common.DataStream.Await(pass=start_2, waitFor=setLocation)
code_block_13 = CodeBlock { "REDY_NHT_Angle"; }
code_block_14 = CodeBlock { 45; }
setParameterByName = Element.SetParameterByName(element=await_2, parameterName=code_block_13, value=code_block_14)
end_2 = Revit.Transaction.Transaction.End(input=setParameterByName)
mep_connector_info = Custom[MEP Connector info+](element=end_2)  # package MEPover; This node will return the connectors and a lot of information about those connectors of the input elements
flatten = List.Flatten(list=mep_connector_info.Connectors)
isConnected = Custom[Connector.IsConnected](connector=flatten)  # package MEPover; Returns a boolean indicating whether the connector is connected to a connector on different element
filterByBoolMask = List.FilterByBoolMask(list=flatten, mask=isConnected)
code_block_15 = CodeBlock(a=filterByBoolMask.out) { a; }
flatten_2 = List.Flatten(list=mep_connector_info.Points)
filterByBoolMask_2 = List.FilterByBoolMask(list=flatten_2, mask=isConnected)
code_block_16 = CodeBlock(a=filterByBoolMask_2.out) { a; }
flatten_3 = List.Flatten(list=mep_connector_info.Direction)
filterByBoolMask_3 = List.FilterByBoolMask(list=flatten_3, mask=isConnected)
code_block_17 = CodeBlock(a=filterByBoolMask_3.out) { a; }
code_block_18 = CodeBlock { 150; }
translate_3 = Geometry.Translate(geometry=code_block_16, direction=code_block_17, distance=code_block_18)
byConnectorEndpoint = Custom[Pipe.ByConnectorEndpoint](connector=code_block_15, point=translate_3, pipeType=type, level=getParameterValueByName_2, lacing=Shortest)  # package MEPover; Creates a pipe from the connector to the given point.
byMEPCurves = Custom[MEPFitting.ByMEPCurves](MEPCurve1=select_branch, MEPCurve2=byConnectorEndpoint)  # package MEPover; Creates a UnionFitting or ElbowFitting by 2 MEPCurves (Ducts, Cable Trays, Pipes or Conduits). The output may not always be all the fittings created as Revit sometimes creates extra transition fittings outside of the node transactions.
