# Dynamo graph Lession_2_DrawX.dyn (Dynamo 2.10.1.3976)

code_block = CodeBlock { [0..12..2]; }
code_block_2 = CodeBlock { 4; }
code_block_3 = CodeBlock { 4; }
byCoordinates = Point.ByCoordinates(x=code_block, y=code_block_2, z=code_block_3)
code_block_4 = CodeBlock { 1; }
dropItems = List.DropItems(list=byCoordinates@L2, amount=code_block_4)
code_block_5 = CodeBlock { [0..12..2]; }
code_block_6 = CodeBlock { 2; }
code_block_7 = CodeBlock { 4; }
byCoordinates_2 = Point.ByCoordinates(x=code_block_5, y=code_block_6, z=code_block_7)
byStartPointEndPoint = Line.ByStartPointEndPoint(startPoint=dropItems, endPoint=byCoordinates_2)  # graph output
code_block_8 = CodeBlock { [0..12..2]; }
code_block_9 = CodeBlock { 4; }
byCoordinates_3 = Point.ByCoordinates(x=code_block_8, z=code_block_9)
code_block_10 = CodeBlock { 1; }
dropItems_2 = List.DropItems(list=byCoordinates_3@L2, amount=code_block_10)
byStartPointEndPoint_2 = Line.ByStartPointEndPoint(startPoint=byCoordinates_2, endPoint=dropItems_2)
code_block_11 = CodeBlock { 1; }
dropItems_3 = List.DropItems(list=byCoordinates_2@L2, amount=code_block_11)
byStartPointEndPoint_3 = Line.ByStartPointEndPoint(startPoint=dropItems_3, endPoint=byCoordinates_3)
byStartPointEndPoint_4 = Line.ByStartPointEndPoint(startPoint=byCoordinates, endPoint=dropItems_3)  # graph output
byCoordinates_4 = Point.ByCoordinates(x=code_block, y=code_block_2)
firstItem = List.FirstItem(list=byCoordinates_4@L2)
firstItem_2 = List.FirstItem(list=byCoordinates@L2)
byStartPointEndPoint_5 = Line.ByStartPointEndPoint(startPoint=firstItem, endPoint=firstItem_2)
lastItem = List.LastItem(list=byCoordinates_4@L2)
lastItem_2 = List.LastItem(list=byCoordinates@L2)
byStartPointEndPoint_6 = Line.ByStartPointEndPoint(startPoint=lastItem, endPoint=lastItem_2)
firstItem_3 = List.FirstItem(list=byCoordinates_3@L2)
byCoordinates_5 = Point.ByCoordinates(x=code_block_8)
firstItem_4 = List.FirstItem(list=byCoordinates_5@L2)
byStartPointEndPoint_7 = Line.ByStartPointEndPoint(startPoint=firstItem_3, endPoint=firstItem_4)
lastItem_3 = List.LastItem(list=byCoordinates_3@L2)
lastItem_4 = List.LastItem(list=byCoordinates_5@L2)
byStartPointEndPoint_8 = Line.ByStartPointEndPoint(startPoint=lastItem_3, endPoint=lastItem_4)
python_script = Python()  # CPython3; unwired: IN[0]; starter script, not edited (OUT = 0)
