# Dynamo graph Loop.dyn (Dynamo 2.10.1.3976)
# packages: BIM3DM 2.1.26

code_block = CodeBlock {  }
code_block_2 = CodeBlock { "Mat bang bo tri chung - A101"; }
code_block_3 = CodeBlock { "- "; }
split = String.Split(str=code_block_2, separator0=code_block_3)
code_block_4 = CodeBlock(a=split) { a[1]; }
boolean = BoolSelector(false)
code_block_5 = CodeBlock { nums = [1,2,3,4, "a", "b", "c", "d", "e", "f"]; }
python_script = Python(IN[0]=boolean, IN[1]=code_block_2)  # IronPython2
# ---------- python_script.python (2 lines) ----------
objects = IN[1]
OUT = objects[-4:]
# ----------------------------------------
python_script_2 = Python(IN[0]=boolean, IN[1]=code_block_5, IN[2]=python_script)  # IronPython2
# ---------- python_script_2.python (10 lines) ----------
objects = IN[1]
text = IN[2]

result = []

for i in objects:
	value = str(i) + " - "+ str(text)
	result.append(value)

OUT = result
# ----------------------------------------
python_script_3 = Python(IN[0]=boolean, IN[1]=code_block_5, IN[2]=python_script)  # IronPython2
# ---------- python_script_3.python (13 lines) ----------
objects = IN[1]
text = IN[2]

result = []

for num in range(len(objects)):
    value = str(objects[num]) + " - " + str(text)
    result.append(value)




OUT = result
# ----------------------------------------
boolean_2 = BoolSelector(false)
number_slider = DoubleSlider(11, range=0..100 step 1)
python_script_4 = Python(IN[0]=boolean_2, IN[1]=number_slider)  # IronPython2
# ---------- python_script_4.python (16 lines) ----------
import clr
import System

clr.AddReference("ProtoGeometry")
from Autodesk.DesignScript.Geometry import *



numSlider = IN[1]
points = []

for i in range(int(numSlider)):
	point =  Point.ByCoordinates(i,1,0)
	points.append([point.X, point.Y, point.Z])

OUT = points
# ----------------------------------------
code = Custom[Code]()  # package BIM3DM; Let me coding. haha

# group: VS Code
boolean_3 = BoolSelector(true)
python_script_5 = Python(IN[0]=boolean_3)  # IronPython2
# ---------- python_script_5.python (5 lines) ----------
re  = open(r"A:\Library-Dynamo-Python-CSharp\test.py", "r")

interpret = re.read()

OUT =  interpret
# ----------------------------------------
python_script_from_string = PythonStringNode(script=python_script_5)  # IronPython2; unwired: IN[0], IN[1]

code_block_6 = CodeBlock(OUT=python_script_from_string) { OUT; }
code_block_7 = CodeBlock { 0..10..1; }
byCoordinates = Point.ByCoordinates(x=code_block_7)
code_block_8 = CodeBlock(p=byCoordinates) { p.X; }
code_block_9 = CodeBlock(p=byCoordinates) { p.Y; }
code_block_10 = CodeBlock(p=byCoordinates) { p.Z; }
list_create = List.Create(item0=code_block_8, item1=code_block_9, item2=code_block_10)
code_block_11 = CodeBlock(p=byCoordinates) { [p.X, p.Y, p.Z]; }
code_block_12 = CodeBlock { t1 = false; }
python_script_6 = Python(IN[0]=code_block_12)  # IronPython2
# ---------- python_script_6.python (18 lines) ----------
import clr
import System

clr.AddReference("ProtoGeometry")
from Autodesk.DesignScript.Geometry import *


p1 = Point.ByCoordinates(1, 0, 0)
p2 = Point.ByCoordinates(1, 10, 0)

lines = []
for i in range(10):
	p1 = Point.ByCoordinates(0 + i, 0, 0)
	p2 = Point.ByCoordinates(0 + i, 10, 0)
	line =  Line.ByStartPointEndPoint(p1, p2)
	lines.append(line)

OUT = lines
# ----------------------------------------
