# Dynamo graph DesignScript.dyn (Dynamo 2.10.1.3976)

# group: Design Script
boolean = BoolSelector(true)
python_script = Python(IN[0]=boolean)  # IronPython2
# ---------- python_script.python (3 lines) ----------
f = open(r"U:\17_TraningAdvanceDynamo\2_WORKING\Tool\Dynamo\Traning-Dynamo-2024\DesignScript.py", "r")

OUT = f.read() 
# ----------------------------------------
python_script_from_string = PythonStringNode(script=python_script)  # IronPython2; unwired: IN[0], IN[1]

number_slider = DoubleSlider(3.4, range=0..100 step 0.1)
byCoordinates = Point.ByCoordinates(x=number_slider, y=number_slider, z=number_slider)
code_block = CodeBlock { Point.ByCoordinates(10,10,10); }
python_script_2 = Python()  # IronPython2; unwired: IN[0]
# ---------- python_script_2.python (23 lines) ----------
import clr
import System
import math 
from System.Collections.Generic import *

clr.AddReference("ProtoGeometry")
from Autodesk.DesignScript.Geometry import *





#Preparing input from dynamo to revit
element = UnwrapElement(IN[0])

#Do some action in a Transaction
#TransactionManager.Instance.EnsureInTransaction(doc)
"""Now, You Can Code """
points = []
for i in range(100):
	point = Point.ByCoordinates(i , 10, i + 10)
	points.append(point)
OUT = points
# ----------------------------------------
