# Dynamo graph Selections.dyn (Dynamo 2.10.1.3976)
# packages: BIM3DM 2.1.26

python_script = Python()  # IronPython2; unwired: IN[0]
# ---------- python_script.python (47 lines) ----------
"""Copyright(c) 2019 by: duengocnguyen@gmail.com"""
'https://www.youtube.com/channel/UCt2JhCDDFxpYho575WTMZ4g'
"""________________Welcome to BIM3DM-DYNAMO API___________________"""
import clr 
import sys
sys.path.append(r'C:\Program Files\Autodesk\Revit 2020\AddIns\DynamoForRevit\IronPython.StdLib.2.7.8')
import math 
from System.Collections.Generic import *

clr.AddReference("ProtoGeometry")
from Autodesk.DesignScript.Geometry import *

clr.AddReference('RevitAPI')
import Autodesk
from Autodesk.Revit.DB import *

clr.AddReference('RevitAPIUI')
from Autodesk.Revit.UI import*
from  Autodesk.Revit.UI.Selection import*

clr.AddReference("RevitNodes")
import Revit
clr.ImportExtensions(Revit.Elements)
clr.ImportExtensions(Revit.GeometryConversion)

clr.AddReference("RevitServices")
import RevitServices
from RevitServices.Persistence import DocumentManager
from RevitServices.Transactions import TransactionManager

doc = DocumentManager.Instance.CurrentDBDocument
view = doc.ActiveView
uidoc = DocumentManager.Instance.CurrentUIApplication.ActiveUIDocument

#Preparing input from dynamo to revit
element = UnwrapElement(IN[0])

#Do some action in a Transaction
#TransactionManager.Instance.EnsureInTransaction(doc)
"""Now, You Can Code """




#TransactionManager.Instance.TransactionTaskDone()

OUT = "hello world"
# ----------------------------------------
python_script_from_string = PythonStringNode()  # IronPython2; unwired: script, IN[0]
byARGB = Color.ByARGB()
conditionalFlattenArray = Custom[ConditionalFlattenArray]()  # package BIM3DM; This function selectively flattens nested lists in the input list based on the specified level, leaving other elements unchanged. Input Parameters: +objects: This is a list of elements (possibly nested lists) that you want to flatten. + level: This is the level at which you want to flatten the nested lists. If the rank of a sublist is greater than or equal to this level, it will be flattened.; unwired: objects
code = Custom[Code]()  # package BIM3DM; Let me coding. haha

# group: Design Script
boolean = BoolSelector(false)
python_script_2 = Python(IN[0]=boolean)  # IronPython2
# ---------- python_script_2.python (3 lines) ----------
f = open(r"U:\17_TraningAdvanceDynamo\2_WORKING\Tool\Dynamo\Traning-Dynamo-2024\DesignScript.py", "r")

OUT = f.read() 
# ----------------------------------------
python_script_from_string_2 = PythonStringNode(script=python_script_2)  # IronPython2; unwired: IN[0], IN[1]

boolean_2 = BoolSelector(true)
python_script_3 = Python(IN[0]=boolean_2)  # IronPython2
# ---------- python_script_3.python (59 lines) ----------
import clr
import System
import math 
from System.Collections.Generic import *

clr.AddReference("ProtoGeometry")
from Autodesk.DesignScript.Geometry import *

clr.AddReference('RevitAPI')
import Autodesk
from Autodesk.Revit.DB import *

clr.AddReference('RevitAPIUI')
from Autodesk.Revit.UI import*
from  Autodesk.Revit.UI.Selection import*

clr.AddReference("RevitNodes")
import Revit
clr.ImportExtensions(Revit.Elements)
clr.ImportExtensions(Revit.GeometryConversion)

clr.AddReference("RevitServices")
import RevitServices
from RevitServices.Persistence import DocumentManager
from RevitServices.Transactions import TransactionManager

import clr
clr.AddReference('DSCoreNodes')
from DSCore import *



doc = DocumentManager.Instance.CurrentDBDocument
view = doc.ActiveView
uidoc = DocumentManager.Instance.CurrentUIApplication.ActiveUIDocument
class SelectionFilter(ISelectionFilter):
	def __init__(self, ctgName1 , ctgName2):
		self.ctgName1 = ctgName1
		self.ctgName2 = ctgName2

	def AllowElement(self, element):
		if element.Category.Name == self.ctgName1 or element.Category.Name == self.ctgName2:
			return True
		else:
			return False
	def AllowReference(ref, xyZ):
		return False


ele = SelectionFilter("Grids", "Structural Columns")
elSelectAll = uidoc.Selection.PickElementsByRectangle(ele,"Selects")
OUT = elSelectAll

grids = []
column = []
for i in elSelectAll:
    if i.Category.Name == "Structural Columns": column.append(i)
    if i.Category.Name == "Grids": grids.append(i)
OUT =  column, grids
# ----------------------------------------
code_block = CodeBlock { a = 10; b = 20; c = a + b; }
code_block_2 = CodeBlock { 100; }
code_block_3 = CodeBlock { 100+a; }  # unwired: a
code_block_4 = CodeBlock { 1..100..4; }
code_block_5 = CodeBlock { 1..100..2; }
code_block_6 = CodeBlock { 1..100..#3; }
code_block_7 = CodeBlock { 1..100; }
python_script_4 = Python()  # IronPython2; unwired: IN[0]
# ---------- python_script_4.python (46 lines) ----------
"""Copyright(c) 2019 by: duengocnguyen@gmail.com"""
'https://www.youtube.com/channel/UCt2JhCDDFxpYho575WTMZ4g'
"""________________Welcome to BIM3DM-DYNAMO API___________________"""
import clr 
import sys
sys.path.append(r'C:\Program Files\Autodesk\Revit 2020\AddIns\DynamoForRevit\IronPython.StdLib.2.7.8')
import math 
from System.Collections.Generic import *

clr.AddReference("ProtoGeometry")
from Autodesk.DesignScript.Geometry import *

clr.AddReference('RevitAPI')
import Autodesk
from Autodesk.Revit.DB import *

clr.AddReference('RevitAPIUI')
from Autodesk.Revit.UI import*
from  Autodesk.Revit.UI.Selection import*

clr.AddReference("RevitNodes")
import Revit
clr.ImportExtensions(Revit.Elements)
clr.ImportExtensions(Revit.GeometryConversion)

clr.AddReference("RevitServices")
import RevitServices
from RevitServices.Persistence import DocumentManager
from RevitServices.Transactions import TransactionManager

doc = DocumentManager.Instance.CurrentDBDocument
view = doc.ActiveView
uidoc = DocumentManager.Instance.CurrentUIApplication.ActiveUIDocument

#Preparing input from dynamo to revit
element = UnwrapElement(IN[0])

#Do some action in a Transaction
#TransactionManager.Instance.EnsureInTransaction(doc)
"""Now, You Can Code """



#TransactionManager.Instance.TransactionTaskDone()

OUT = element
# ----------------------------------------
