# Dynamo graph DIM_Grids.dyn (Dynamo 2.18.1.5096)

getgeoelement_element = Python()  # CPython3; unwired: IN[0], IN[1]
# ---------- getgeoelement_element.python (48 lines) ----------
"""Copyright by: duengocnguyen@gmail.com"""
import clr 
import System
import math 
from System.Collections.Generic import *

clr.AddReference("ProtoGeometry")
from Autodesk.DesignScript.Geometry import *

clr.AddReference('RevitAPI')
import Autodesk
from Autodesk.Revit.DB import *

clr.AddReference('RevitAPIUI')
from Autodesk.Revit.UI import*
from  Autodesk.Revit.UI.Selection import*

clr.AddReference("RevitNodes")
import Revit
clr.ImportExtensions(Revit.Elements)
clr.ImportExtensions(Revit.GeometryConversion)

clr.AddReference("RevitServices")
import RevitServices
from RevitServices.Persistence import DocumentManager
from RevitServices.Transactions import TransactionManager

# Accessing the current Revit document and active view
doc = DocumentManager.Instance.CurrentDBDocument
view = doc.ActiveView
uidoc = DocumentManager.Instance.CurrentUIApplication.ActiveUIDocument
# #############################################################
# #                      FUNCTION                             #
# #############################################################
def getGeoElement(element): # Get geometry of element.
    geo = []
    opt = Options()
    opt.ComputeReferences = True
    opt.IncludeNonVisibleObjects = True
    opt.DetailLevel = ViewDetailLevel.Fine
    geoByElement = element.get_Geometry(opt)
    geo = [i for i in geoByElement]
    return geo
# #############################################################
# #                      GEOMETRY                             #
# #############################################################
elements = UnwrapElement(IN[1]) if isinstance(IN[1],list) else [UnwrapElement(IN[1])]
OUT = [getGeoElement(i) for i in elements]
# ----------------------------------------
flatten = List.Flatten(list=getgeoelement_element)
filterTypesDBGeo = Python(IN[1]=flatten)  # CPython3; unwired: IN[0]
# ---------- filterTypesDBGeo.python (44 lines) ----------
import clr
import System
 
clr.AddReference("RevitServices")
import RevitServices
from RevitServices.Persistence import DocumentManager
from RevitServices.Transactions import TransactionManager

clr.AddReference("RevitNodes")
import Revit
clr.ImportExtensions(Revit.Elements)
clr.ImportExtensions(Revit.GeometryConversion)

clr.AddReference("RevitAPIUI")
from Autodesk.Revit.UI import*
clr.AddReference('RevitAPIUI')
from Autodesk.Revit.UI import Selection
from  Autodesk.Revit.UI.Selection import ISelectionFilter

clr.AddReference('RevitAPI')
from Autodesk.Revit.DB import*
from Autodesk.Revit.DB import Line, ModelLine, LinePattern, ElementId
import Autodesk.Revit.DB as RDB
doc = DocumentManager.Instance.CurrentDBDocument
View = doc.ActiveView
uidoc = DocumentManager.Instance.CurrentUIApplication.ActiveUIDocument
app  = uidoc.Application 
# #############################################################
# #                      FUNCTION                             #
# #############################################################
from Autodesk.Revit.DB import Line, GeometryInstance, Solid

def filterTypesDBGeo(lstGeo):
    mySet = set()
    for item in lstGeo:
        itemType = item.GetType().ToString()
        mySet.add(itemType)
    return mySet

# #############################################################
# #                      GEOMETRY                             #
# #############################################################
elements = UnwrapElement(IN[1]) if isinstance(IN[1],list) else [UnwrapElement(IN[1])]
OUT = filterTypesDBGeo(elements)
# ----------------------------------------
getdbsolidfromdbgeo_lstgeo = Python(IN[1]=getgeoelement_element)  # IronPython2; unwired: IN[0]
# ---------- getdbsolidfromdbgeo_lstgeo.python (46 lines) ----------
import clr
import System
 
clr.AddReference("RevitServices")
import RevitServices
from RevitServices.Persistence import DocumentManager
from RevitServices.Transactions import TransactionManager

clr.AddReference("RevitNodes")
import Revit
clr.ImportExtensions(Revit.Elements)
clr.ImportExtensions(Revit.GeometryConversion)

clr.AddReference("RevitAPIUI")
from Autodesk.Revit.UI import*
clr.AddReference('RevitAPIUI')
from Autodesk.Revit.UI import Selection
from  Autodesk.Revit.UI.Selection import ISelectionFilter

clr.AddReference('RevitAPI')
from Autodesk.Revit.DB import*
from Autodesk.Revit.DB import Line, ModelLine, LinePattern, ElementId
import Autodesk.Revit.DB as RDB
doc = DocumentManager.Instance.CurrentDBDocument
View = doc.ActiveView
uidoc = DocumentManager.Instance.CurrentUIApplication.ActiveUIDocument
app  = uidoc.Application 
# #############################################################
# #                      FUNCTION                             #
# #############################################################
def getDBSolidFromDBGeo(lstGeo):  # Way 1
    sol = []
    for i in lstGeo:
        if i.GetType() == Solid and i.Volume > 0:
            sol.append(i)
        elif i.GetType() == GeometryInstance:
            for j in i.GetInstanceGeometry():
                if isinstance(j, Solid):
                    if j.Volume > 0:
                        sol.append(j)
    return sol
# #############################################################
# #                      GEOMETRY                             #
# #############################################################
elements = UnwrapElement(IN[1]) if isinstance(IN[1],list) else [UnwrapElement(IN[1])]
OUT = [getDBSolidFromDBGeo(ele) for ele in elements]
# ----------------------------------------
getplanarfacesformsolid_solids = Python(IN[1]=getdbsolidfromdbgeo_lstgeo)  # IronPython2; unwired: IN[0]
# ---------- getplanarfacesformsolid_solids.python (48 lines) ----------
import clr
import System
 
clr.AddReference("RevitServices")
import RevitServices
from RevitServices.Persistence import DocumentManager
from RevitServices.Transactions import TransactionManager


clr.AddReference("RevitNodes")
import Revit
clr.ImportExtensions(Revit.Elements)
clr.ImportExtensions(Revit.GeometryConversion)

clr.AddReference("RevitAPIUI")
from Autodesk.Revit.UI import*
clr.AddReference('RevitAPIUI')
from Autodesk.Revit.UI import Selection
from  Autodesk.Revit.UI.Selection import ISelectionFilter

clr.AddReference('RevitAPI')
from Autodesk.Revit.DB import*
from Autodesk.Revit.DB import Line, ModelLine, LinePattern, ElementId
import Autodesk.Revit.DB as RDB
from Autodesk.Revit.DB import Line, GeometryInstance, Solid

doc = DocumentManager.Instance.CurrentDBDocument
View = doc.ActiveView
uidoc = DocumentManager.Instance.CurrentUIApplication.ActiveUIDocument
app  = uidoc.Application 
# #############################################################
# #                      FUNCTION                             #
# #############################################################
def getPlanarFacesFormSolid(solids): # Get PlanarFace from solids
    planarFaces = []
    for i in solids:
        var = i.Faces
        for j in var:
            if j.Reference != None:
                planarFaces.append(j)
    return planarFaces

# #############################################################
# #                      GEOMETRY                             #
# #############################################################

elements = UnwrapElement(IN[1]) if isinstance(IN[1],list) else [UnwrapElement(IN[1])]
OUT = [getPlanarFacesFormSolid(e) for e in elements]
# ----------------------------------------
filterverticaldbplanarface = Python(IN[1]=getplanarfacesformsolid_solids)  # "filterVerticalDBPlanarFace(dbPlanarFaces)"; CPython3; unwired: IN[0]
# ---------- filterverticaldbplanarface.python (52 lines) ----------
import clr
import System
 
clr.AddReference("RevitServices")
import RevitServices
from RevitServices.Persistence import DocumentManager
from RevitServices.Transactions import TransactionManager


clr.AddReference("RevitNodes")
import Revit
clr.ImportExtensions(Revit.Elements)
clr.ImportExtensions(Revit.GeometryConversion)

clr.AddReference("RevitAPIUI")
from Autodesk.Revit.UI import*
clr.AddReference('RevitAPIUI')
from Autodesk.Revit.UI import Selection
from  Autodesk.Revit.UI.Selection import ISelectionFilter

clr.AddReference('RevitAPI')
from Autodesk.Revit.DB import*
from Autodesk.Revit.DB import Line, ModelLine, LinePattern, ElementId
import Autodesk.Revit.DB as RDB
from Autodesk.Revit.DB import Line, GeometryInstance, Solid

doc = DocumentManager.Instance.CurrentDBDocument
View = doc.ActiveView
uidoc = DocumentManager.Instance.CurrentUIApplication.ActiveUIDocument
app  = uidoc.Application 
# #############################################################
# #                      FUNCTION                             #
# #############################################################
def isParalel(p,q):
    return p.CrossProduct(q).IsZeroLength()

def filterVerticalDBPlanarFace(dbPlanarFaces): # Get Vertical PlannarFaces 
    faV = []
    y = XYZ.BasisY
    for i in dbPlanarFaces:
        faNomal = i.FaceNormal
        check  = isParalel(y,faNomal)
        if check == True:
            faV.append(i)
    return faV

# #############################################################
# #                      GEOMETRY                             #
# #############################################################

elements = UnwrapElement(IN[1]) if isinstance(IN[1],list) else [UnwrapElement(IN[1])]
OUT = [filterVerticalDBPlanarFace(e) for e in elements]
# ----------------------------------------
getedgesplanarfaces = Python(IN[1]=filterverticaldbplanarface)  # "getEdgesPlanarFaces(dbPlanarFaces)"; CPython3; unwired: IN[0]
# ---------- getedgesplanarfaces.python (47 lines) ----------
import clr
import System
 
clr.AddReference("RevitServices")
import RevitServices
from RevitServices.Persistence import DocumentManager
from RevitServices.Transactions import TransactionManager


clr.AddReference("RevitNodes")
import Revit
clr.ImportExtensions(Revit.Elements)
clr.ImportExtensions(Revit.GeometryConversion)

clr.AddReference("RevitAPIUI")
from Autodesk.Revit.UI import*
clr.AddReference('RevitAPIUI')
from Autodesk.Revit.UI import Selection
from  Autodesk.Revit.UI.Selection import ISelectionFilter

clr.AddReference('RevitAPI')
from Autodesk.Revit.DB import*
from Autodesk.Revit.DB import Line, ModelLine, LinePattern, ElementId
import Autodesk.Revit.DB as RDB
from Autodesk.Revit.DB import Line, GeometryInstance, Solid

doc = DocumentManager.Instance.CurrentDBDocument
View = doc.ActiveView
uidoc = DocumentManager.Instance.CurrentUIApplication.ActiveUIDocument
app  = uidoc.Application 
# #############################################################
# #                      FUNCTION                             #
# #############################################################
def getEdgesPlanarFaces(dbPlanarFaces): # Get DBLines of PlanarFaces
    result = []
    var = dbPlanarFaces.EdgeLoops
    for i in var:
        re = []
        for j in i:
            re.append(j.AsCurve())
        result.append(re)
    return result
# #############################################################
# #                      GEOMETRY                             #
# #############################################################
elements = UnwrapElement(IN[1]) if isinstance(IN[1],list) else [UnwrapElement(IN[1])]
OUT = [getEdgesPlanarFaces(j) for e in elements for j in e]
# ----------------------------------------
getdblinesmax_dblines = Python(IN[1]=getedgesplanarfaces)  # CPython3; unwired: IN[0]
# ---------- getdblinesmax_dblines.python (53 lines) ----------
import clr
import System
 
clr.AddReference("RevitServices")
import RevitServices
from RevitServices.Persistence import DocumentManager
from RevitServices.Transactions import TransactionManager


clr.AddReference("RevitNodes")
import Revit
clr.ImportExtensions(Revit.Elements)
clr.ImportExtensions(Revit.GeometryConversion)

clr.AddReference("RevitAPIUI")
from Autodesk.Revit.UI import*
clr.AddReference('RevitAPIUI')
from Autodesk.Revit.UI import Selection
from  Autodesk.Revit.UI.Selection import ISelectionFilter

clr.AddReference('RevitAPI')
from Autodesk.Revit.DB import*
from Autodesk.Revit.DB import Line, ModelLine, LinePattern, ElementId
import Autodesk.Revit.DB as RDB
from Autodesk.Revit.DB import Line, GeometryInstance, Solid

doc = DocumentManager.Instance.CurrentDBDocument
View = doc.ActiveView
uidoc = DocumentManager.Instance.CurrentUIApplication.ActiveUIDocument
app  = uidoc.Application 
# #############################################################
# #                      FUNCTION                             #
# #############################################################
def getDbLinesMax(dbLines): # Get a min line of list line
    _length = []
    dbLineMax = []
    for i in dbLines:
        r1 = []
        for z in i:
            r1.append(z.Length)
        _length.append(r1)
    for j in range(len(dbLines)):
        r2 = []
        for l in dbLines[j]:
            if l.Length == max(_length[j]):
                r2.append(l)
        dbLineMax.append(r2)
    return dbLineMax
# #############################################################
# #                      GEOMETRY                             #
# #############################################################
elements = UnwrapElement(IN[1]) if isinstance(IN[1],list) else [UnwrapElement(IN[1])]
OUT = [getDbLinesMax(e) for e in elements]
# ----------------------------------------
code_block = CodeBlock(a=getdblinesmax_dblines) { a[0][0]; }
firstItem = List.FirstItem(list=code_block)
create_dbline_from_crossproduct = Python(IN[1]=firstItem)  # IronPython2; unwired: IN[0]
# ---------- create_dbline_from_crossproduct.python (52 lines) ----------
import clr
import System
 
clr.AddReference("RevitServices")
import RevitServices
from RevitServices.Persistence import DocumentManager
from RevitServices.Transactions import TransactionManager


clr.AddReference("RevitNodes")
import Revit
clr.ImportExtensions(Revit.Elements)
clr.ImportExtensions(Revit.GeometryConversion)

clr.AddReference("RevitAPIUI")
from Autodesk.Revit.UI import*
clr.AddReference('RevitAPIUI')
from  Autodesk.Revit.UI.Selection import*
from  Autodesk.Revit.UI.Selection import ISelectionFilter

clr.AddReference('RevitAPI')
from Autodesk.Revit.DB import*
from Autodesk.Revit.DB import Line, ModelLine, LinePattern, ElementId
import Autodesk.Revit.DB as RDB
from Autodesk.Revit.DB import Line, GeometryInstance, Solid

doc = DocumentManager.Instance.CurrentDBDocument
View = doc.ActiveView
uidoc = DocumentManager.Instance.CurrentUIApplication.ActiveUIDocument
app  = uidoc.Application 
# #############################################################
# #                      FUNCTION                             #
# #############################################################

# #############################################################
# #                      GEOMETRY                             #
# #############################################################
getLineMax = IN[1]

vtxPlane = XYZ.BasisZ
vtxSection = XYZ.BasisY

ptsLine1 = getLineMax.GetEndPoint(0)
ptsLine2 = getLineMax.GetEndPoint(1)

pickPoint = uidoc.Selection.PickPoint("Select Point")

vtxFromLine = ptsLine1 - ptsLine2

direct = vtxPlane.CrossProduct(vtxFromLine) 
dbLine = Line.CreateBound(pickPoint,pickPoint+direct)
OUT = dbLine
# ----------------------------------------
flatten_2 = List.Flatten(list=filterverticaldbplanarface)

# group: Design Script
boolean = BoolSelector(false)
python_script = Python(IN[0]=boolean)  # CPython3
# ---------- python_script.python (4 lines) ----------
#f = open(r"U:\17_TrainingAdvanceDynamo\2_WORKING\Tool\Dynamo\Training-Dynamo-2024\DesignScript.py", "r")

f = open(r"A:\Library-Dynamo-Python-CSharp\test.py", "r")
OUT = f.read() 
# ----------------------------------------
python_script_from_string = PythonStringNode(script=python_script, IN[1]=create_dbline_from_crossproduct, IN[2]=flatten_2)  # IronPython2; unwired: IN[0]

code_block_2 = CodeBlock(a=python_script_from_string) { [a]; }
conversionRtD = Custom[ConversionRtD](Objects=code_block_2)  # Return an object entity that can be displayed on the Dynamo interface.
getFaceNormal = Python(IN[1]=getplanarfacesformsolid_solids)  # CPython3; unwired: IN[0]
# ---------- getFaceNormal.python (40 lines) ----------
import clr
import System
 
clr.AddReference("RevitServices")
import RevitServices
from RevitServices.Persistence import DocumentManager
from RevitServices.Transactions import TransactionManager


clr.AddReference("RevitNodes")
import Revit
clr.ImportExtensions(Revit.Elements)
clr.ImportExtensions(Revit.GeometryConversion)

clr.AddReference("RevitAPIUI")
from Autodesk.Revit.UI import*
clr.AddReference('RevitAPIUI')
from Autodesk.Revit.UI import Selection
from  Autodesk.Revit.UI.Selection import ISelectionFilter

clr.AddReference('RevitAPI')
from Autodesk.Revit.DB import*
from Autodesk.Revit.DB import Line, ModelLine, LinePattern, ElementId
import Autodesk.Revit.DB as RDB
from Autodesk.Revit.DB import Line, GeometryInstance, Solid

doc = DocumentManager.Instance.CurrentDBDocument
View = doc.ActiveView
uidoc = DocumentManager.Instance.CurrentUIApplication.ActiveUIDocument
app  = uidoc.Application 
# #############################################################
# #                      FUNCTION                             #
# #############################################################
def getFaceNormal(dbPlanarFaces):
    return [e.FaceNormal for e in dbPlanarFaces]
# #############################################################
# #                      GEOMETRY                             #
# #############################################################
elements = UnwrapElement(IN[1]) if isinstance(IN[1],list) else [UnwrapElement(IN[1])]
OUT = [getFaceNormal(e) for e in elements]
# ----------------------------------------
getreferencearray_bbplanarfaces = Python(IN[1]=filterverticaldbplanarface)  # IronPython2; unwired: IN[0]
# ---------- getreferencearray_bbplanarfaces.python (43 lines) ----------
import clr
import System
 
clr.AddReference("RevitServices")
import RevitServices
from RevitServices.Persistence import DocumentManager
from RevitServices.Transactions import TransactionManager


clr.AddReference("RevitNodes")
import Revit
clr.ImportExtensions(Revit.Elements)
clr.ImportExtensions(Revit.GeometryConversion)

clr.AddReference("RevitAPIUI")
from Autodesk.Revit.UI import*
clr.AddReference('RevitAPIUI')
from Autodesk.Revit.UI import Selection
from  Autodesk.Revit.UI.Selection import ISelectionFilter

clr.AddReference('RevitAPI')
from Autodesk.Revit.DB import*
from Autodesk.Revit.DB import Line, ModelLine, LinePattern, ElementId
import Autodesk.Revit.DB as RDB
from Autodesk.Revit.DB import Line, GeometryInstance, Solid

doc = DocumentManager.Instance.CurrentDBDocument
View = doc.ActiveView
uidoc = DocumentManager.Instance.CurrentUIApplication.ActiveUIDocument
app  = uidoc.Application 
# #############################################################
# #                      FUNCTION                             #
# #############################################################
def getReferenceArray(bbPlanarFaces):
    reArray = ReferenceArray()
    for i in bbPlanarFaces:
        reArray.Append(i.Reference)
    return reArray
# #############################################################
# #                      GEOMETRY                             #
# #############################################################
elements = UnwrapElement(IN[1]) if isinstance(IN[1],list) else [UnwrapElement(IN[1])]
OUT = [getReferenceArray(e) for e in elements]
# ----------------------------------------
conversionRtD_2 = Custom[ConversionRtD](Objects=getdbsolidfromdbgeo_lstgeo)  # frozen
code_block_3 = CodeBlock {  }

# group: Design Script
boolean_2 = BoolSelector(false)
python_script_2 = Python(IN[0]=boolean_2)  # CPython3; same code as python_script
python_script_from_string_2 = PythonStringNode(script=python_script_2)  # IronPython2; unwired: IN[0], IN[1], IN[2]

code_block_4 = CodeBlock { ["Grids"]; }
boolean_3 = BoolSelector(true)
selectionElementsByCategoryNameAndClassi = Custom[SelectionElementsByCategoryNameAndClassification](categoryNames=code_block_4, reset=boolean_3)  # Returning the elements you want to select based on the name of the category you pass as a parameter. Subsequently, classify them for you.
valueAtKey = DesignScript.Builtin.Dictionary.ValueAtKey(dictionary=selectionElementsByCategoryNameAndClassi, key=code_block_4)
flatten_3 = List.Flatten(list=valueAtKey)
getreferenceofgrid_elementgrids = Python(IN[1]=flatten_3)  # IronPython2; unwired: IN[0]
# ---------- getreferenceofgrid_elementgrids.python (52 lines) ----------
import clr
import System
 
clr.AddReference("RevitServices")
import RevitServices
from RevitServices.Persistence import DocumentManager
from RevitServices.Transactions import TransactionManager


clr.AddReference("RevitNodes")
import Revit
clr.ImportExtensions(Revit.Elements)
clr.ImportExtensions(Revit.GeometryConversion)

clr.AddReference("RevitAPIUI")
from Autodesk.Revit.UI import*
clr.AddReference('RevitAPIUI')
from  Autodesk.Revit.UI.Selection import*
from  Autodesk.Revit.UI.Selection import ISelectionFilter

clr.AddReference('RevitAPI')
from Autodesk.Revit.DB import*
from Autodesk.Revit.DB import Line, ModelLine, LinePattern, ElementId
import Autodesk.Revit.DB as RDB
from Autodesk.Revit.DB import Line, GeometryInstance, Solid

doc = DocumentManager.Instance.CurrentDBDocument
view = doc.ActiveView
uidoc = DocumentManager.Instance.CurrentUIApplication.ActiveUIDocument
app  = uidoc.Application 
# #############################################################
# #                      FUNCTION                             #
def getRefArrayFromGrids(grids,doc):
    refArray = ReferenceArray()
    opt = Options()
    opt.ComputeReferences= True
    opt.IncludeNonVisibleObjects = True
    opt.View = doc.ActiveView
    for i in UnwrapElement(grids):
        f = (i.get_Geometry(opt))
        for j in f:
            if j.GetType() == Line:
                refArray.Append(j.Reference)
    return refArray
# #############################################################

# #############################################################
# #                      GEOMETRY                             #
# #############################################################

elements = UnwrapElement(IN[1]) if isinstance(IN[1],list) else [UnwrapElement(IN[1])]
OUT = getRefArrayFromGrids(elements, doc)
# ----------------------------------------
getdbgrids_elementgrids = Python(IN[1]=flatten_3)  # IronPython2; unwired: IN[0]
# ---------- getdbgrids_elementgrids.python (52 lines) ----------
import clr
import System
 
clr.AddReference("RevitServices")
import RevitServices
from RevitServices.Persistence import DocumentManager
from RevitServices.Transactions import TransactionManager


clr.AddReference("RevitNodes")
import Revit
clr.ImportExtensions(Revit.Elements)
clr.ImportExtensions(Revit.GeometryConversion)

clr.AddReference("RevitAPIUI")
from Autodesk.Revit.UI import*
clr.AddReference('RevitAPIUI')
from  Autodesk.Revit.UI.Selection import*
from  Autodesk.Revit.UI.Selection import ISelectionFilter

clr.AddReference('RevitAPI')
from Autodesk.Revit.DB import*
from Autodesk.Revit.DB import Line, ModelLine, LinePattern, ElementId
import Autodesk.Revit.DB as RDB
from Autodesk.Revit.DB import Line, GeometryInstance, Solid

doc = DocumentManager.Instance.CurrentDBDocument
view = doc.ActiveView
uidoc = DocumentManager.Instance.CurrentUIApplication.ActiveUIDocument
app  = uidoc.Application 
# #############################################################
# #                      FUNCTION                             #
def getDbGrids(elementGrids): # Get Revit.DB.Reference from Grids
    opt = Options()
    opt.ComputeReferences = True
    opt.IncludeNonVisibleObjects = True
    opt.View = doc.ActiveView
    dbGrids = []
    for i in UnwrapElement(elementGrids):
        f = (i.get_Geometry(opt))
        for j in f:
            if j.GetType() == Line:
                dbGrids.append(j)
    return dbGrids
# #############################################################

# #############################################################
# #                      GRID                                 #
# #############################################################

elements = UnwrapElement(IN[1]) if isinstance(IN[1],list) else [UnwrapElement(IN[1])]
OUT = getDbGrids(elements)
# ----------------------------------------
firstItem_2 = List.FirstItem(list=getdbgrids_elementgrids)
python_script_3 = Python(IN[1]=firstItem_2)  # IronPython2; unwired: IN[0]; same code as create_dbline_from_crossproduct
code_block_5 = CodeBlock(a=python_script_3) { [a]; }
conversionRtD_3 = Custom[ConversionRtD](Objects=code_block_5)
getrefarrayfromgrids_grids_doc = Python(IN[1]=python_script_3, IN[2]=flatten_3)  # "getRefArrayFromGrids(grids, doc) => DIM"; IronPython2; unwired: IN[0]
# ---------- getrefarrayfromgrids_grids_doc.python (58 lines) ----------
import clr
import System
 
clr.AddReference("RevitServices")
import RevitServices
from RevitServices.Persistence import DocumentManager
from RevitServices.Transactions import TransactionManager


clr.AddReference("RevitNodes")
import Revit
clr.ImportExtensions(Revit.Elements)
clr.ImportExtensions(Revit.GeometryConversion)

clr.AddReference("RevitAPIUI")
from Autodesk.Revit.UI import*
clr.AddReference('RevitAPIUI')
from  Autodesk.Revit.UI.Selection import*
from  Autodesk.Revit.UI.Selection import ISelectionFilter

clr.AddReference('RevitAPI')
from Autodesk.Revit.DB import*
from Autodesk.Revit.DB import Line, ModelLine, LinePattern, ElementId
import Autodesk.Revit.DB as RDB
from Autodesk.Revit.DB import Line, GeometryInstance, Solid

doc = DocumentManager.Instance.CurrentDBDocument
view = doc.ActiveView
uidoc = DocumentManager.Instance.CurrentUIApplication.ActiveUIDocument
app  = uidoc.Application 
# #############################################################
# #                      FUNCTION                             #
def getRefArrayFromGrids(grids,doc):
    refArray = ReferenceArray()
    opt = Options()
    opt.ComputeReferences= True
    opt.IncludeNonVisibleObjects = True
    opt.View = doc.ActiveView
    for i in UnwrapElement(grids):
        f = (i.get_Geometry(opt))
        for j in f:
            if j.GetType() == Line:
                refArray.Append(j.Reference)
    return refArray
# #############################################################

# #############################################################
# #                      GEOMETRY                             #
# #############################################################

dbLine = IN[1]
grids = IN[2]

TransactionManager.Instance.EnsureInTransaction(doc)
refs = getRefArrayFromGrids(grids, doc)
dim = doc.Create.NewDimension(view, dbLine, refs)
TransactionManager.Instance.TransactionTaskDone()
OUT = dim
# ----------------------------------------
