# Dynamo graph DIM_Grids_v2.dyn (Dynamo 2.18.1.5096)

code_block = CodeBlock { ["Grids", "Data Devices"]; }
boolean = BoolSelector(false)
selectionElementsByCategoryNameAndClassi = Custom[SelectionElementsByCategoryNameAndClassification](categoryNames=code_block, reset=boolean)  # Returning the elements you want to select based on the name of the category you pass as a parameter. Subsequently, classify them for you.
valueAtKey = DesignScript.Builtin.Dictionary.ValueAtKey(dictionary=selectionElementsByCategoryNameAndClassi, key=code_block)
flatten = List.Flatten(list=valueAtKey)
getdbgrids_elementgrids = Python(IN[1]=flatten)  # IronPython2; unwired: IN[0]
# ---------- getdbgrids_elementgrids.python (52 lines) ----------
import clr
import System
 
clr.AddReference("RevitServices")
import RevitServices
from RevitServices.Persistence import DocumentManager
from RevitServices.Transactions import TransactionManager


clr.AddReference("RevitNodes")
import Revit
clr.ImportExtensions(Revit.Elements)
clr.ImportExtensions(Revit.GeometryConversion)

clr.AddReference("RevitAPIUI")
from Autodesk.Revit.UI import*
clr.AddReference('RevitAPIUI')
from  Autodesk.Revit.UI.Selection import*
from  Autodesk.Revit.UI.Selection import ISelectionFilter

clr.AddReference('RevitAPI')
from Autodesk.Revit.DB import*
from Autodesk.Revit.DB import Line, ModelLine, LinePattern, ElementId
import Autodesk.Revit.DB as RDB
from Autodesk.Revit.DB import Line, GeometryInstance, Solid

doc = DocumentManager.Instance.CurrentDBDocument
view = doc.ActiveView
uidoc = DocumentManager.Instance.CurrentUIApplication.ActiveUIDocument
app  = uidoc.Application 
# #############################################################
# #                      FUNCTION                             #
def getDbGrids(elementGrids): # Get Revit.DB.Reference from Grids
    opt = Options()
    opt.ComputeReferences = True
    opt.IncludeNonVisibleObjects = True
    opt.View = doc.ActiveView
    dbGrids = []
    for i in UnwrapElement(elementGrids):
        f = (i.get_Geometry(opt))
        for j in f:
            if j.GetType() == Line:
                dbGrids.append(j)
    return dbGrids
# #############################################################

# #############################################################
# #                      GRID                                 #
# #############################################################

elements = UnwrapElement(IN[1]) if isinstance(IN[1],list) else [UnwrapElement(IN[1])]
OUT = getDbGrids(elements)
# ----------------------------------------
firstItem = List.FirstItem(list=getdbgrids_elementgrids)
python_script = Python(IN[1]=firstItem)  # IronPython2; unwired: IN[0]
# ---------- python_script.python (52 lines) ----------
import clr
import System
 
clr.AddReference("RevitServices")
import RevitServices
from RevitServices.Persistence import DocumentManager
from RevitServices.Transactions import TransactionManager


clr.AddReference("RevitNodes")
import Revit
clr.ImportExtensions(Revit.Elements)
clr.ImportExtensions(Revit.GeometryConversion)

clr.AddReference("RevitAPIUI")
from Autodesk.Revit.UI import*
clr.AddReference('RevitAPIUI')
from  Autodesk.Revit.UI.Selection import*
from  Autodesk.Revit.UI.Selection import ISelectionFilter

clr.AddReference('RevitAPI')
from Autodesk.Revit.DB import*
from Autodesk.Revit.DB import Line, ModelLine, LinePattern, ElementId
import Autodesk.Revit.DB as RDB
from Autodesk.Revit.DB import Line, GeometryInstance, Solid

doc = DocumentManager.Instance.CurrentDBDocument
View = doc.ActiveView
uidoc = DocumentManager.Instance.CurrentUIApplication.ActiveUIDocument
app  = uidoc.Application 
# #############################################################
# #                      FUNCTION                             #
# #############################################################

# #############################################################
# #                      GEOMETRY                             #
# #############################################################
getLineMax = IN[1]

vtxPlane = XYZ.BasisZ
vtxSection = XYZ.BasisY

ptsLine1 = getLineMax.GetEndPoint(0)
ptsLine2 = getLineMax.GetEndPoint(1)

pickPoint = uidoc.Selection.PickPoint("Select Point")

vtxFromLine = ptsLine1 - ptsLine2

direct = vtxPlane.CrossProduct(vtxFromLine) 
dbLine = Line.CreateBound(pickPoint,pickPoint+direct)
OUT = dbLine
# ----------------------------------------
code_block_2 = CodeBlock(a=getdbgrids_elementgrids) { a[0]; }
code_block_3 = CodeBlock(a=getdbgrids_elementgrids) { a[2]; }
code_block_4 = CodeBlock(a=code_block_2, b=code_block_3) { [a,b]; }

# group: Design Script
boolean_2 = BoolSelector(true)
python_script_2 = Python(IN[0]=boolean_2)  # CPython3
# ---------- python_script_2.python (4 lines) ----------
#f = open(r"U:\17_TrainingAdvanceDynamo\2_WORKING\Tool\Dynamo\Training-Dynamo-2024\DesignScript.py", "r")

f = open(r"A:\Library-Dynamo-Python-CSharp\test.py", "r")
OUT = f.read() 
# ----------------------------------------
python_script_from_string = PythonStringNode(script=python_script_2, IN[1]=python_script, IN[2]=code_block_4)  # IronPython2; unwired: IN[0]

code_block_5 = CodeBlock(a=python_script_from_string) { [a]; }
conversionRtD = Custom[ConversionRtD](Objects=code_block_5)  # Return an object entity that can be displayed on the Dynamo interface.
getrefarrayfromgrids_grids_doc = Python(IN[1]=python_script, IN[2]=code_block_4)  # "getRefArrayFromGrids(grids, doc) => DIM"; IronPython2; unwired: IN[0]
# ---------- getrefarrayfromgrids_grids_doc.python (58 lines) ----------
import clr
import System
 
clr.AddReference("RevitServices")
import RevitServices
from RevitServices.Persistence import DocumentManager
from RevitServices.Transactions import TransactionManager


clr.AddReference("RevitNodes")
import Revit
clr.ImportExtensions(Revit.Elements)
clr.ImportExtensions(Revit.GeometryConversion)

clr.AddReference("RevitAPIUI")
from Autodesk.Revit.UI import*
clr.AddReference('RevitAPIUI')
from  Autodesk.Revit.UI.Selection import*
from  Autodesk.Revit.UI.Selection import ISelectionFilter

clr.AddReference('RevitAPI')
from Autodesk.Revit.DB import*
from Autodesk.Revit.DB import Line, ModelLine, LinePattern, ElementId
import Autodesk.Revit.DB as RDB
from Autodesk.Revit.DB import Line, GeometryInstance, Solid

doc = DocumentManager.Instance.CurrentDBDocument
view = doc.ActiveView
uidoc = DocumentManager.Instance.CurrentUIApplication.ActiveUIDocument
app  = uidoc.Application 
# #############################################################
# #                      FUNCTION                             #
def getRefArrayFromGrids(grids,doc):
    refArray = ReferenceArray()
    opt = Options()
    opt.ComputeReferences= True
    opt.IncludeNonVisibleObjects = True
    opt.View = doc.ActiveView
    for i in UnwrapElement(grids):
        f = (i.get_Geometry(opt))
        for j in f:
            if j.GetType() == Line:
                refArray.Append(j.Reference)
    return refArray
# #############################################################

# #############################################################
# #                      GEOMETRY                             #
# #############################################################

dbLine = IN[1]
grids = IN[2]

TransactionManager.Instance.EnsureInTransaction(doc)
refs = getRefArrayFromGrids(grids, doc)
dim = doc.Create.NewDimension(view, dbLine, refs)
TransactionManager.Instance.TransactionTaskDone()
OUT = dim
# ----------------------------------------
conversionRtD_2 = Custom[ConversionRtD](Objects=getdbgrids_elementgrids)
code_block_6 = CodeBlock(a=conversionRtD_2) { [a[2]]; }
conversionRtD_3 = Custom[ConversionRtD](Objects=code_block_6)
code_block_7 = CodeBlock(a=flatten) { a[1]; }
python_script_3 = Python(IN[1]=code_block_7)  # IronPython2; unwired: IN[0]
# ---------- python_script_3.python (55 lines) ----------
import clr
import System
 
clr.AddReference("RevitServices")
import RevitServices
from RevitServices.Persistence import DocumentManager
from RevitServices.Transactions import TransactionManager


clr.AddReference("RevitNodes")
import Revit
clr.ImportExtensions(Revit.Elements)
clr.ImportExtensions(Revit.GeometryConversion)

clr.AddReference("RevitAPIUI")
from Autodesk.Revit.UI import*
clr.AddReference('RevitAPIUI')
from  Autodesk.Revit.UI.Selection import*
from  Autodesk.Revit.UI.Selection import ISelectionFilter

clr.AddReference('RevitAPI')
from Autodesk.Revit.DB import*
from Autodesk.Revit.DB import Line, ModelLine, LinePattern, ElementId
import Autodesk.Revit.DB as RDB
from Autodesk.Revit.DB import Line, GeometryInstance, Solid

doc = DocumentManager.Instance.CurrentDBDocument
view = doc.ActiveView
uidoc = DocumentManager.Instance.CurrentUIApplication.ActiveUIDocument
app  = uidoc.Application 
# #############################################################
# #                      FUNCTION                             #
def getLocationXYZ(element): # Get XYZ of element.    
    point = element.Location
    return XYZ(point.X, point.Y, point.Z)

def getLocationXYZMoveY(element): # Get XYZ of element.    
    point = element.Location
    return XYZ(point.X, point.Y - 100000, point.Z)
# #############################################################

# #############################################################
# #                      GEOMETRY                             #
# #############################################################

element = IN[1]
xyzElement = getLocationXYZ(element)
editedYxyzElement = getLocationXYZMoveY(element)

vtxFromXYZ = editedYxyzElement - xyzElement
vtxPlane = XYZ.BasisZ
direct = vtxPlane.CrossProduct(vtxFromXYZ) 
line = Line.CreateBound(xyzElement,xyzElement+direct)

OUT = line
# ----------------------------------------
