# Dynamo graph DesignScript.dyn (Dynamo 2.10.1.3976)
# packages: BIM3DM 2.1.26

python_script = Python()  # IronPython2; unwired: IN[0]
# ---------- python_script.python (12 lines) ----------
import random

# Define the size of the list and the range for the random numbers
list_size = 10
min_value = 1
max_value = 100

# Create the list of random numbers
random_numbers1 = [random.randint(min_value, max_value) for _ in range(list_size)]
random_numbers2 = [random.randint(min_value, max_value) for _ in range(list_size)]
random_numbers3 = [random.randint(min_value, max_value) for _ in range(list_size)]
OUT = random_numbers1, random_numbers2, random_numbers3
# ----------------------------------------
code_block = CodeBlock(a=python_script) { a[0]; a[1]; a[2]; }
code_block_2 = CodeBlock(x=code_block.out0, y=code_block.out1, z=code_block.out2) { Point.ByCoordinates(x,y,z); }
code_block_3 = CodeBlock { "Z"; }
code_block_4 = CodeBlock { 500; }

# group: Design Script
boolean = BoolSelector(false)
python_script_2 = Python(IN[0]=boolean)  # CPython3
# ---------- python_script_2.python (3 lines) ----------
f = open(r"U:\17_TrainingAdvanceDynamo\2_WORKING\Tool\Dynamo\Traning-Dynamo-2024\DesignScript.py", "r")
#f = open(r"A:\Library-Dynamo-Python-CSharp\test.py", "r")
OUT = f.read() 
# ----------------------------------------
python_script_from_string = PythonStringNode(script=python_script_2, IN[0]=code_block_2, IN[1]=code_block_3, IN[2]=code_block_4)  # IronPython2

python_script_3 = Python()  # IronPython2; unwired: IN[0]
# ---------- python_script_3.python (94 lines) ----------
import clr
clr.AddReference("System")
import System
clr.AddReference('RevitAPI')
from Autodesk.Revit.DB import *
from Autodesk.Revit.DB import Transaction, FilteredElementCollector
from System.Collections.Generic import List
import json

clr.AddReference('RevitAPIUI')
from Autodesk.Revit.UI import *
from Autodesk.Revit.UI.Selection import *

clr.AddReference("RevitServices")
import RevitServices
from RevitServices.Persistence import DocumentManager
from RevitServices.Transactions import TransactionManager
#########################################################################

import wpf
from System.Windows import Application, Window
from System.Windows.Controls import ListBoxItem, CheckBox, TextBox, RadioButton, Button, StackPanel, TextBlock
from System.Windows.Media import Brushes

#########################################################################
doc = DocumentManager.Instance.CurrentDBDocument
view = doc.ActiveView
uidoc = DocumentManager.Instance.CurrentUIApplication.ActiveUIDocument
#########################################################################

class ViewModel:
    def __init__(self):
        pass

class MyWindow(Window):
    def __init__(self, viewModel):
        self.ui = wpf.LoadComponent(self, "U:\\17_TraningAdvanceDynamo\\2_WORKING\\Tool\\Design\\ConfigSelections\\config_view.xaml")
        self.InitializeComponents()

    def InitializeComponents(self):
        self.searchBox = self.FindName("searchBox")
        self.listBox = self.FindName("listBox")
        self.jsonOutput = self.FindName("jsonOutput")
        self.rbtnCheckAll = self.FindName("rbtnCheckAll")
        self.rbtnCheckNone = self.FindName("rbtnCheckNone")
        self.btnOK = self.FindName("btnOK")
        self.btnCancel = self.FindName("btnCancel")

    def SearchBox_TextChanged(self, sender, e):
        searchText = self.searchBox.Text.lower()
        for item in self.listBox.Items:
            if isinstance(item, ListBoxItem) and isinstance(item.Content, CheckBox):
                checkBox = item.Content
                item.Visibility = System.Windows.Visibility.Visible if searchText in checkBox.Content.lower() else System.Windows.Visibility.Collapsed

    def rbtnCheckAll_Checked(self, sender, e):
        self.SetAllCheckBoxes(True)

    def rbtnCheckNone_Checked(self, sender, e):
        self.SetAllCheckBoxes(False)

    def SetAllCheckBoxes(self, isChecked):
        for item in self.listBox.Items:
            if isinstance(item, ListBoxItem) and isinstance(item.Content, CheckBox):
                checkBox = item.Content
                checkBox.IsChecked = isChecked
        self.UpdateJsonOutput()

    def CheckBox_Click(self, sender, e):
        self.UpdateJsonOutput()

    def UpdateJsonOutput(self):
        selected_items = []
        for item in self.listBox.Items:
            if isinstance(item, ListBoxItem) and isinstance(item.Content, CheckBox):
                checkBox = item.Content
                if checkBox.IsChecked:
                    selected_items.append({"name": checkBox.Content})
        json_output = json.dumps(selected_items, indent=4)
        self.jsonOutput.Text = json_output

    def btnOK_Click(self, sender, e):
        System.Windows.MessageBox.Show("OK button clicked")
        self.DialogResult = True
        self.Close()

    def btnCancel_Click(self, sender, e):
        System.Windows.MessageBox.Show("Cancel button clicked")
        self.DialogResult = False
        self.Close()

viewModel = ViewModel()
window = MyWindow(viewModel)
showDialog = window.ShowDialog()
# ----------------------------------------
number_slider = DoubleSlider(0, range=0..100 step 0.1)
Z = Point.Z(point=code_block_2)
maximumItem = List.MaximumItem(list=Z)
code_block_5 = CodeBlock(x=Z, y=maximumItem) { x==y; }
filterByBoolMask = List.FilterByBoolMask(list=code_block_2, mask=code_block_5)
code_block_6 = CodeBlock(max=filterByBoolMask.in) { max; }
python_script_4 = Python()  # IronPython2; unwired: IN[0]; same code as python_script
code_block_7 = CodeBlock(a=python_script_4) { a[0]; a[1]; a[2]; }
code_block_8 = CodeBlock(x=code_block_7.out0, y=code_block_7.out1, z=code_block_7.out2) { Point.ByCoordinates(x,y,z); }
code_block_9 = CodeBlock { "Z"; }
code_block_10 = CodeBlock { 500; }
python_script_5 = Python(IN[0]=code_block_8, IN[1]=code_block_9, IN[2]=code_block_10)  # IronPython2
# ---------- python_script_5.python (37 lines) ----------
"""Copyright(c) 2019 by: duengocnguyen@gmail.com"""
'https://www.youtube.com/channel/UCt2JhCDDFxpYho575WTMZ4g'
"""________________Welcome to BIM3DM-DYNAMO API___________________"""
import clr 
import sys
sys.path.append(r'C:\Program Files\Autodesk\Revit 2020\AddIns\DynamoForRevit\IronPython.StdLib.2.7.8')
sys.path.append(r'U:\17_TrainingAdvanceDynamo\2_WORKING\Tool\Dynamo\Traning-Dynamo-2024\Library')
from System.Collections.Generic import *

clr.AddReference("ProtoGeometry")
from Autodesk.DesignScript.Geometry import *
from Points import getMaxPoints


#Preparing input from dynamo to revit
elements = UnwrapElement(IN[0])
field = IN[1]
distance = IN[2]

def translatePointByField(points, field = 'x', distance = 0):
    newPoints = []
    for point in points:
        x = point.X
        y = point.Y
        z = point.Z
        
        if field == 'x' or field == 'X':
            x = x + distance
        if field == 'y' or field == 'Y':
            y = y + distance
        if field == 'z' or field == 'Z':
            z = z + distance
        _point = Point.ByCoordinates(x,y,z)
        newPoints.append(_point)
    return newPoints

OUT = translatePointByField(elements, field, distance)
# ----------------------------------------
showRank = Custom[ShowRank]()  # package BIM3DM; Returning the rank of an object passed to it.; unwired: object
code_block_11 = CodeBlock { 0..100..10; }
code_block_12 = CodeBlock { 0..100..10; }
boolean_2 = BoolSelector(false)
getItemsAtOldIndex = CodeBlock(list=code_block_12, isOldIndex=boolean_2) { list; isOldIndex; }
boolean_3 = BoolSelector(false)
getItemsAtOldIndex_2 = Custom[GetItemsAtOldIndex](list=code_block_12, isOldIndex=boolean_3)  # Return values at old index in a list
