# Dynamo graph DesignScript_SCRIPT.dyn (Dynamo 2.18.1.5096)

select_face = DSFaceSelection()  # 1 picked in the model
select_edge = DSEdgeSelection()  # nothing selected
select_model_element = DSModelElementSelection()  # 1 picked in the model
select_model_element_by_category = DSModelElementByCategorySelection()  # nothing selected; nothing selected
boolean = BoolSelector(false)  # frozen
python_script = Python(IN[0]=boolean)  # IronPython2
# ---------- python_script.python (49 lines) ----------
"""Copyright(c) 2019 by: duengocnguyen@gmail.com"""
'https://www.youtube.com/channel/UCt2JhCDDFxpYho575WTMZ4g'
"""________________Welcome to BIM3DM-DYNAMO API___________________"""
import clr 
import sys
sys.path.append(r'C:\Program Files\Autodesk\Revit 2020\AddIns\DynamoForRevit\IronPython.StdLib.2.7.8')
import math 
from System.Collections.Generic import *

clr.AddReference("ProtoGeometry")
from Autodesk.DesignScript.Geometry import *

clr.AddReference('RevitAPI')
import Autodesk
from Autodesk.Revit.DB import *

clr.AddReference('RevitAPIUI')
from Autodesk.Revit.UI import*
from  Autodesk.Revit.UI.Selection import*

clr.AddReference("RevitNodes")
import Revit
clr.ImportExtensions(Revit.Elements)
clr.ImportExtensions(Revit.GeometryConversion)

clr.AddReference("RevitServices")
import RevitServices
from RevitServices.Persistence import DocumentManager

from RevitServices.Transactions import TransactionManager

doc = DocumentManager.Instance.CurrentDBDocument
view = doc.ActiveView
uidoc = DocumentManager.Instance.CurrentUIApplication.ActiveUIDocument

#Preparing input from dynamo to revit

objType =  ObjectType.Element



selectedRef =  uidoc.Selection.PickObject(objType)


elementId = selectedRef.ElementId

selectedElement = doc.GetElement(elementId)

OUT = selectedElement, elementId
# ----------------------------------------
python_script_2 = Python()  # CPython3; unwired: IN[0]
# ---------- python_script_2.python (46 lines) ----------
"""Copyright(c) 2019 by: duengocnguyen@gmail.com"""
'https://www.youtube.com/channel/UCt2JhCDDFxpYho575WTMZ4g'
"""________________Welcome to BIM3DM-DYNAMO API___________________"""
import clr 
import sys
sys.path.append(r'C:\Program Files\Autodesk\Revit 2020\AddIns\DynamoForRevit\IronPython.StdLib.2.7.8')
import math 
from System.Collections.Generic import *

clr.AddReference("ProtoGeometry")
from Autodesk.DesignScript.Geometry import *

clr.AddReference('RevitAPI')
import Autodesk
from Autodesk.Revit.DB import *

clr.AddReference('RevitAPIUI')
from Autodesk.Revit.UI import*
from  Autodesk.Revit.UI.Selection import*

clr.AddReference("RevitNodes")
import Revit
clr.ImportExtensions(Revit.Elements)
clr.ImportExtensions(Revit.GeometryConversion)

clr.AddReference("RevitServices")
import RevitServices
from RevitServices.Persistence import DocumentManager
from RevitServices.Transactions import TransactionManager

doc = DocumentManager.Instance.CurrentDBDocument
view = doc.ActiveView
uidoc = DocumentManager.Instance.CurrentUIApplication.ActiveUIDocument

#Preparing input from dynamo to revit
element = UnwrapElement(IN[0])

#Do some action in a Transaction
#TransactionManager.Instance.EnsureInTransaction(doc)
"""Now, You Can Code """



#TransactionManager.Instance.TransactionTaskDone()

OUT = element
# ----------------------------------------
boolean_2 = BoolSelector(false)
select_model_elements = Python(IN[0]=boolean_2)  # IronPython2; frozen
# ---------- select_model_elements.python (28 lines) ----------
import clr
clr.AddReference('RevitAPI')
import Autodesk
from Autodesk.Revit.DB import *

clr.AddReference("RevitServices")
import RevitServices
from RevitServices.Persistence import DocumentManager

clr.AddReference("RevitAPIUI")
from  Autodesk.Revit.UI import *

clr.AddReference("RevitNodes")
import Revit
clr.ImportExtensions(Revit.Elements)

doc = DocumentManager.Instance.CurrentDBDocument
uidoc=DocumentManager.Instance.CurrentUIApplication.ActiveUIDocument

obType = Selection.ObjectType.Element
refs = uidoc.Selection.PickObjects(obType, "🐶🐶🐶 Please!!!Seclect Model Elemnets.🐶🐶🐶🐶 ")
result = []
for ref in refs:
	element = doc.GetElement(ref.ElementId)
	result.Add(element.ToDSType(True))
	
	
OUT = result
# ----------------------------------------
boolean_3 = BoolSelector(true)
selectionfilter_iselectionfilter = Python(IN[0]=boolean_3)  # IronPython2
# ---------- selectionfilter_iselectionfilter.python (44 lines) ----------
import clr
import System
import math 
from System.Collections.Generic import *

clr.AddReference('ProtoGeometry')
from Autodesk.DesignScript.Geometry import *

clr.AddReference('RevitAPI')
import Autodesk
from Autodesk.Revit.DB import *

clr.AddReference('RevitAPIUI')
from Autodesk.Revit.UI import*
from  Autodesk.Revit.UI.Selection import*

clr.AddReference("RevitNodes")
import Revit
clr.ImportExtensions(Revit.Elements)
clr.ImportExtensions(Revit.GeometryConversion)

clr.AddReference("RevitServices")
import RevitServices
from RevitServices.Persistence import DocumentManager
from RevitServices.Transactions import TransactionManager

doc = DocumentManager.Instance.CurrentDBDocument
view = doc.ActiveView
uidoc = DocumentManager.Instance.CurrentUIApplication.ActiveUIDocument
class SelectionFilter(ISelectionFilter):
	def __init__(self, ctgName1 , ctgName2):
		self.ctgName1 = ctgName1
		self.ctgName2 = ctgName2

	def AllowElement(self, element):
		if element.Category.Name == self.ctgName1 or element.Category.Name == self.ctgName2:
			return True
		else:
			return False
	def AllowReference(ref, xyZ):
		return False
ele = SelectionFilter("Grids", "Structural Columns")
elSelectAll = uidoc.Selection.PickElementsByRectangle(ele,"Selects")
OUT = elSelectAll
# ----------------------------------------

# group: Design Script
boolean_4 = BoolSelector(false)
python_script_3 = Python(IN[0]=boolean_4)  # CPython3
# ---------- python_script_3.python (4 lines) ----------
f = open(r"U:\17_TrainingAdvanceDynamo\2_WORKING\Tool\Dynamo\Training-Dynamo-2024\DesignScript.py", "r")

#f = open(r"A:\Library-Dynamo-Python-CSharp\test.py", "r")
OUT = f.read() 
# ----------------------------------------
code_block = CodeBlock { ['b', 'b', 'b', 'b', 'b']; [300, 400,500,600,700]; }
python_script_from_string = PythonStringNode(script=python_script_3, IN[1]=selectionfilter_iselectionfilter, IN[2]=code_block.out0, IN[3]=code_block.out1)  # CPython3; unwired: IN[0]

type = Object.Type(object=python_script_from_string)
type_2 = Object.Type(object=selectionfilter_iselectionfilter)
code_block_2 = CodeBlock { "Type"; }
getParameterValueByName = Element.GetParameterValueByName(element=selectionfilter_iselectionfilter, parameterName=code_block_2)
code_block_3 = CodeBlock { ["b", "h"]; }
getParameterValueByName_2 = Element.GetParameterValueByName(element=getParameterValueByName, parameterName=code_block_3)
code_block_4 = CodeBlock()
# ---------- code_block_4.designscript (2 lines) ----------
[[500,500,500,500,500],
[600,600,600,550,600]];
# ----------------------------------------
code_block_5 = CodeBlock { "a"; "b"; }
python_script_4 = Python(IN[0]=code_block_5.out0, IN[1]=code_block_5.out1)  # CPython3
# ---------- python_script_4.python (4 lines) ----------
OUT = {
    IN[1]: [500, 600,500,600,700],
    IN[0] : [300, 400,500,600,700],
}
# ----------------------------------------
python_script_5 = Python(IN[0]=python_script_4)  # CPython3
# ---------- python_script_5.python (1 lines) ----------
OUT = IN[0]['b']
# ----------------------------------------
