# Dynamo graph Dictionary.dyn (Dynamo 3.1.0.4724)

code_block = CodeBlock { ["a2", "b2"]; }
code_block_2 = CodeBlock { [0,10]; }
byKeysValues = DesignScript.Builtin.Dictionary.ByKeysValues(keys=code_block, values=code_block_2)
code_block_3 = CodeBlock { [["200x30",1000, 600],["200x30",1000, 600],["200x30",1000, 600],["200x30",1000, 600],["200x30",1000, 600]]; }
code_block_4 = CodeBlock(a=code_block_3) { a[1]; }
boolean = BoolSelector(true)
python_script = Python(IN[0]=boolean)  # CPython3
# ---------- python_script.python (62 lines) ----------
info = {
    'structural_column_1' :{
        'bxh': '200x300',
        'length': 1000,
        'volume' : 600,
        'mark' : 'D1'
    },
     'structural_column_3' : {

        'bxh': '200x500',

        'length': 1000,

        'volume' : 600,

        'mark' : 'D1'

    },
         'structural_column_2' : {

        'bxh': '200x600',

        'length': 1000,

        'volume' : 600,

        'mark' : 'D1'

    },

     'structural_column_4' : {
        'bxh': '200x800',
        'length': 1000,
        'volume' : 600,
        'mark' : 'D1'
    },
     'structural_column_5' : {

        'bxh': '200x300',

        'length': 1000,

        'volume' : 600,

        'mark' : 'D1'

    },

     'structural_column_6' : {

        'bxh': '200x300',

        'length': 1000,

        'volume' : 600,

        'mark' : 'D1'

    }
}

OUT = info
# ----------------------------------------
code_block_5 = CodeBlock { "structural_column_3"; }
valueAtKey = DesignScript.Builtin.Dictionary.ValueAtKey(dictionary=python_script, key=code_block_5)
values = DesignScript.Builtin.Dictionary.Values(dictionary=valueAtKey)
byKeysValues_2 = Python(IN[1]=code_block, IN[2]=code_block_2)  # "Dictionary.ByKeysValues"; CPython3; unwired: IN[0]
# ---------- byKeysValues_2.python (11 lines) ----------
keys = IN[1]
values = IN[2]

output = dict()


if keys and values:
    for k, v in zip(keys, values):
        output[k] = v
    
OUT = output 
# ----------------------------------------
boolean_2 = BoolSelector(false)
code_block_6 = CodeBlock { ["a2", "b2"]; }
code_block_7 = CodeBlock { [0,10]; }
byKeysValues_3 = Python(IN[1]=code_block_6, IN[2]=code_block_7)  # "Dictionary.ByKeysValues"; CPython3; unwired: IN[0]; same code as byKeysValues_2
valueAtKey_2 = Python(IN[1]=python_script, IN[2]=code_block_5)  # "Dictionary.ValueAtKey"; CPython3; unwired: IN[0]
# ---------- valueAtKey_2.python (9 lines) ----------
_dict = IN[1]
key = IN[2]

output = {}
for obj in _dict:
    if str(key) == str(obj):
        output = _dict[key]
        break
OUT = output
# ----------------------------------------
valueAtKey_3 = Python(IN[1]=python_script, IN[2]=code_block_5)  # "Dictionary.ValueAtKey"; CPython3; unwired: IN[0]
# ---------- valueAtKey_3.python (7 lines) ----------
_dict = IN[1]
key = IN[2]


for k, v in _dict.items():
    if str(k) == str(key):  
        OUT = v
# ----------------------------------------
byKeysValues_4 = DesignScript.Builtin.Dictionary.ByKeysValues()  # unwired: keys, values
components = DesignScript.Builtin.Dictionary.Components(dictionary=python_script)
components_2 = Python(IN[1]=python_script)  # "Dictionary.Components"; CPython3; unwired: IN[0]
# ---------- components_2.python (10 lines) ----------
_dict = IN[1]


keys , values = [], []

for key, value in _dict.items():
    keys.append(key)
    values.append(value)
OUT = {'keys' :keys , 'values' : values} #Order By
    
# ----------------------------------------
python_script_2 = Python(IN[0]=components_2)  # CPython3
# ---------- python_script_2.python (1 lines) ----------
OUT = IN[0]['keys']
# ----------------------------------------
python_script_3 = Python(IN[0]=components_2)  # CPython3
# ---------- python_script_3.python (1 lines) ----------
OUT = IN[0]['values']
# ----------------------------------------
code_block_8 = CodeBlock(FirstArray=python_script) { FirstArray; }
code_block_9 = CodeBlock { ["structural_column_3", "structural_column_2"]; }
code_block_10 = CodeBlock { ["100", "500"]; }
setValueAtKeys = DesignScript.Builtin.Dictionary.SetValueAtKeys(dictionary=code_block_8, keys=code_block_9, values=code_block_10)
python_script_4 = Python(IN[1]=code_block_8, IN[2]=code_block_9, IN[3]=code_block_10)  # CPython3; unwired: IN[0]
# ---------- python_script_4.python (10 lines) ----------
_dict = IN[1]
_keyIndexs = IN[2]
_valueIndexs = IN[3]

for key, value in _dict.items():
    for keyIndex, valueIndex in zip(_keyIndexs, _valueIndexs):
        if str(key) == str(keyIndex):
            _dict[key] = valueIndex
            
OUT = _dict
# ----------------------------------------
