# Dynamo graph Geometry.dyn (Dynamo 2.18.1.5096)

code_block = CodeBlock { ["Structural Framing"]; }
boolean = BoolSelector(false)
selectionElementsByCategoryNameAndClassi = Custom[SelectionElementsByCategoryNameAndClassification](categoryNames=code_block, reset=boolean)  # Returning the elements you want to select based on the name of the category you pass as a parameter. Subsequently, classify them for you.
valueAtKey = DesignScript.Builtin.Dictionary.ValueAtKey(dictionary=selectionElementsByCategoryNameAndClassi, key=code_block)
flatten = List.Flatten(list=valueAtKey)
getgeoelement_element = Python(IN[1]=flatten)  # CPython3; unwired: IN[0]
# ---------- getgeoelement_element.python (48 lines) ----------
"""Copyright by: duengocnguyen@gmail.com"""
import clr 
import System
import math 
from System.Collections.Generic import *

clr.AddReference("ProtoGeometry")
from Autodesk.DesignScript.Geometry import *

clr.AddReference('RevitAPI')
import Autodesk
from Autodesk.Revit.DB import *

clr.AddReference('RevitAPIUI')
from Autodesk.Revit.UI import*
from  Autodesk.Revit.UI.Selection import*

clr.AddReference("RevitNodes")
import Revit
clr.ImportExtensions(Revit.Elements)
clr.ImportExtensions(Revit.GeometryConversion)

clr.AddReference("RevitServices")
import RevitServices
from RevitServices.Persistence import DocumentManager
from RevitServices.Transactions import TransactionManager

# Accessing the current Revit document and active view
doc = DocumentManager.Instance.CurrentDBDocument
view = doc.ActiveView
uidoc = DocumentManager.Instance.CurrentUIApplication.ActiveUIDocument
# #############################################################
# #                      FUNCTION                             #
# #############################################################
def getGeoElement(element): # Get geometry of element.
    geo = []
    opt = Options()
    opt.ComputeReferences = True
    opt.IncludeNonVisibleObjects = True
    opt.DetailLevel = ViewDetailLevel.Fine
    geoByElement = element.get_Geometry(opt)
    geo = [i for i in geoByElement]
    return geo
# #############################################################
# #                      GEOMETRY                             #
# #############################################################
elements = UnwrapElement(IN[1]) if isinstance(IN[1],list) else [UnwrapElement(IN[1])]
OUT = [getGeoElement(i) for i in elements]
# ----------------------------------------
flatten_2 = List.Flatten(list=getgeoelement_element)
filterTypesDBGeo = Python(IN[1]=flatten_2)  # CPython3; unwired: IN[0]
# ---------- filterTypesDBGeo.python (44 lines) ----------
import clr
import System
 
clr.AddReference("RevitServices")
import RevitServices
from RevitServices.Persistence import DocumentManager
from RevitServices.Transactions import TransactionManager

clr.AddReference("RevitNodes")
import Revit
clr.ImportExtensions(Revit.Elements)
clr.ImportExtensions(Revit.GeometryConversion)

clr.AddReference("RevitAPIUI")
from Autodesk.Revit.UI import*
clr.AddReference('RevitAPIUI')
from Autodesk.Revit.UI import Selection
from  Autodesk.Revit.UI.Selection import ISelectionFilter

clr.AddReference('RevitAPI')
from Autodesk.Revit.DB import*
from Autodesk.Revit.DB import Line, ModelLine, LinePattern, ElementId
import Autodesk.Revit.DB as RDB
doc = DocumentManager.Instance.CurrentDBDocument
View = doc.ActiveView
uidoc = DocumentManager.Instance.CurrentUIApplication.ActiveUIDocument
app  = uidoc.Application 
# #############################################################
# #                      FUNCTION                             #
# #############################################################
from Autodesk.Revit.DB import Line, GeometryInstance, Solid

def filterTypesDBGeo(lstGeo):
    mySet = set()
    for item in lstGeo:
        itemType = item.GetType().ToString()
        mySet.add(itemType)
    return mySet

# #############################################################
# #                      GEOMETRY                             #
# #############################################################
elements = UnwrapElement(IN[1]) if isinstance(IN[1],list) else [UnwrapElement(IN[1])]
OUT = filterTypesDBGeo(elements)
# ----------------------------------------

# group: Design Script
boolean_2 = BoolSelector(false)
python_script = Python(IN[0]=boolean_2)  # CPython3
# ---------- python_script.python (4 lines) ----------
#f = open(r"U:\17_TrainingAdvanceDynamo\2_WORKING\Tool\Dynamo\Training-Dynamo-2024\DesignScript.py", "r")

f = open(r"A:\Library-Dynamo-Python-CSharp\test.py", "r")
OUT = f.read() 
# ----------------------------------------
python_script_from_string = PythonStringNode(script=python_script)  # IronPython2; unwired: IN[0], IN[1], IN[2]

code_block_2 = CodeBlock(a=python_script_from_string) { [a]; }
conversionRtD = Custom[ConversionRtD](Objects=code_block_2)  # Return an object entity that can be displayed on the Dynamo interface.
getdbsolidfromdbgeo_lstgeo = Python(IN[1]=getgeoelement_element)  # IronPython2; unwired: IN[0]
# ---------- getdbsolidfromdbgeo_lstgeo.python (46 lines) ----------
import clr
import System
 
clr.AddReference("RevitServices")
import RevitServices
from RevitServices.Persistence import DocumentManager
from RevitServices.Transactions import TransactionManager

clr.AddReference("RevitNodes")
import Revit
clr.ImportExtensions(Revit.Elements)
clr.ImportExtensions(Revit.GeometryConversion)

clr.AddReference("RevitAPIUI")
from Autodesk.Revit.UI import*
clr.AddReference('RevitAPIUI')
from Autodesk.Revit.UI import Selection
from  Autodesk.Revit.UI.Selection import ISelectionFilter

clr.AddReference('RevitAPI')
from Autodesk.Revit.DB import*
from Autodesk.Revit.DB import Line, ModelLine, LinePattern, ElementId
import Autodesk.Revit.DB as RDB
doc = DocumentManager.Instance.CurrentDBDocument
View = doc.ActiveView
uidoc = DocumentManager.Instance.CurrentUIApplication.ActiveUIDocument
app  = uidoc.Application 
# #############################################################
# #                      FUNCTION                             #
# #############################################################
def getDBSolidFromDBGeo(lstGeo):  # Way 1
    sol = []
    for i in lstGeo:
        if i.GetType() == Solid and i.Volume > 0:
            sol.append(i)
        elif i.GetType() == GeometryInstance:
            for j in i.GetInstanceGeometry():
                if isinstance(j, Solid):
                    if j.Volume > 0:
                        sol.append(j)
    return sol
# #############################################################
# #                      GEOMETRY                             #
# #############################################################
elements = UnwrapElement(IN[1]) if isinstance(IN[1],list) else [UnwrapElement(IN[1])]
OUT = [getDBSolidFromDBGeo(ele) for ele in elements]
# ----------------------------------------
getplanarfacesformsolid_solids = Python(IN[1]=getdbsolidfromdbgeo_lstgeo)  # IronPython2; unwired: IN[0]
# ---------- getplanarfacesformsolid_solids.python (48 lines) ----------
import clr
import System
 
clr.AddReference("RevitServices")
import RevitServices
from RevitServices.Persistence import DocumentManager
from RevitServices.Transactions import TransactionManager


clr.AddReference("RevitNodes")
import Revit
clr.ImportExtensions(Revit.Elements)
clr.ImportExtensions(Revit.GeometryConversion)

clr.AddReference("RevitAPIUI")
from Autodesk.Revit.UI import*
clr.AddReference('RevitAPIUI')
from Autodesk.Revit.UI import Selection
from  Autodesk.Revit.UI.Selection import ISelectionFilter

clr.AddReference('RevitAPI')
from Autodesk.Revit.DB import*
from Autodesk.Revit.DB import Line, ModelLine, LinePattern, ElementId
import Autodesk.Revit.DB as RDB
from Autodesk.Revit.DB import Line, GeometryInstance, Solid

doc = DocumentManager.Instance.CurrentDBDocument
View = doc.ActiveView
uidoc = DocumentManager.Instance.CurrentUIApplication.ActiveUIDocument
app  = uidoc.Application 
# #############################################################
# #                      FUNCTION                             #
# #############################################################
def getPlanarFacesFormSolid(solids): # Get PlanarFace from solids
    planarFaces = []
    for i in solids:
        var = i.Faces
        for j in var:
            if j.Reference != None:
                planarFaces.append(j)
    return planarFaces

# #############################################################
# #                      GEOMETRY                             #
# #############################################################

elements = UnwrapElement(IN[1]) if isinstance(IN[1],list) else [UnwrapElement(IN[1])]
OUT = [getPlanarFacesFormSolid(e) for e in elements]
# ----------------------------------------
getFaceNormal = Python(IN[1]=getplanarfacesformsolid_solids)  # CPython3; unwired: IN[0]
# ---------- getFaceNormal.python (40 lines) ----------
import clr
import System
 
clr.AddReference("RevitServices")
import RevitServices
from RevitServices.Persistence import DocumentManager
from RevitServices.Transactions import TransactionManager


clr.AddReference("RevitNodes")
import Revit
clr.ImportExtensions(Revit.Elements)
clr.ImportExtensions(Revit.GeometryConversion)

clr.AddReference("RevitAPIUI")
from Autodesk.Revit.UI import*
clr.AddReference('RevitAPIUI')
from Autodesk.Revit.UI import Selection
from  Autodesk.Revit.UI.Selection import ISelectionFilter

clr.AddReference('RevitAPI')
from Autodesk.Revit.DB import*
from Autodesk.Revit.DB import Line, ModelLine, LinePattern, ElementId
import Autodesk.Revit.DB as RDB
from Autodesk.Revit.DB import Line, GeometryInstance, Solid

doc = DocumentManager.Instance.CurrentDBDocument
View = doc.ActiveView
uidoc = DocumentManager.Instance.CurrentUIApplication.ActiveUIDocument
app  = uidoc.Application 
# #############################################################
# #                      FUNCTION                             #
# #############################################################
def getFaceNormal(dbPlanarFaces):
    return [e.FaceNormal for e in dbPlanarFaces]
# #############################################################
# #                      GEOMETRY                             #
# #############################################################
elements = UnwrapElement(IN[1]) if isinstance(IN[1],list) else [UnwrapElement(IN[1])]
OUT = [getFaceNormal(e) for e in elements]
# ----------------------------------------
filterverticaldbplanarface = Python(IN[1]=getplanarfacesformsolid_solids)  # "filterVerticalDBPlanarFace(dbPlanarFaces)"; CPython3; unwired: IN[0]
# ---------- filterverticaldbplanarface.python (52 lines) ----------
import clr
import System
 
clr.AddReference("RevitServices")
import RevitServices
from RevitServices.Persistence import DocumentManager
from RevitServices.Transactions import TransactionManager


clr.AddReference("RevitNodes")
import Revit
clr.ImportExtensions(Revit.Elements)
clr.ImportExtensions(Revit.GeometryConversion)

clr.AddReference("RevitAPIUI")
from Autodesk.Revit.UI import*
clr.AddReference('RevitAPIUI')
from Autodesk.Revit.UI import Selection
from  Autodesk.Revit.UI.Selection import ISelectionFilter

clr.AddReference('RevitAPI')
from Autodesk.Revit.DB import*
from Autodesk.Revit.DB import Line, ModelLine, LinePattern, ElementId
import Autodesk.Revit.DB as RDB
from Autodesk.Revit.DB import Line, GeometryInstance, Solid

doc = DocumentManager.Instance.CurrentDBDocument
View = doc.ActiveView
uidoc = DocumentManager.Instance.CurrentUIApplication.ActiveUIDocument
app  = uidoc.Application 
# #############################################################
# #                      FUNCTION                             #
# #############################################################
def isParalel(p,q):
    return p.CrossProduct(q).IsZeroLength()

def filterVerticalDBPlanarFace(dbPlanarFaces): # Get Vertical PlannarFaces 
    faV = []
    y = XYZ.BasisY
    for i in dbPlanarFaces:
        faNomal = i.FaceNormal
        check  = isParalel(y,faNomal)
        if check == True:
            faV.append(i)
    return faV

# #############################################################
# #                      GEOMETRY                             #
# #############################################################

elements = UnwrapElement(IN[1]) if isinstance(IN[1],list) else [UnwrapElement(IN[1])]
OUT = [filterVerticalDBPlanarFace(e) for e in elements]
# ----------------------------------------
getreferencearray_bbplanarfaces = Python(IN[1]=filterverticaldbplanarface)  # IronPython2; unwired: IN[0]
# ---------- getreferencearray_bbplanarfaces.python (43 lines) ----------
import clr
import System
 
clr.AddReference("RevitServices")
import RevitServices
from RevitServices.Persistence import DocumentManager
from RevitServices.Transactions import TransactionManager


clr.AddReference("RevitNodes")
import Revit
clr.ImportExtensions(Revit.Elements)
clr.ImportExtensions(Revit.GeometryConversion)

clr.AddReference("RevitAPIUI")
from Autodesk.Revit.UI import*
clr.AddReference('RevitAPIUI')
from Autodesk.Revit.UI import Selection
from  Autodesk.Revit.UI.Selection import ISelectionFilter

clr.AddReference('RevitAPI')
from Autodesk.Revit.DB import*
from Autodesk.Revit.DB import Line, ModelLine, LinePattern, ElementId
import Autodesk.Revit.DB as RDB
from Autodesk.Revit.DB import Line, GeometryInstance, Solid

doc = DocumentManager.Instance.CurrentDBDocument
View = doc.ActiveView
uidoc = DocumentManager.Instance.CurrentUIApplication.ActiveUIDocument
app  = uidoc.Application 
# #############################################################
# #                      FUNCTION                             #
# #############################################################
def getReferenceArray(bbPlanarFaces):
    reArray = ReferenceArray()
    for i in bbPlanarFaces:
        reArray.Append(i.Reference)
    return reArray
# #############################################################
# #                      GEOMETRY                             #
# #############################################################
elements = UnwrapElement(IN[1]) if isinstance(IN[1],list) else [UnwrapElement(IN[1])]
OUT = [getReferenceArray(e) for e in elements]
# ----------------------------------------
flatten_3 = List.Flatten(list=filterverticaldbplanarface)
conversionRtD_2 = Custom[ConversionRtD](Objects=flatten_3)
getedgesplanarfaces = Python(IN[1]=filterverticaldbplanarface)  # "getEdgesPlanarFaces(dbPlanarFaces)"; CPython3; unwired: IN[0]
# ---------- getedgesplanarfaces.python (47 lines) ----------
import clr
import System
 
clr.AddReference("RevitServices")
import RevitServices
from RevitServices.Persistence import DocumentManager
from RevitServices.Transactions import TransactionManager


clr.AddReference("RevitNodes")
import Revit
clr.ImportExtensions(Revit.Elements)
clr.ImportExtensions(Revit.GeometryConversion)

clr.AddReference("RevitAPIUI")
from Autodesk.Revit.UI import*
clr.AddReference('RevitAPIUI')
from Autodesk.Revit.UI import Selection
from  Autodesk.Revit.UI.Selection import ISelectionFilter

clr.AddReference('RevitAPI')
from Autodesk.Revit.DB import*
from Autodesk.Revit.DB import Line, ModelLine, LinePattern, ElementId
import Autodesk.Revit.DB as RDB
from Autodesk.Revit.DB import Line, GeometryInstance, Solid

doc = DocumentManager.Instance.CurrentDBDocument
View = doc.ActiveView
uidoc = DocumentManager.Instance.CurrentUIApplication.ActiveUIDocument
app  = uidoc.Application 
# #############################################################
# #                      FUNCTION                             #
# #############################################################
def getEdgesPlanarFaces(dbPlanarFaces): # Get DBLines of PlanarFaces
    result = []
    var = dbPlanarFaces.EdgeLoops
    for i in var:
        re = []
        for j in i:
            re.append(j.AsCurve())
        result.append(re)
    return result
# #############################################################
# #                      GEOMETRY                             #
# #############################################################
elements = UnwrapElement(IN[1]) if isinstance(IN[1],list) else [UnwrapElement(IN[1])]
OUT = [getEdgesPlanarFaces(j) for e in elements for j in e]
# ----------------------------------------
getdblinesmax_dblines = Python(IN[1]=getedgesplanarfaces)  # CPython3; unwired: IN[0]
# ---------- getdblinesmax_dblines.python (53 lines) ----------
import clr
import System
 
clr.AddReference("RevitServices")
import RevitServices
from RevitServices.Persistence import DocumentManager
from RevitServices.Transactions import TransactionManager


clr.AddReference("RevitNodes")
import Revit
clr.ImportExtensions(Revit.Elements)
clr.ImportExtensions(Revit.GeometryConversion)

clr.AddReference("RevitAPIUI")
from Autodesk.Revit.UI import*
clr.AddReference('RevitAPIUI')
from Autodesk.Revit.UI import Selection
from  Autodesk.Revit.UI.Selection import ISelectionFilter

clr.AddReference('RevitAPI')
from Autodesk.Revit.DB import*
from Autodesk.Revit.DB import Line, ModelLine, LinePattern, ElementId
import Autodesk.Revit.DB as RDB
from Autodesk.Revit.DB import Line, GeometryInstance, Solid

doc = DocumentManager.Instance.CurrentDBDocument
View = doc.ActiveView
uidoc = DocumentManager.Instance.CurrentUIApplication.ActiveUIDocument
app  = uidoc.Application 
# #############################################################
# #                      FUNCTION                             #
# #############################################################
def getDbLinesMax(dbLines): # Get a min line of list line
    _length = []
    dbLineMax = []
    for i in dbLines:
        r1 = []
        for z in i:
            r1.append(z.Length)
        _length.append(r1)
    for j in range(len(dbLines)):
        r2 = []
        for l in dbLines[j]:
            if l.Length == max(_length[j]):
                r2.append(l)
        dbLineMax.append(r2)
    return dbLineMax
# #############################################################
# #                      GEOMETRY                             #
# #############################################################
elements = UnwrapElement(IN[1]) if isinstance(IN[1],list) else [UnwrapElement(IN[1])]
OUT = [getDbLinesMax(e) for e in elements]
# ----------------------------------------
code_block_3 = CodeBlock(a=getdblinesmax_dblines) { a[0][0]; }
firstItem = List.FirstItem(list=code_block_3)
create_dbline_from_crossproduct = Python(IN[1]=firstItem)  # IronPython2; unwired: IN[0]
# ---------- create_dbline_from_crossproduct.python (52 lines) ----------
import clr
import System
 
clr.AddReference("RevitServices")
import RevitServices
from RevitServices.Persistence import DocumentManager
from RevitServices.Transactions import TransactionManager


clr.AddReference("RevitNodes")
import Revit
clr.ImportExtensions(Revit.Elements)
clr.ImportExtensions(Revit.GeometryConversion)

clr.AddReference("RevitAPIUI")
from Autodesk.Revit.UI import*
clr.AddReference('RevitAPIUI')
from  Autodesk.Revit.UI.Selection import*
from  Autodesk.Revit.UI.Selection import ISelectionFilter

clr.AddReference('RevitAPI')
from Autodesk.Revit.DB import*
from Autodesk.Revit.DB import Line, ModelLine, LinePattern, ElementId
import Autodesk.Revit.DB as RDB
from Autodesk.Revit.DB import Line, GeometryInstance, Solid

doc = DocumentManager.Instance.CurrentDBDocument
View = doc.ActiveView
uidoc = DocumentManager.Instance.CurrentUIApplication.ActiveUIDocument
app  = uidoc.Application 
# #############################################################
# #                      FUNCTION                             #
# #############################################################

# #############################################################
# #                      GEOMETRY                             #
# #############################################################
getLineMax = IN[1]

vtxPlane = XYZ.BasisZ
vtxSection = XYZ.BasisY

ptsLine1 = getLineMax.GetEndPoint(0)
ptsLine2 = getLineMax.GetEndPoint(1)

pickPoint = uidoc.Selection.PickPoint("Select Point")

vtxFromLine = ptsLine1 - ptsLine2

direct = vtxPlane.CrossProduct(vtxFromLine) 
dbLine = Line.CreateBound(pickPoint,pickPoint+direct)
OUT = dbLine
# ----------------------------------------
python_script_2 = Python(IN[1]=create_dbline_from_crossproduct, IN[2]=flatten_3)  # CPython3; unwired: IN[0]
# ---------- python_script_2.python (52 lines) ----------
import clr
import System
 
clr.AddReference("RevitServices")
import RevitServices
from RevitServices.Persistence import DocumentManager
from RevitServices.Transactions import TransactionManager


clr.AddReference("RevitNodes")
import Revit
clr.ImportExtensions(Revit.Elements)
clr.ImportExtensions(Revit.GeometryConversion)

clr.AddReference("RevitAPIUI")
from Autodesk.Revit.UI import*
clr.AddReference('RevitAPIUI')
from  Autodesk.Revit.UI.Selection import*
from  Autodesk.Revit.UI.Selection import ISelectionFilter

clr.AddReference('RevitAPI')
from Autodesk.Revit.DB import*
from Autodesk.Revit.DB import Line, ModelLine, LinePattern, ElementId
import Autodesk.Revit.DB as RDB
from Autodesk.Revit.DB import Line, GeometryInstance, Solid

doc = DocumentManager.Instance.CurrentDBDocument
view = doc.ActiveView
uidoc = DocumentManager.Instance.CurrentUIApplication.ActiveUIDocument
app  = uidoc.Application 
# #############################################################
# #                      FUNCTION                             #
def getReferenceArray(dbPlanarFaces):
    reArray = ReferenceArray()
    for i in dbPlanarFaces:
        reArray.Append(i.Reference)
    return reArray
# #############################################################

# #############################################################
# #                      GEOMETRY                             #
# #############################################################

dbLine = IN[1]
planarFaces = IN[2]

TransactionManager.Instance.EnsureInTransaction(doc)
result = []
refs = getReferenceArray(planarFaces)
dim = doc.Create.NewDimension(view, dbLine, refs)
TransactionManager.Instance.TransactionTaskDone()
OUT = dim
# ----------------------------------------
code_block_4 = CodeBlock { ["Structural Framing"]; }
boolean_3 = BoolSelector(true)
selectionElementsByCategoryNameAndClassi_2 = Custom[SelectionElementsByCategoryNameAndClassification](categoryNames=code_block_4, reset=boolean_3)
valueAtKey_2 = DesignScript.Builtin.Dictionary.ValueAtKey(dictionary=selectionElementsByCategoryNameAndClassi_2, key=code_block_4)
flatten_4 = List.Flatten(list=valueAtKey_2)
