# Dynamo graph Geometry_Lesson_16.dyn (Dynamo 2.18.1.5096)
# packages: BIM3DM 2.1.16

code_block = CodeBlock { ["Structural Framing"]; }
boolean = BoolSelector(true)
selectionElementsByCategoryNameAndClassi = Custom[SelectionElementsByCategoryNameAndClassification](categoryNames=code_block, reset=boolean)  # package BIM3DM; Returning the elements you want to select based on the name of the category you pass as a parameter. Subsequently, classify them for you.
valueAtKey = DesignScript.Builtin.Dictionary.ValueAtKey(dictionary=selectionElementsByCategoryNameAndClassi, key=code_block)
flatten = List.Flatten(list=valueAtKey)
getgeoelement_element = Python(IN[1]=flatten)  # CPython3; unwired: IN[0]
# ---------- getgeoelement_element.python (48 lines) ----------
"""Copyright by: duengocnguyen@gmail.com"""
import clr 
import System
import math 
from System.Collections.Generic import *

clr.AddReference("ProtoGeometry")
from Autodesk.DesignScript.Geometry import *

clr.AddReference('RevitAPI')
import Autodesk
from Autodesk.Revit.DB import *

clr.AddReference('RevitAPIUI')
from Autodesk.Revit.UI import*
from  Autodesk.Revit.UI.Selection import*

clr.AddReference("RevitNodes")
import Revit
clr.ImportExtensions(Revit.Elements)
clr.ImportExtensions(Revit.GeometryConversion)

clr.AddReference("RevitServices")
import RevitServices
from RevitServices.Persistence import DocumentManager
from RevitServices.Transactions import TransactionManager

# Accessing the current Revit document and active view
doc = DocumentManager.Instance.CurrentDBDocument
view = doc.ActiveView
uidoc = DocumentManager.Instance.CurrentUIApplication.ActiveUIDocument
# #############################################################
# #                      FUNCTION                             #
# #############################################################
def getGeoElement(element): # Get geometry of element.
    geo = []
    opt = Options()
    opt.ComputeReferences = True
    opt.IncludeNonVisibleObjects = True
    opt.DetailLevel = ViewDetailLevel.Fine
    geoByElement = element.get_Geometry(opt)
    geo = [i for i in geoByElement]
    return geo
# #############################################################
# #                      GEOMETRY                             #
# #############################################################
elements = UnwrapElement(IN[1]) if isinstance(IN[1],list) else [UnwrapElement(IN[1])]
OUT = [getGeoElement(i) for i in elements]
# ----------------------------------------
flatten_2 = List.Flatten(list=getgeoelement_element)
filterTypesDBGeo = Python(IN[1]=flatten_2)  # CPython3; unwired: IN[0]
# ---------- filterTypesDBGeo.python (44 lines) ----------
import clr
import System
 
clr.AddReference("RevitServices")
import RevitServices
from RevitServices.Persistence import DocumentManager
from RevitServices.Transactions import TransactionManager

clr.AddReference("RevitNodes")
import Revit
clr.ImportExtensions(Revit.Elements)
clr.ImportExtensions(Revit.GeometryConversion)

clr.AddReference("RevitAPIUI")
from Autodesk.Revit.UI import*
clr.AddReference('RevitAPIUI')
from Autodesk.Revit.UI import Selection
from  Autodesk.Revit.UI.Selection import ISelectionFilter

clr.AddReference('RevitAPI')
from Autodesk.Revit.DB import*
from Autodesk.Revit.DB import Line, ModelLine, LinePattern, ElementId
import Autodesk.Revit.DB as RDB
doc = DocumentManager.Instance.CurrentDBDocument
View = doc.ActiveView
uidoc = DocumentManager.Instance.CurrentUIApplication.ActiveUIDocument
app  = uidoc.Application 
# #############################################################
# #                      FUNCTION                             #
# #############################################################
from Autodesk.Revit.DB import Line, GeometryInstance, Solid

def filterTypesDBGeo(lstGeo):
    mySet = set()
    for item in lstGeo:
        itemType = item.GetType().ToString()
        mySet.add(itemType)
    return mySet

# #############################################################
# #                      GEOMETRY                             #
# #############################################################
elements = UnwrapElement(IN[1]) if isinstance(IN[1],list) else [UnwrapElement(IN[1])]
OUT = filterTypesDBGeo(elements)
# ----------------------------------------

# group: Design Script
boolean_2 = BoolSelector(true)
python_script = Python(IN[0]=boolean_2)  # CPython3
# ---------- python_script.python (4 lines) ----------
#f = open(r"U:\17_TrainingAdvanceDynamo\2_WORKING\Tool\Dynamo\Training-Dynamo-2024\DesignScript.py", "r")

f = open(r"A:\Library-Dynamo-Python-CSharp\test.py", "r")
OUT = f.read() 
# ----------------------------------------
python_script_from_string = PythonStringNode(script=python_script)  # IronPython2; unwired: IN[0], IN[1], IN[2]

conversionRtD = Custom[ConversionRtD](Objects=python_script_from_string)  # package BIM3DM; Return an object entity that can be displayed on the Dynamo interface.
getdbsolidfromdbgeo_lstgeo = Python(IN[1]=getgeoelement_element)  # IronPython2; unwired: IN[0]
# ---------- getdbsolidfromdbgeo_lstgeo.python (46 lines) ----------
import clr
import System
 
clr.AddReference("RevitServices")
import RevitServices
from RevitServices.Persistence import DocumentManager
from RevitServices.Transactions import TransactionManager

clr.AddReference("RevitNodes")
import Revit
clr.ImportExtensions(Revit.Elements)
clr.ImportExtensions(Revit.GeometryConversion)

clr.AddReference("RevitAPIUI")
from Autodesk.Revit.UI import*
clr.AddReference('RevitAPIUI')
from Autodesk.Revit.UI import Selection
from  Autodesk.Revit.UI.Selection import ISelectionFilter

clr.AddReference('RevitAPI')
from Autodesk.Revit.DB import*
from Autodesk.Revit.DB import Line, ModelLine, LinePattern, ElementId
import Autodesk.Revit.DB as RDB
doc = DocumentManager.Instance.CurrentDBDocument
View = doc.ActiveView
uidoc = DocumentManager.Instance.CurrentUIApplication.ActiveUIDocument
app  = uidoc.Application 
# #############################################################
# #                      FUNCTION                             #
# #############################################################
def getDBSolidFromDBGeo(lstGeo):  # Way 1
    sol = []
    for i in lstGeo:
        if i.GetType() == Solid and i.Volume > 0:
            sol.append(i)
        elif i.GetType() == GeometryInstance:
            for j in i.GetInstanceGeometry():
                if isinstance(j, Solid):
                    if j.Volume > 0:
                        sol.append(j)
    return sol
# #############################################################
# #                      GEOMETRY                             #
# #############################################################
elements = UnwrapElement(IN[1]) if isinstance(IN[1],list) else [UnwrapElement(IN[1])]
OUT = [getDBSolidFromDBGeo(ele) for ele in elements]
# ----------------------------------------
getplanarfacesformsolid_solids = Python(IN[1]=getdbsolidfromdbgeo_lstgeo)  # IronPython2; unwired: IN[0]
# ---------- getplanarfacesformsolid_solids.python (48 lines) ----------
import clr
import System
 
clr.AddReference("RevitServices")
import RevitServices
from RevitServices.Persistence import DocumentManager
from RevitServices.Transactions import TransactionManager


clr.AddReference("RevitNodes")
import Revit
clr.ImportExtensions(Revit.Elements)
clr.ImportExtensions(Revit.GeometryConversion)

clr.AddReference("RevitAPIUI")
from Autodesk.Revit.UI import*
clr.AddReference('RevitAPIUI')
from Autodesk.Revit.UI import Selection
from  Autodesk.Revit.UI.Selection import ISelectionFilter

clr.AddReference('RevitAPI')
from Autodesk.Revit.DB import*
from Autodesk.Revit.DB import Line, ModelLine, LinePattern, ElementId
import Autodesk.Revit.DB as RDB
from Autodesk.Revit.DB import Line, GeometryInstance, Solid

doc = DocumentManager.Instance.CurrentDBDocument
View = doc.ActiveView
uidoc = DocumentManager.Instance.CurrentUIApplication.ActiveUIDocument
app  = uidoc.Application 
# #############################################################
# #                      FUNCTION                             #
# #############################################################
def getPlanarFacesFormSolid(solids): # Get PlanarFace from solids
    planarFaces = []
    for i in solids:
        var = i.Faces
        for j in var:
            if j.Reference != None:
                planarFaces.append(j)
    return planarFaces

# #############################################################
# #                      GEOMETRY                             #
# #############################################################

elements = UnwrapElement(IN[1]) if isinstance(IN[1],list) else [UnwrapElement(IN[1])]
OUT = [getPlanarFacesFormSolid(e) for e in elements]
# ----------------------------------------
getFaceNormal = Python(IN[1]=getplanarfacesformsolid_solids)  # CPython3; unwired: IN[0]
# ---------- getFaceNormal.python (40 lines) ----------
import clr
import System
 
clr.AddReference("RevitServices")
import RevitServices
from RevitServices.Persistence import DocumentManager
from RevitServices.Transactions import TransactionManager


clr.AddReference("RevitNodes")
import Revit
clr.ImportExtensions(Revit.Elements)
clr.ImportExtensions(Revit.GeometryConversion)

clr.AddReference("RevitAPIUI")
from Autodesk.Revit.UI import*
clr.AddReference('RevitAPIUI')
from Autodesk.Revit.UI import Selection
from  Autodesk.Revit.UI.Selection import ISelectionFilter

clr.AddReference('RevitAPI')
from Autodesk.Revit.DB import*
from Autodesk.Revit.DB import Line, ModelLine, LinePattern, ElementId
import Autodesk.Revit.DB as RDB
from Autodesk.Revit.DB import Line, GeometryInstance, Solid

doc = DocumentManager.Instance.CurrentDBDocument
View = doc.ActiveView
uidoc = DocumentManager.Instance.CurrentUIApplication.ActiveUIDocument
app  = uidoc.Application 
# #############################################################
# #                      FUNCTION                             #
# #############################################################
def getFaceNormal(dbPlanarFaces):
    return [e.FaceNormal for e in dbPlanarFaces]
# #############################################################
# #                      GEOMETRY                             #
# #############################################################
elements = UnwrapElement(IN[1]) if isinstance(IN[1],list) else [UnwrapElement(IN[1])]
OUT = [getFaceNormal(e) for e in elements]
# ----------------------------------------
filterverticaldbplanarface = Python(IN[1]=getplanarfacesformsolid_solids)  # "filterVerticalDBPlanarFace(dbPlanarFaces)"; CPython3; unwired: IN[0]
# ---------- filterverticaldbplanarface.python (52 lines) ----------
import clr
import System
 
clr.AddReference("RevitServices")
import RevitServices
from RevitServices.Persistence import DocumentManager
from RevitServices.Transactions import TransactionManager


clr.AddReference("RevitNodes")
import Revit
clr.ImportExtensions(Revit.Elements)
clr.ImportExtensions(Revit.GeometryConversion)

clr.AddReference("RevitAPIUI")
from Autodesk.Revit.UI import*
clr.AddReference('RevitAPIUI')
from Autodesk.Revit.UI import Selection
from  Autodesk.Revit.UI.Selection import ISelectionFilter

clr.AddReference('RevitAPI')
from Autodesk.Revit.DB import*
from Autodesk.Revit.DB import Line, ModelLine, LinePattern, ElementId
import Autodesk.Revit.DB as RDB
from Autodesk.Revit.DB import Line, GeometryInstance, Solid

doc = DocumentManager.Instance.CurrentDBDocument
View = doc.ActiveView
uidoc = DocumentManager.Instance.CurrentUIApplication.ActiveUIDocument
app  = uidoc.Application 
# #############################################################
# #                      FUNCTION                             #
# #############################################################
def isParalel(p,q):
    return p.CrossProduct(q).IsZeroLength()

def filterVerticalDBPlanarFace(dbPlanarFaces): # Get Vertical PlannarFaces 
    faV = []
    y = XYZ.BasisY
    for i in dbPlanarFaces:
        faNomal = i.FaceNormal
        check  = isParalel(y,faNomal)
        if check == True:
            faV.append(i)
    return faV

# #############################################################
# #                      GEOMETRY                             #
# #############################################################

elements = UnwrapElement(IN[1]) if isinstance(IN[1],list) else [UnwrapElement(IN[1])]
OUT = [filterVerticalDBPlanarFace(e) for e in elements]
# ----------------------------------------
getreferencearray_bbplanarfaces = Python(IN[1]=filterverticaldbplanarface)  # IronPython2; unwired: IN[0]
# ---------- getreferencearray_bbplanarfaces.python (43 lines) ----------
import clr
import System
 
clr.AddReference("RevitServices")
import RevitServices
from RevitServices.Persistence import DocumentManager
from RevitServices.Transactions import TransactionManager


clr.AddReference("RevitNodes")
import Revit
clr.ImportExtensions(Revit.Elements)
clr.ImportExtensions(Revit.GeometryConversion)

clr.AddReference("RevitAPIUI")
from Autodesk.Revit.UI import*
clr.AddReference('RevitAPIUI')
from Autodesk.Revit.UI import Selection
from  Autodesk.Revit.UI.Selection import ISelectionFilter

clr.AddReference('RevitAPI')
from Autodesk.Revit.DB import*
from Autodesk.Revit.DB import Line, ModelLine, LinePattern, ElementId
import Autodesk.Revit.DB as RDB
from Autodesk.Revit.DB import Line, GeometryInstance, Solid

doc = DocumentManager.Instance.CurrentDBDocument
View = doc.ActiveView
uidoc = DocumentManager.Instance.CurrentUIApplication.ActiveUIDocument
app  = uidoc.Application 
# #############################################################
# #                      FUNCTION                             #
# #############################################################
def getReferenceArray(bbPlanarFaces):
    reArray = ReferenceArray()
    for i in bbPlanarFaces:
        reArray.Append(i.Reference)
    return reArray
# #############################################################
# #                      GEOMETRY                             #
# #############################################################
elements = UnwrapElement(IN[1]) if isinstance(IN[1],list) else [UnwrapElement(IN[1])]
OUT = [getReferenceArray(e) for e in elements]
# ----------------------------------------
flatten_3 = List.Flatten(list=filterverticaldbplanarface)
conversionRtD_2 = Custom[ConversionRtD](Objects=flatten_3)
getedgesplanarfaces = Python(IN[1]=filterverticaldbplanarface)  # "getEdgesPlanarFaces(dbPlanarFaces)"; CPython3; unwired: IN[0]
# ---------- getedgesplanarfaces.python (47 lines) ----------
import clr
import System
 
clr.AddReference("RevitServices")
import RevitServices
from RevitServices.Persistence import DocumentManager
from RevitServices.Transactions import TransactionManager


clr.AddReference("RevitNodes")
import Revit
clr.ImportExtensions(Revit.Elements)
clr.ImportExtensions(Revit.GeometryConversion)

clr.AddReference("RevitAPIUI")
from Autodesk.Revit.UI import*
clr.AddReference('RevitAPIUI')
from Autodesk.Revit.UI import Selection
from  Autodesk.Revit.UI.Selection import ISelectionFilter

clr.AddReference('RevitAPI')
from Autodesk.Revit.DB import*
from Autodesk.Revit.DB import Line, ModelLine, LinePattern, ElementId
import Autodesk.Revit.DB as RDB
from Autodesk.Revit.DB import Line, GeometryInstance, Solid

doc = DocumentManager.Instance.CurrentDBDocument
View = doc.ActiveView
uidoc = DocumentManager.Instance.CurrentUIApplication.ActiveUIDocument
app  = uidoc.Application 
# #############################################################
# #                      FUNCTION                             #
# #############################################################
def getEdgesPlanarFaces(dbPlanarFaces): # Get DBLines of PlanarFaces
    result = []
    var = dbPlanarFaces.EdgeLoops
    for i in var:
        re = []
        for j in i:
            re.append(j.AsCurve())
        result.append(re)
    return result
# #############################################################
# #                      GEOMETRY                             #
# #############################################################
elements = UnwrapElement(IN[1]) if isinstance(IN[1],list) else [UnwrapElement(IN[1])]
OUT = [getEdgesPlanarFaces(j) for e in elements for j in e]
# ----------------------------------------
getdblinesmax_dblines = Python(IN[1]=getedgesplanarfaces)  # CPython3; unwired: IN[0]
# ---------- getdblinesmax_dblines.python (53 lines) ----------
import clr
import System
 
clr.AddReference("RevitServices")
import RevitServices
from RevitServices.Persistence import DocumentManager
from RevitServices.Transactions import TransactionManager


clr.AddReference("RevitNodes")
import Revit
clr.ImportExtensions(Revit.Elements)
clr.ImportExtensions(Revit.GeometryConversion)

clr.AddReference("RevitAPIUI")
from Autodesk.Revit.UI import*
clr.AddReference('RevitAPIUI')
from Autodesk.Revit.UI import Selection
from  Autodesk.Revit.UI.Selection import ISelectionFilter

clr.AddReference('RevitAPI')
from Autodesk.Revit.DB import*
from Autodesk.Revit.DB import Line, ModelLine, LinePattern, ElementId
import Autodesk.Revit.DB as RDB
from Autodesk.Revit.DB import Line, GeometryInstance, Solid

doc = DocumentManager.Instance.CurrentDBDocument
View = doc.ActiveView
uidoc = DocumentManager.Instance.CurrentUIApplication.ActiveUIDocument
app  = uidoc.Application 
# #############################################################
# #                      FUNCTION                             #
# #############################################################
def getDbLinesMax(dbLines): # Get a min line of list line
    _length = []
    dbLineMax = []
    for i in dbLines:
        r1 = []
        for z in i:
            r1.append(z.Length)
        _length.append(r1)
    for j in range(len(dbLines)):
        r2 = []
        for l in dbLines[j]:
            if l.Length == max(_length[j]):
                r2.append(l)
        dbLineMax.append(r2)
    return dbLineMax
# #############################################################
# #                      GEOMETRY                             #
# #############################################################
elements = UnwrapElement(IN[1]) if isinstance(IN[1],list) else [UnwrapElement(IN[1])]
OUT = [getDbLinesMax(e) for e in elements]
# ----------------------------------------
code_block_2 = CodeBlock(a=getdblinesmax_dblines) { a[0][0]; }
firstItem = List.FirstItem(list=code_block_2)
create_dbline_from_crossproduct = Python(IN[1]=firstItem)  # IronPython2; unwired: IN[0]
# ---------- create_dbline_from_crossproduct.python (52 lines) ----------
import clr
import System
 
clr.AddReference("RevitServices")
import RevitServices
from RevitServices.Persistence import DocumentManager
from RevitServices.Transactions import TransactionManager


clr.AddReference("RevitNodes")
import Revit
clr.ImportExtensions(Revit.Elements)
clr.ImportExtensions(Revit.GeometryConversion)

clr.AddReference("RevitAPIUI")
from Autodesk.Revit.UI import*
clr.AddReference('RevitAPIUI')
from  Autodesk.Revit.UI.Selection import*
from  Autodesk.Revit.UI.Selection import ISelectionFilter

clr.AddReference('RevitAPI')
from Autodesk.Revit.DB import*
from Autodesk.Revit.DB import Line, ModelLine, LinePattern, ElementId
import Autodesk.Revit.DB as RDB
from Autodesk.Revit.DB import Line, GeometryInstance, Solid

doc = DocumentManager.Instance.CurrentDBDocument
View = doc.ActiveView
uidoc = DocumentManager.Instance.CurrentUIApplication.ActiveUIDocument
app  = uidoc.Application 
# #############################################################
# #                      FUNCTION                             #
# #############################################################

# #############################################################
# #                      GEOMETRY                             #
# #############################################################
getLineMax = IN[1]

vtxPlane = XYZ.BasisZ
vtxSection = XYZ.BasisY

ptsLine1 = getLineMax.GetEndPoint(0)
ptsLine2 = getLineMax.GetEndPoint(1)

pickPoint = uidoc.Selection.PickPoint("Select Point")

vtxFromLine = ptsLine1 - ptsLine2

direct = vtxPlane.CrossProduct(vtxFromLine) 
dbLine = Line.CreateBound(pickPoint,pickPoint+direct)
OUT = dbLine
# ----------------------------------------
python_script_2 = Python(IN[1]=create_dbline_from_crossproduct, IN[2]=flatten_3)  # CPython3; unwired: IN[0]
# ---------- python_script_2.python (52 lines) ----------
import clr
import System
 
clr.AddReference("RevitServices")
import RevitServices
from RevitServices.Persistence import DocumentManager
from RevitServices.Transactions import TransactionManager


clr.AddReference("RevitNodes")
import Revit
clr.ImportExtensions(Revit.Elements)
clr.ImportExtensions(Revit.GeometryConversion)

clr.AddReference("RevitAPIUI")
from Autodesk.Revit.UI import*
clr.AddReference('RevitAPIUI')
from  Autodesk.Revit.UI.Selection import*
from  Autodesk.Revit.UI.Selection import ISelectionFilter

clr.AddReference('RevitAPI')
from Autodesk.Revit.DB import*
from Autodesk.Revit.DB import Line, ModelLine, LinePattern, ElementId
import Autodesk.Revit.DB as RDB
from Autodesk.Revit.DB import Line, GeometryInstance, Solid

doc = DocumentManager.Instance.CurrentDBDocument
view = doc.ActiveView
uidoc = DocumentManager.Instance.CurrentUIApplication.ActiveUIDocument
app  = uidoc.Application 
# #############################################################
# #                      FUNCTION                             #
def getReferenceArray(dbPlanarFaces):
    reArray = ReferenceArray()
    for i in dbPlanarFaces:
        reArray.Append(i.Reference)
    return reArray
# #############################################################

# #############################################################
# #                      GEOMETRY                             #
# #############################################################

dbLine = IN[1]
planarFaces = IN[2]

TransactionManager.Instance.EnsureInTransaction(doc)
result = []
refs = getReferenceArray(planarFaces)
dim = doc.Create.NewDimension(view, dbLine, refs)
TransactionManager.Instance.TransactionTaskDone()
OUT = dim
# ----------------------------------------

# group: DtR
flatten_4 = List.Flatten(list=python_script_from_string)
python_script_3 = Python(IN[0]=flatten_4)  # CPython3
# ---------- python_script_3.python (48 lines) ----------
"""Copyright(c) 2019 by: duengocnguyen@gmail.com"""
'https://www.youtube.com/channel/UCt2JhCDDFxpYho575WTMZ4g'
"""________________Welcome to BIM3DM-DYNAMO API___________________"""
import clr 
import sys
sys.path.append(r'C:\Program Files\Autodesk\Revit 2020\AddIns\DynamoForRevit\IronPython.StdLib.2.7.8')
import math 
from System.Collections.Generic import *

clr.AddReference("ProtoGeometry")
from Autodesk.DesignScript.Geometry import *

clr.AddReference('RevitAPI')
import Autodesk
from Autodesk.Revit.DB import *

clr.AddReference('RevitAPIUI')
from Autodesk.Revit.UI import*
from  Autodesk.Revit.UI.Selection import*

clr.AddReference("RevitNodes")
import Revit
clr.ImportExtensions(Revit.Elements)
clr.ImportExtensions(Revit.GeometryConversion)
clr.AddReference('DSCoreNodes')
from DSCore import *

clr.AddReference("RevitServices")
import RevitServices
from RevitServices.Persistence import DocumentManager
from RevitServices.Transactions import TransactionManager

doc = DocumentManager.Instance.CurrentDBDocument
view = doc.ActiveView
uidoc = DocumentManager.Instance.CurrentUIApplication.ActiveUIDocument

#Preparing input from dynamo to revit
elements = UnwrapElement(IN[0])

#Do some action in a Transaction
#TransactionManager.Instance.EnsureInTransaction(doc)
"""Now, You Can Code """



#TransactionManager.Instance.TransactionTaskDone()

OUT = [ele.ToProtoType() for ele in elements]
# ----------------------------------------

code_block_3 = CodeBlock { ["Structural Framing", "Floors", "Structural Foundations"]; }
boolean_3 = BoolSelector(true)
selectionElementsByCategoryNameAndClassi_2 = Custom[SelectionElementsByCategoryNameAndClassification](categoryNames=code_block_3, reset=boolean_3)
valueAtKey_2 = DesignScript.Builtin.Dictionary.ValueAtKey(dictionary=selectionElementsByCategoryNameAndClassi_2, key=code_block_3)
flatten_5 = List.Flatten(list=valueAtKey_2)
getgeoelement_element_2 = Python(IN[1]=flatten_5)  # IronPython2; unwired: IN[0]
# ---------- getgeoelement_element_2.python (46 lines) ----------
import clr
import System
 
clr.AddReference("RevitServices")
import RevitServices
from RevitServices.Persistence import DocumentManager
from RevitServices.Transactions import TransactionManager


clr.AddReference("RevitNodes")
import Revit
clr.ImportExtensions(Revit.Elements)
clr.ImportExtensions(Revit.GeometryConversion)

clr.AddReference("RevitAPIUI")
from Autodesk.Revit.UI import*
clr.AddReference('RevitAPIUI')
from  Autodesk.Revit.UI.Selection import*
from  Autodesk.Revit.UI.Selection import ISelectionFilter

clr.AddReference('RevitAPI')
from Autodesk.Revit.DB import*
from Autodesk.Revit.DB import Line, ModelLine, LinePattern, ElementId
import Autodesk.Revit.DB as RDB
from Autodesk.Revit.DB import Line, GeometryInstance, Solid

doc = DocumentManager.Instance.CurrentDBDocument
view = doc.ActiveView
uidoc = DocumentManager.Instance.CurrentUIApplication.ActiveUIDocument
app  = uidoc.Application 
# #############################################################
# #                      FUNCTION                             #
def getGeoElement(element):
    opt = Options()
    opt.ComputeReferences = True
    opt.IncludeNonVisibleObjects = True
    opt.DetailLevel = ViewDetailLevel.Fine
    geoByElement = ele.get_Geometry(opt)
    return geoByElement
    

# #############################################################
# #                      GEOMETRY                             #
# #############################################################
elements = UnwrapElement(IN[1]) if isinstance(IN[1], list) else [UnwrapElement(IN[1])]
OUT = [getGeoElement(ele) for ele in elements]
# ----------------------------------------
getdbsolidfromdbgeo_geos = Python(IN[1]=getgeoelement_element_2)  # IronPython2; unwired: IN[0]
# ---------- getdbsolidfromdbgeo_geos.python (50 lines) ----------
import clr
import System
 
clr.AddReference("RevitServices")
import RevitServices
from RevitServices.Persistence import DocumentManager
from RevitServices.Transactions import TransactionManager


clr.AddReference("RevitNodes")
import Revit
clr.ImportExtensions(Revit.Elements)
clr.ImportExtensions(Revit.GeometryConversion)

clr.AddReference("RevitAPIUI")
from Autodesk.Revit.UI import*
clr.AddReference('RevitAPIUI')
from  Autodesk.Revit.UI.Selection import*
from  Autodesk.Revit.UI.Selection import ISelectionFilter

clr.AddReference('RevitAPI')
from Autodesk.Revit.DB import*
from Autodesk.Revit.DB import Line, ModelLine, LinePattern, ElementId
import Autodesk.Revit.DB as RDB
from Autodesk.Revit.DB import Line, GeometryInstance, Solid

doc = DocumentManager.Instance.CurrentDBDocument
view = doc.ActiveView
uidoc = DocumentManager.Instance.CurrentUIApplication.ActiveUIDocument
app  = uidoc.Application 
# #############################################################
# #                      FUNCTION                             #

def getDbSolidFromDbGeo(geos):
    solids = []
    for i in geos:
        if i.GetType() == Solid and i.Volume > 0:
            solids.append(i)
        elif i.GetType() == GeometryInstance:
            for j in i.GetInstanceGeometry():
                if instance(j, Solid):
                    if j.Volume > 0:
                        solids.append(j)
    return solids

# #############################################################
# #                      GEOMETRY                             #
# #############################################################
elements = UnwrapElement(IN[1]) if isinstance(IN[1], list) else [UnwrapElement(IN[1])]
OUT = [getDbSolidFromDbGeo(geo) for geo in elements]
# ----------------------------------------
getdbedgesbydbsolid_dbsolids = Python(IN[1]=getdbsolidfromdbgeo_geos)  # IronPython2; unwired: IN[0]
# ---------- getdbedgesbydbsolid_dbsolids.python (48 lines) ----------
import clr
import System
 
clr.AddReference("RevitServices")
import RevitServices
from RevitServices.Persistence import DocumentManager
from RevitServices.Transactions import TransactionManager


clr.AddReference("RevitNodes")
import Revit
clr.ImportExtensions(Revit.Elements)
clr.ImportExtensions(Revit.GeometryConversion)

clr.AddReference("RevitAPIUI")
from Autodesk.Revit.UI import*
clr.AddReference('RevitAPIUI')
from  Autodesk.Revit.UI.Selection import*
from  Autodesk.Revit.UI.Selection import ISelectionFilter

clr.AddReference('RevitAPI')
from Autodesk.Revit.DB import*
from Autodesk.Revit.DB import Line, ModelLine, LinePattern, ElementId
import Autodesk.Revit.DB as RDB
from Autodesk.Revit.DB import Line, GeometryInstance, Solid

doc = DocumentManager.Instance.CurrentDBDocument
view = doc.ActiveView
uidoc = DocumentManager.Instance.CurrentUIApplication.ActiveUIDocument
app  = uidoc.Application 
# #############################################################
# #                      FUNCTION                             #


def getDbEdgesByDbSolid(dbSolids):
    edgesDb = []
    for i in dbSolids:
        edgeArray = i.Edges
        edgesDb.append(edgeArray)
    return edgesDb



# #############################################################
# #                      GEOMETRY                             #
# #############################################################
elements = UnwrapElement(IN[1]) if isinstance(IN[1], list) else [UnwrapElement(IN[1])]
OUT = [getDbEdgesByDbSolid(eles) for eles in elements]
# ----------------------------------------
getplanarfacesbydbsolid_dbsolids = Python(IN[1]=getdbsolidfromdbgeo_geos)  # CPython3; unwired: IN[0]
# ---------- getplanarfacesbydbsolid_dbsolids.python (48 lines) ----------
import clr
import System
 
clr.AddReference("RevitServices")
import RevitServices
from RevitServices.Persistence import DocumentManager
from RevitServices.Transactions import TransactionManager


clr.AddReference("RevitNodes")
import Revit
clr.ImportExtensions(Revit.Elements)
clr.ImportExtensions(Revit.GeometryConversion)

clr.AddReference("RevitAPIUI")
from Autodesk.Revit.UI import*
clr.AddReference('RevitAPIUI')
from  Autodesk.Revit.UI.Selection import*
from  Autodesk.Revit.UI.Selection import ISelectionFilter

clr.AddReference('RevitAPI')
from Autodesk.Revit.DB import*
from Autodesk.Revit.DB import Line, ModelLine, LinePattern, ElementId
import Autodesk.Revit.DB as RDB
from Autodesk.Revit.DB import Line, GeometryInstance, Solid

doc = DocumentManager.Instance.CurrentDBDocument
view = doc.ActiveView
uidoc = DocumentManager.Instance.CurrentUIApplication.ActiveUIDocument
app  = uidoc.Application 
# #############################################################
# #                      FUNCTION                             #

def getPlanarFacesByDbSolid(dbSolids):
    planarFaces = []
    for i in dbSolids:
        faceArray = i.Faces
        for j in faceArray:
            if j.Reference != None:
                planarFaces.append(j)
        return faceArray
    return planarFaces

# #############################################################
# #                      GEOMETRY                             #
# #############################################################
elements = UnwrapElement(IN[1]) if isinstance(IN[1], list) else [UnwrapElement(IN[1])]
OUT = [getPlanarFacesByDbSolid(eles) for eles in elements]
# ----------------------------------------
getverticaldbplanarfaces = Python(IN[1]=getplanarfacesbydbsolid_dbsolids)  # "getVerticalDbPlanarFaces(dbPlanarFaces)"; CPython3; frozen; unwired: IN[0]
# ---------- getverticaldbplanarfaces.python (54 lines) ----------
import clr
import System
 
clr.AddReference("RevitServices")
import RevitServices
from RevitServices.Persistence import DocumentManager
from RevitServices.Transactions import TransactionManager


clr.AddReference("RevitNodes")
import Revit
clr.ImportExtensions(Revit.Elements)
clr.ImportExtensions(Revit.GeometryConversion)

clr.AddReference("RevitAPIUI")
from Autodesk.Revit.UI import*
clr.AddReference('RevitAPIUI')
from  Autodesk.Revit.UI.Selection import*
from  Autodesk.Revit.UI.Selection import ISelectionFilter

clr.AddReference('RevitAPI')
from Autodesk.Revit.DB import*
from Autodesk.Revit.DB import Line, ModelLine, LinePattern, ElementId
import Autodesk.Revit.DB as RDB
from Autodesk.Revit.DB import Line, GeometryInstance, Solid

doc = DocumentManager.Instance.CurrentDBDocument
view = doc.ActiveView
uidoc = DocumentManager.Instance.CurrentUIApplication.ActiveUIDocument
app  = uidoc.Application 
# #############################################################
# #                      FUNCTION                             #

def isParalel(p,q):
    return p.CrossProduct(q).IsZeroLength()

def getVerticalDbPlanarFaces(dbPlanarFaces):
    vPFaces =  []
    y = XYZ.BasisY
    for i in dbPlanarFaces:
        pfNormal = i.FaceNormal
        check = isParalel(y, pfNormal)
        if check:
            vPFaces.append(i)
    return vPFaces




# #############################################################
# #                      GEOMETRY                             #
# #############################################################
elements = UnwrapElement(IN[1]) if isinstance(IN[1], list) else [UnwrapElement(IN[1])]
OUT = [getVerticalDbPlanarFaces(eles) for eles in elements]
# ----------------------------------------
getdbedgesplanarfaces = Python(IN[1]=getverticaldbplanarfaces)  # "getDbEdgesPlanarFaces(dbPlanarFaces)"; IronPython2; unwired: IN[0]
# ---------- getdbedgesplanarfaces.python (62 lines) ----------
import clr
import System
 
clr.AddReference("RevitServices")
import RevitServices
from RevitServices.Persistence import DocumentManager
from RevitServices.Transactions import TransactionManager


clr.AddReference("RevitNodes")
import Revit
clr.ImportExtensions(Revit.Elements)
clr.ImportExtensions(Revit.GeometryConversion)

clr.AddReference("RevitAPIUI")
from Autodesk.Revit.UI import*
clr.AddReference('RevitAPIUI')
from  Autodesk.Revit.UI.Selection import*
from  Autodesk.Revit.UI.Selection import ISelectionFilter

clr.AddReference('RevitAPI')
from Autodesk.Revit.DB import*
from Autodesk.Revit.DB import Line, ModelLine, LinePattern, ElementId
import Autodesk.Revit.DB as RDB
from Autodesk.Revit.DB import Line, GeometryInstance, Solid

doc = DocumentManager.Instance.CurrentDBDocument
view = doc.ActiveView
uidoc = DocumentManager.Instance.CurrentUIApplication.ActiveUIDocument
app  = uidoc.Application 
# #############################################################
# #                      FUNCTION                             #


# def getDbEdgesPlanarFaces(dbPlanarFaces):
#     result = []
#     for eles in dbPlanarFaces:
#         re = []
#         for ele in eles:
#             vals = ele.EdgeLoops
#             re.append(vals)
#         result.append(re)
#     return result

def getDbEdgesPlanarFaces(dbPlanarFaces):
    result = []
    vals = dbPlanarFaces.EdgeLoops
    for edges in vals:
        # re = []
        for edge in edges:
            dbLine = edge.AsCurve()
            result.append(dbLine)
        # result.append(re)
    return result



# #############################################################
# #                      GEOMETRY                             #
# #############################################################
elements = UnwrapElement(IN[1]) if isinstance(IN[1], list) else [UnwrapElement(IN[1])]
OUT = [getDbEdgesPlanarFaces(ele) for eles in elements for ele in eles]
# ----------------------------------------
conversionRtD_3 = Custom[ConversionRtD]()  # unwired: Objects
python_script_4 = Python()  # CPython3; unwired: IN[0]
# ---------- python_script_4.python (46 lines) ----------
"""Copyright(c) 2019 by: duengocnguyen@gmail.com"""
'https://www.youtube.com/channel/UCt2JhCDDFxpYho575WTMZ4g'
"""________________Welcome to BIM3DM-DYNAMO API___________________"""
import clr 
import sys
sys.path.append(r'C:\Program Files\Autodesk\Revit 2020\AddIns\DynamoForRevit\IronPython.StdLib.2.7.8')
import math 
from System.Collections.Generic import *

clr.AddReference("ProtoGeometry")
from Autodesk.DesignScript.Geometry import *

clr.AddReference('RevitAPI')
import Autodesk
from Autodesk.Revit.DB import *

clr.AddReference('RevitAPIUI')
from Autodesk.Revit.UI import*
from  Autodesk.Revit.UI.Selection import*

clr.AddReference("RevitNodes")
import Revit
clr.ImportExtensions(Revit.Elements)
clr.ImportExtensions(Revit.GeometryConversion)

clr.AddReference("RevitServices")
import RevitServices
from RevitServices.Persistence import DocumentManager
from RevitServices.Transactions import TransactionManager

doc = DocumentManager.Instance.CurrentDBDocument
view = doc.ActiveView
uidoc = DocumentManager.Instance.CurrentUIApplication.ActiveUIDocument

#Preparing input from dynamo to revit
element = UnwrapElement(IN[0])

#Do some action in a Transaction
#TransactionManager.Instance.EnsureInTransaction(doc)
"""Now, You Can Code """



#TransactionManager.Instance.TransactionTaskDone()

OUT = element
# ----------------------------------------
getdbedgesplanarfaces_2 = Python(IN[1]=getverticaldbplanarfaces)  # "getDbEdgesPlanarFaces(dbPlanarFaces)"; IronPython2; unwired: IN[0]; same code as getedgesplanarfaces
getmaxdblines_dblines = Python(IN[1]=getdbedgesplanarfaces_2)  # IronPython2; unwired: IN[0]
# ---------- getmaxdblines_dblines.python (68 lines) ----------
import clr
import System
 
clr.AddReference("RevitServices")
import RevitServices
from RevitServices.Persistence import DocumentManager
from RevitServices.Transactions import TransactionManager


clr.AddReference("RevitNodes")
import Revit
clr.ImportExtensions(Revit.Elements)
clr.ImportExtensions(Revit.GeometryConversion)

clr.AddReference("RevitAPIUI")
from Autodesk.Revit.UI import*
clr.AddReference('RevitAPIUI')
from  Autodesk.Revit.UI.Selection import*
from  Autodesk.Revit.UI.Selection import ISelectionFilter

clr.AddReference('RevitAPI')
from Autodesk.Revit.DB import*
from Autodesk.Revit.DB import Line, ModelLine, LinePattern, ElementId
import Autodesk.Revit.DB as RDB
from Autodesk.Revit.DB import Line, GeometryInstance, Solid

doc = DocumentManager.Instance.CurrentDBDocument
view = doc.ActiveView
uidoc = DocumentManager.Instance.CurrentUIApplication.ActiveUIDocument
app  = uidoc.Application 
# #############################################################
# #                      FUNCTION                             #


# def getDbEdgesPlanarFaces(dbPlanarFaces):
#     result = []
#     for eles in dbPlanarFaces:
#         re = []
#         for ele in eles:
#             vals = ele.EdgeLoops
#             re.append(vals)
#         result.append(re)
#     return result

def getMaxDbLines(dbLines): # Get a min line of list line
    lengths = []
    dbMaxLine = []
    for lines in dbLines:
        r1 = []
        for line in lines:
            r1.append(line.Length)
        lengths.append(r1)

    for index in range(len(dbLines)):
        r2 = []
        for line in dbLines[index]:
            if line.Length == max(lengths[index]):
                r2.append(line)
        dbMaxLine.append(r2)
    return dbMaxLine



# #############################################################
# #                      GEOMETRY                             #
# #############################################################
elements = UnwrapElement(IN[1]) if isinstance(IN[1], list) else [UnwrapElement(IN[1])]
OUT = [getMaxDbLines(eles) for eles in elements]
# ----------------------------------------
code_block_4 = CodeBlock(a=getmaxdblines_dblines) { a[0][0]; }
firstItem_2 = List.FirstItem(list=code_block_4)
dbLine = Python(IN[1]=firstItem_2)  # IronPython2; unwired: IN[0]
# ---------- dbLine.python (51 lines) ----------
import clr
import System
 
clr.AddReference("RevitServices")
import RevitServices
from RevitServices.Persistence import DocumentManager
from RevitServices.Transactions import TransactionManager


clr.AddReference("RevitNodes")
import Revit
clr.ImportExtensions(Revit.Elements)
clr.ImportExtensions(Revit.GeometryConversion)

clr.AddReference("RevitAPIUI")
from Autodesk.Revit.UI import*
clr.AddReference('RevitAPIUI')
from  Autodesk.Revit.UI.Selection import*
from  Autodesk.Revit.UI.Selection import ISelectionFilter

clr.AddReference('RevitAPI')
from Autodesk.Revit.DB import*
from Autodesk.Revit.DB import Line, ModelLine, LinePattern, ElementId
import Autodesk.Revit.DB as RDB
from Autodesk.Revit.DB import Line, GeometryInstance, Solid

doc = DocumentManager.Instance.CurrentDBDocument
view = doc.ActiveView
uidoc = DocumentManager.Instance.CurrentUIApplication.ActiveUIDocument
app  = uidoc.Application 
# #############################################################
# #                      FUNCTION                             #


# #############################################################
# #                      GEOMETRY                             #
# #############################################################
maxLine = IN[1]


xyzMaxLine1 = maxLine.GetEndPoint(0)
xyzMaxLine2 = maxLine.GetEndPoint(1)

vtByDbLine = xyzMaxLine1 - xyzMaxLine2

xyzPictPoint = uidoc.Selection.PickPoint("Select a place to put DIM")

direct = vtByDbLine.CrossProduct(XYZ.BasisZ)

dbLine = Line.CreateBound(xyzPictPoint, xyzPictPoint + direct)
OUT = dbLine
# ----------------------------------------
flatten_6 = List.Flatten(list=getverticaldbplanarfaces)
newDimension = Python(IN[1]=dbLine, IN[2]=flatten_6)  # IronPython2; frozen; unwired: IN[0]
# ---------- newDimension.python (51 lines) ----------
import clr
import System
 
clr.AddReference("RevitServices")
import RevitServices
from RevitServices.Persistence import DocumentManager
from RevitServices.Transactions import TransactionManager


clr.AddReference("RevitNodes")
import Revit
clr.ImportExtensions(Revit.Elements)
clr.ImportExtensions(Revit.GeometryConversion)

clr.AddReference("RevitAPIUI")
from Autodesk.Revit.UI import*
clr.AddReference('RevitAPIUI')
from  Autodesk.Revit.UI.Selection import*
from  Autodesk.Revit.UI.Selection import ISelectionFilter

clr.AddReference('RevitAPI')
from Autodesk.Revit.DB import*
from Autodesk.Revit.DB import Line, ModelLine, LinePattern, ElementId
import Autodesk.Revit.DB as RDB
from Autodesk.Revit.DB import Line, GeometryInstance, Solid

doc = DocumentManager.Instance.CurrentDBDocument
view = doc.ActiveView
uidoc = DocumentManager.Instance.CurrentUIApplication.ActiveUIDocument
app  = uidoc.Application 
# #############################################################
# #                      FUNCTION                             #

def getReferencesArray(planarFaces):
    reArray = ReferenceArray()
    for i in planarFaces:
        reArray.Append(i.Reference)
    return reArray
# #############################################################
# #                      GEOMETRY                             #
# #############################################################
dbLine = IN[1]
planarFaces = IN[2]

TransactionManager.Instance.EnsureInTransaction(doc)
refs = getReferencesArray(planarFaces)
dim = doc.Create.NewDimension(view, dbLine, refs)
TransactionManager.Instance.TransactionTaskDone()


OUT = dim
# ----------------------------------------
select_faces = SelectFaces()  # 1 picked in the model

# group: DtR
flatten_7 = List.Flatten(list=select_faces)
python_script_5 = Python(IN[0]=flatten_7)  # CPython3
# ---------- python_script_5.python (48 lines) ----------
"""Copyright(c) 2019 by: duengocnguyen@gmail.com"""
'https://www.youtube.com/channel/UCt2JhCDDFxpYho575WTMZ4g'
"""________________Welcome to BIM3DM-DYNAMO API___________________"""
import clr 
import sys
sys.path.append(r'C:\Program Files\Autodesk\Revit 2020\AddIns\DynamoForRevit\IronPython.StdLib.2.7.8')
import math 
from System.Collections.Generic import *

clr.AddReference("ProtoGeometry")
from Autodesk.DesignScript.Geometry import *

clr.AddReference('RevitAPI')
import Autodesk
from Autodesk.Revit.DB import *

clr.AddReference('RevitAPIUI')
from Autodesk.Revit.UI import*
from  Autodesk.Revit.UI.Selection import*

clr.AddReference("RevitNodes")
import Revit
clr.ImportExtensions(Revit.Elements)
clr.ImportExtensions(Revit.GeometryConversion)
clr.AddReference('DSCoreNodes')
from DSCore import *

clr.AddReference("RevitServices")
import RevitServices
from RevitServices.Persistence import DocumentManager
from RevitServices.Transactions import TransactionManager

doc = DocumentManager.Instance.CurrentDBDocument
view = doc.ActiveView
uidoc = DocumentManager.Instance.CurrentUIApplication.ActiveUIDocument

#Preparing input from dynamo to revit
elements = UnwrapElement(IN[0])

#Do some action in a Transaction
#TransactionManager.Instance.EnsureInTransaction(doc)
"""Now, You Can Code """



#TransactionManager.Instance.TransactionTaskDone()

OUT = [ele.ToRevitType() for ele in elements]
# ----------------------------------------

flatten_8 = List.Flatten(list=python_script_5)
python_script_6 = Python(IN[0]=flatten_8)  # CPython3; frozen; same code as python_script_3
code_block_5 = CodeBlock(planarfaces=getplanarfacesbydbsolid_dbsolids) { planarfaces; }
boolean_4 = BoolSelector(false)
python_script_7 = Python(IN[1]=code_block_5, IN[2]=boolean_4)  # IronPython2; unwired: IN[0]
# ---------- python_script_7.python (59 lines) ----------
import clr
import System
 
clr.AddReference("RevitServices")
import RevitServices
from RevitServices.Persistence import DocumentManager
from RevitServices.Transactions import TransactionManager


clr.AddReference("RevitNodes")
import Revit
clr.ImportExtensions(Revit.Elements)
clr.ImportExtensions(Revit.GeometryConversion)

clr.AddReference("RevitAPIUI")
from Autodesk.Revit.UI import*
clr.AddReference('RevitAPIUI')
from  Autodesk.Revit.UI.Selection import*
from  Autodesk.Revit.UI.Selection import ISelectionFilter

clr.AddReference('RevitAPI')
from Autodesk.Revit.DB import*
from Autodesk.Revit.DB import Line, ModelLine, LinePattern, ElementId
import Autodesk.Revit.DB as RDB
from Autodesk.Revit.DB import Line, GeometryInstance, Solid

doc = DocumentManager.Instance.CurrentDBDocument
view = doc.ActiveView
uidoc = DocumentManager.Instance.CurrentUIApplication.ActiveUIDocument
app  = uidoc.Application 
# #############################################################
# #                      FUNCTION                             #

def getRightPlanarFaces(dbPlanarFaces):
    direct = view.RightDirection
    for pf in dbPlanarFaces:
        faceNormal = pf.FaceNormal
        if faceNormal.IsAlmostEqualTo(direct):
            return pf


def getLeftPlanarFaces(dbPlanarFaces):
    direct = view.RightDirection
    for pf in dbPlanarFaces:
        faceNormal = -1 * pf.FaceNormal
        if faceNormal.IsAlmostEqualTo(direct):
            return pf

def getLeftOrRightPlanarFaces(dbPlanarFaces, isLeftPlanarFace = True):
    if isLeftPlanarFace:
        return getLeftPlanarFaces(dbPlanarFaces)
    else:
        return getRightPlanarFaces(dbPlanarFaces)      
# #############################################################
# #                      GEOMETRY                             #
# #############################################################
elements = UnwrapElement(IN[1]) if isinstance(IN[1], list) else [UnwrapElement(IN[1])]
isTopPlanarFace = IN[2]
OUT = [getLeftOrRightPlanarFaces(ele, isTopPlanarFace) for ele in elements]
# ----------------------------------------
conversionRtD_4 = Custom[ConversionRtD](Objects=python_script_7)

# group: Design Script
boolean_5 = BoolSelector(false)
python_script_8 = Python(IN[0]=boolean_5)  # CPython3; same code as python_script
python_script_from_string_2 = PythonStringNode(script=python_script_8)  # IronPython2; unwired: IN[0], IN[1], IN[2]
conversionRtD_5 = Custom[ConversionRtD](Objects=python_script_from_string_2)

select_model_element = DSModelElementSelection()  # 1 picked in the model
geometry = Element.Geometry(element=select_model_element)
getRightPlanarFaces = Python(IN[1]=code_block_5)  # IronPython2; unwired: IN[0]
# ---------- getRightPlanarFaces.python (45 lines) ----------
import clr
import System
 
clr.AddReference("RevitServices")
import RevitServices
from RevitServices.Persistence import DocumentManager
from RevitServices.Transactions import TransactionManager


clr.AddReference("RevitNodes")
import Revit
clr.ImportExtensions(Revit.Elements)
clr.ImportExtensions(Revit.GeometryConversion)

clr.AddReference("RevitAPIUI")
from Autodesk.Revit.UI import*
clr.AddReference('RevitAPIUI')
from  Autodesk.Revit.UI.Selection import*
from  Autodesk.Revit.UI.Selection import ISelectionFilter

clr.AddReference('RevitAPI')
from Autodesk.Revit.DB import*
from Autodesk.Revit.DB import Line, ModelLine, LinePattern, ElementId
import Autodesk.Revit.DB as RDB
from Autodesk.Revit.DB import Line, GeometryInstance, Solid

doc = DocumentManager.Instance.CurrentDBDocument
view = doc.ActiveView
uidoc = DocumentManager.Instance.CurrentUIApplication.ActiveUIDocument
app  = uidoc.Application 
# #############################################################
# #                      FUNCTION                             #

def getRightPlanarFaces(dbPlanarFaces):
    direct = view.RightDirection
    for pf in dbPlanarFaces:
        faceNormal = pf.FaceNormal
        if faceNormal.IsAlmostEqualTo(direct):
            return pf

# #############################################################
# #                      GEOMETRY                             #
# #############################################################
elements = UnwrapElement(IN[1]) if isinstance(IN[1], list) else [UnwrapElement(IN[1])]
OUT = [getRightPlanarFaces(eles) for eles in elements]
# ----------------------------------------
getLeftPlanarFaces = Python(IN[1]=code_block_5)  # IronPython2; unwired: IN[0]
# ---------- getLeftPlanarFaces.python (45 lines) ----------
import clr
import System
 
clr.AddReference("RevitServices")
import RevitServices
from RevitServices.Persistence import DocumentManager
from RevitServices.Transactions import TransactionManager


clr.AddReference("RevitNodes")
import Revit
clr.ImportExtensions(Revit.Elements)
clr.ImportExtensions(Revit.GeometryConversion)

clr.AddReference("RevitAPIUI")
from Autodesk.Revit.UI import*
clr.AddReference('RevitAPIUI')
from  Autodesk.Revit.UI.Selection import*
from  Autodesk.Revit.UI.Selection import ISelectionFilter

clr.AddReference('RevitAPI')
from Autodesk.Revit.DB import*
from Autodesk.Revit.DB import Line, ModelLine, LinePattern, ElementId
import Autodesk.Revit.DB as RDB
from Autodesk.Revit.DB import Line, GeometryInstance, Solid

doc = DocumentManager.Instance.CurrentDBDocument
view = doc.ActiveView
uidoc = DocumentManager.Instance.CurrentUIApplication.ActiveUIDocument
app  = uidoc.Application 
# #############################################################
# #                      FUNCTION                             #

def getLeftPlanarFaces(dbPlanarFaces):
    direct = view.RightDirection
    for pf in dbPlanarFaces:
        faceNormal = -1 * pf.FaceNormal
        if faceNormal.IsAlmostEqualTo(direct):
            return pf

# #############################################################
# #                      GEOMETRY                             #
# #############################################################
elements = UnwrapElement(IN[1]) if isinstance(IN[1], list) else [UnwrapElement(IN[1])]
OUT = [getLeftPlanarFaces(eles) for eles in elements]
# ----------------------------------------
getFaceNormal_2 = Python(IN[0]=code_block_5)  # CPython3
# ---------- getFaceNormal_2.python (46 lines) ----------
"""Copyright(c) 2019 by: duengocnguyen@gmail.com"""
'https://www.youtube.com/channel/UCt2JhCDDFxpYho575WTMZ4g'
"""________________Welcome to BIM3DM-DYNAMO API___________________"""
import clr 
import sys
sys.path.append(r'C:\Program Files\Autodesk\Revit 2020\AddIns\DynamoForRevit\IronPython.StdLib.2.7.8')
import math 
from System.Collections.Generic import *

clr.AddReference("ProtoGeometry")
from Autodesk.DesignScript.Geometry import *

clr.AddReference('RevitAPI')
import Autodesk
from Autodesk.Revit.DB import *

clr.AddReference('RevitAPIUI')
from Autodesk.Revit.UI import*
from  Autodesk.Revit.UI.Selection import*

clr.AddReference("RevitNodes")
import Revit
clr.ImportExtensions(Revit.Elements)
clr.ImportExtensions(Revit.GeometryConversion)

clr.AddReference("RevitServices")
import RevitServices
from RevitServices.Persistence import DocumentManager
from RevitServices.Transactions import TransactionManager

doc = DocumentManager.Instance.CurrentDBDocument
view = doc.ActiveView
uidoc = DocumentManager.Instance.CurrentUIApplication.ActiveUIDocument

#Preparing input from dynamo to revit
elements = UnwrapElement(IN[0])

#Do some action in a Transaction
#TransactionManager.Instance.EnsureInTransaction(doc)
"""Now, You Can Code """



#TransactionManager.Instance.TransactionTaskDone()

OUT = [ele.FaceNormal for j in elements for ele in j]
# ----------------------------------------
boolean_6 = BoolSelector(false)
getTopOrBotPlanarFaces = Python(IN[1]=code_block_5, IN[2]=boolean_6)  # CPython3; unwired: IN[0]
# ---------- getTopOrBotPlanarFaces.python (54 lines) ----------
import clr
import System
 
clr.AddReference("RevitServices")
import RevitServices
from RevitServices.Persistence import DocumentManager
from RevitServices.Transactions import TransactionManager


clr.AddReference("RevitNodes")
import Revit
clr.ImportExtensions(Revit.Elements)
clr.ImportExtensions(Revit.GeometryConversion)

clr.AddReference("RevitAPIUI")
from Autodesk.Revit.UI import*
clr.AddReference('RevitAPIUI')
from  Autodesk.Revit.UI.Selection import*
from  Autodesk.Revit.UI.Selection import ISelectionFilter

clr.AddReference('RevitAPI')
from Autodesk.Revit.DB import*
from Autodesk.Revit.DB import Line, ModelLine, LinePattern, ElementId
import Autodesk.Revit.DB as RDB
from Autodesk.Revit.DB import Line, GeometryInstance, Solid

doc = DocumentManager.Instance.CurrentDBDocument
view = doc.ActiveView
uidoc = DocumentManager.Instance.CurrentUIApplication.ActiveUIDocument
app  = uidoc.Application 
# #############################################################
# #                      FUNCTION                             #

def getTopPlanarFaces(dbPlanarFaces):
    for pf in dbPlanarFaces:
        if pf.FaceNormal.Z > 0:
            return pf

def getBotPlanarFaces(dbPlanarFaces):
    for pf in dbPlanarFaces:
        if pf.FaceNormal.Z < 0:
            return pf

def getTopOrBotPlanarFaces(dbPlanarFaces, isTopPlanarFace = True):
    if isTopPlanarFace:
        return getTopPlanarFaces(dbPlanarFaces)
    else:
        return getBotPlanarFaces(dbPlanarFaces)
# #############################################################
# #                      GEOMETRY                             #
# #############################################################
elements = UnwrapElement(IN[1]) if isinstance(IN[1], list) else [UnwrapElement(IN[1])]
isTopPlanarFace = IN[2]
OUT = [getTopOrBotPlanarFaces(ele, isTopPlanarFace) for ele in elements]
# ----------------------------------------
conversionRtD_6 = Custom[ConversionRtD](Objects=getTopOrBotPlanarFaces)
conversionRtD_7 = Custom[ConversionRtD](Objects=getplanarfacesbydbsolid_dbsolids)
form_1 = Python()  # IronPython2; frozen; unwired: IN[0]
# ---------- form_1.python (136 lines) ----------
import clr
import System
 
clr.AddReference("RevitServices")
import RevitServices
from RevitServices.Persistence import DocumentManager
from RevitServices.Transactions import TransactionManager

clr.AddReference("RevitNodes")
import Revit
clr.ImportExtensions(Revit.Elements)
clr.ImportExtensions(Revit.GeometryConversion)

clr.AddReference("RevitAPIUI")
from Autodesk.Revit.UI import*
clr.AddReference('RevitAPIUI')
from Autodesk.Revit.UI import Selection
from  Autodesk.Revit.UI.Selection import ISelectionFilter

clr.AddReference('RevitAPI')
from Autodesk.Revit.DB import*
#########################################################################
clr.AddReference('System.Windows.Forms')
clr.AddReference('System.Drawing')
# clr.AddReference('System.Windows.Forms.DataVisualization')
import System.Windows.Forms
import System.Drawing
from System.Drawing import *
from System.Windows.Forms import *
from System.Collections.Generic import *
#########################################################################
doc = DocumentManager.Instance.CurrentDBDocument
View = doc.ActiveView
uidoc = DocumentManager.Instance.CurrentUIApplication.ActiveUIDocument

#########################################################################


class MainForm(Form):
	def __init__(self):
		self.InitializeComponent()
	
	def InitializeComponent(self):
		self._listView1 = System.Windows.Forms.ListView()
		self._cbbx = System.Windows.Forms.ComboBox()
		self._button1 = System.Windows.Forms.Button()
		self._button2 = System.Windows.Forms.Button()
		self.SuspendLayout()
		# 
		# listView1
		# 
		self._listView1.Location = System.Drawing.Point(5, 54)
		self._listView1.Name = "listView1"
		self._listView1.Size = System.Drawing.Size(366, 339)
		self._listView1.TabIndex = 0
		self._listView1.UseCompatibleStateImageBehavior = False
		# 
		# cbbx
		# 
		self._cbbx.FormattingEnabled = True
		self._cbbx.Location = System.Drawing.Point(5, 27)
		self._cbbx.Name = "cbbx"
		self._cbbx.Size = System.Drawing.Size(366, 21)
		self._cbbx.TabIndex = 1
		self._cbbx.SelectedIndexChanged += self.ComboBox1SelectedIndexChanged
		self._cbbx.Items.AddRange(System.Array[System.Object](["a", "b", "c", "d"]))

		# 
		# button1
		# 
		self._button1.Location = System.Drawing.Point(204, 399)
		self._button1.Name = "button1"
		self._button1.Size = System.Drawing.Size(75, 23)
		self._button1.TabIndex = 2
		self._button1.Text = "Cancel"
		self._button1.UseVisualStyleBackColor = True
		# 
		# button2
		# 
		self._button2.Location = System.Drawing.Point(285, 399)
		self._button2.Name = "button2"
		self._button2.Size = System.Drawing.Size(75, 23)
		self._button2.TabIndex = 3
		self._button2.Text = "Ok"
		self._button2.UseVisualStyleBackColor = True
		# 
		# MainForm
		# 
		self.AllowDrop = True
		self.AutoScroll = True
		self.AutoSize = True
		self.AutoSizeMode = System.Windows.Forms.AutoSizeMode.GrowAndShrink
		self.BackColor = System.Drawing.SystemColors.ButtonHighlight
		self.ClientSize = System.Drawing.Size(382, 425)
		self.Controls.Add(self._button2)
		self.Controls.Add(self._button1)
		self.Controls.Add(self._cbbx)
		self.Controls.Add(self._listView1)
		self.ForeColor = System.Drawing.SystemColors.ActiveCaptionText
		self.FormBorderStyle = System.Windows.Forms.FormBorderStyle.Fixed3D
		self.HelpButton = True
		self.Name = "MainForm"
		self.ShowIcon = False
		self.StartPosition = System.Windows.Forms.FormStartPosition.CenterScreen
		self.Text = "Form"
		self.TopMost = True
		self.Load += self.MainFormLoad
		self.ResumeLayout(False)


	def MainFormLoad(self, sender, e):
			pass

	def ComboBox1SelectedIndexChanged(self, sender, e):
		selected_item = self._cbbx.SelectedItem

		if selected_item == "a":
			self.UpdateListView(0, 10)
		elif selected_item == "b":
			self.UpdateListView(11, 20)
		elif selected_item == "c":
			self.UpdateListView(21, 30)
		elif selected_item == "d":
			self.UpdateListView(50, 100)
			pass

	def UpdateListView(self, start, end):
		self._listView1.Items.Clear()
		data = System.Array[object]([str(i) for i in range(start, end + 1)])
		for item in data:
			self._listView1.Items.Add(item)




Application.Run(MainForm())
# ----------------------------------------
form_2 = Python()  # CPython3; frozen; unwired: IN[0]
# ---------- form_2.python (71 lines) ----------
import clr
import System
 
clr.AddReference("RevitServices")
import RevitServices
from RevitServices.Persistence import DocumentManager
from RevitServices.Transactions import TransactionManager


clr.AddReference("RevitNodes")
import Revit
clr.ImportExtensions(Revit.Elements)
clr.ImportExtensions(Revit.GeometryConversion)

clr.AddReference("RevitAPIUI")
from Autodesk.Revit.UI import*
clr.AddReference('RevitAPIUI')
from  Autodesk.Revit.UI.Selection import*
from  Autodesk.Revit.UI.Selection import ISelectionFilter

clr.AddReference('RevitAPI')
from Autodesk.Revit.DB import*
from Autodesk.Revit.DB import Line, ModelLine, LinePattern, ElementId
import Autodesk.Revit.DB as RDB
from Autodesk.Revit.DB import Line, GeometryInstance, Solid
#########################################################################
clr.AddReference('System.Windows.Forms')
clr.AddReference('System.Drawing')
# clr.AddReference('System.Windows.Forms.DataVisualization')
import System.Windows.Forms
import System.Drawing
from System.Drawing import *
from System.Windows.Forms import *
from System.Collections.Generic import *
#########################################################################
doc = DocumentManager.Instance.CurrentDBDocument
View = doc.ActiveView
uidoc = DocumentManager.Instance.CurrentUIApplication.ActiveUIDocument

#########################################################################

class MainForm(Form):
	def __init__(self):
		self.InitializeComponent()
	
	def InitializeComponent(self):
		self._label1 = System.Windows.Forms.Label()
		self.SuspendLayout()
		# 
		# label1
		# 
		self._label1.Location = System.Drawing.Point(191, 172)
		self._label1.Name = "label1"
		self._label1.Size = System.Drawing.Size(100, 23)
		self._label1.TabIndex = 0
		self._label1.Text = "HELLO WORLD"
		self._label1.TextAlign = System.Drawing.ContentAlignment.MiddleCenter
		# 
		# MainForm
		# 
		self.ClientSize = System.Drawing.Size(533, 397)
		self.Controls.Add(self._label1)
		self.Name = "MainForm"
		self.StartPosition = System.Windows.Forms.FormStartPosition.CenterScreen
		self.Text = "Form1"
		self.TopMost = True
		self.ResumeLayout(False)


		
Application.Run(MainForm())
# ----------------------------------------
form_3 = Python()  # CPython3; frozen; unwired: IN[0]
# ---------- form_3.python (163 lines) ----------
import clr
import System
 
clr.AddReference("RevitServices")
import RevitServices
from RevitServices.Persistence import DocumentManager
from RevitServices.Transactions import TransactionManager

clr.AddReference("RevitNodes")
import Revit
clr.ImportExtensions(Revit.Elements)
clr.ImportExtensions(Revit.GeometryConversion)

clr.AddReference("RevitAPIUI")
from Autodesk.Revit.UI import*
clr.AddReference('RevitAPIUI')
from Autodesk.Revit.UI import Selection
from  Autodesk.Revit.UI.Selection import ISelectionFilter

clr.AddReference('RevitAPI')
from Autodesk.Revit.DB import*
#########################################################################
clr.AddReference('System.Windows.Forms')
clr.AddReference('System.Drawing')
# clr.AddReference('System.Windows.Forms.DataVisualization')
import System.Windows.Forms
import System.Drawing
from System.Drawing import *
from System.Windows.Forms import *
from System.Collections.Generic import *
#########################################################################
doc = DocumentManager.Instance.CurrentDBDocument
View = doc.ActiveView
uidoc = DocumentManager.Instance.CurrentUIApplication.ActiveUIDocument

class MainForm(Form):
	def __init__(self):
		self.InitializeComponent()
	
	def InitializeComponent(self):
		self._Schedules = System.Windows.Forms.GroupBox()
		self._lstSche = System.Windows.Forms.ListBox()
		self._rdbtAll = System.Windows.Forms.RadioButton()
		self._groupBox1 = System.Windows.Forms.GroupBox()
		self._label1 = System.Windows.Forms.Label()
		self._textBox1 = System.Windows.Forms.TextBox()
		self._button1 = System.Windows.Forms.Button()
		self._bttExport = System.Windows.Forms.Button()
		self._bttCancel = System.Windows.Forms.Button()
		self._Schedules.SuspendLayout()
		self._groupBox1.SuspendLayout()
		self.SuspendLayout()
		# 
		# Schedules
		# 
		self._Schedules.Controls.Add(self._rdbtAll)
		self._Schedules.Controls.Add(self._lstSche)
		self._Schedules.Location = System.Drawing.Point(14, 13)
		self._Schedules.Name = "Schedules"
		self._Schedules.Size = System.Drawing.Size(467, 154)
		self._Schedules.TabIndex = 0
		self._Schedules.TabStop = False
		self._Schedules.Text = "Schedules"
		# 
		# lstSche
		# 
		self._lstSche.FormattingEnabled = True
		self._lstSche.Location = System.Drawing.Point(6, 19)
		self._lstSche.Name = "lstSche"
		self._lstSche.Size = System.Drawing.Size(453, 108)
		self._lstSche.TabIndex = 0
		# 
		# rdbtAll
		# 
		self._rdbtAll.Location = System.Drawing.Point(7, 127)
		self._rdbtAll.Name = "rdbtAll"
		self._rdbtAll.Size = System.Drawing.Size(104, 24)
		self._rdbtAll.TabIndex = 1
		self._rdbtAll.TabStop = True
		self._rdbtAll.Text = "Check All/None"
		self._rdbtAll.UseVisualStyleBackColor = True
		# 
		# groupBox1
		# 
		self._groupBox1.Controls.Add(self._button1)
		self._groupBox1.Controls.Add(self._textBox1)
		self._groupBox1.Controls.Add(self._label1)
		self._groupBox1.Location = System.Drawing.Point(14, 175)
		self._groupBox1.Name = "groupBox1"
		self._groupBox1.Size = System.Drawing.Size(467, 55)
		self._groupBox1.TabIndex = 1
		self._groupBox1.TabStop = False
		self._groupBox1.Text = "Export Options"
		# 
		# label1
		# 
		self._label1.Location = System.Drawing.Point(7, 20)
		self._label1.Name = "label1"
		self._label1.Size = System.Drawing.Size(100, 23)
		self._label1.TabIndex = 0
		self._label1.Text = "Output folder:"
		# 
		# textBox1
		# 
		self._textBox1.Location = System.Drawing.Point(80, 20)
		self._textBox1.Name = "textBox1"
		self._textBox1.Size = System.Drawing.Size(298, 20)
		self._textBox1.TabIndex = 1
		# 
		# button1
		# 
		self._button1.Location = System.Drawing.Point(384, 20)
		self._button1.Name = "button1"
		self._button1.Size = System.Drawing.Size(75, 23)
		self._button1.TabIndex = 2
		self._button1.Text = "Browse..."
		self._button1.UseVisualStyleBackColor = True
		# 
		# bttExport
		# 
		self._bttExport.Location = System.Drawing.Point(317, 236)
		self._bttExport.Name = "bttExport"
		self._bttExport.Size = System.Drawing.Size(75, 23)
		self._bttExport.TabIndex = 2
		self._bttExport.Text = "Export"
		self._bttExport.UseVisualStyleBackColor = True
		# 
		# bttCancel
		# 
		self._bttCancel.Location = System.Drawing.Point(398, 236)
		self._bttCancel.Name = "bttCancel"
		self._bttCancel.Size = System.Drawing.Size(75, 23)
		self._bttCancel.TabIndex = 3
		self._bttCancel.Text = "Cacel"
		self._bttCancel.UseVisualStyleBackColor = True
		# 
		# MainForm
		# 
		self.BackColor = System.Drawing.SystemColors.ButtonHighlight
		self.ClientSize = System.Drawing.Size(495, 264)
		self.Controls.Add(self._bttCancel)
		self.Controls.Add(self._bttExport)
		self.Controls.Add(self._groupBox1)
		self.Controls.Add(self._Schedules)
		self.Name = "MainForm"
		self.ShowIcon = False
		self.Text = "Export Schedule Dynamo Winform"
		self._Schedules.ResumeLayout(False)
		self._groupBox1.ResumeLayout(False)
		self._groupBox1.PerformLayout()
		self.ResumeLayout(False)








form  = MainForm()
Application.Run(form)

OUT = 0
# ----------------------------------------
