# Dynamo graph Geometry_Lesson_16_plan.dyn (Dynamo 2.18.1.5096)
# packages: BIM3DM 2.1.16

# group: Design Script
boolean = BoolSelector(true)
python_script = Python(IN[0]=boolean)  # CPython3
# ---------- python_script.python (4 lines) ----------
#f = open(r"U:\17_TrainingAdvanceDynamo\2_WORKING\Tool\Dynamo\Training-Dynamo-2024\DesignScript.py", "r")

f = open(r"A:\Library-Dynamo-Python-CSharp\test.py", "r")
OUT = f.read() 
# ----------------------------------------
python_script_from_string = PythonStringNode(script=python_script)  # IronPython2; unwired: IN[0], IN[1]
boolean_2 = BoolSelector(false)

code_block = CodeBlock { ["Structural Framing"]; }  # frozen
boolean_3 = BoolSelector(true)
selectionElementsByCategoryNameAndClassi = Custom[SelectionElementsByCategoryNameAndClassification](categoryNames=code_block, reset=boolean_3)  # package BIM3DM; Returning the elements you want to select based on the name of the category you pass as a parameter. Subsequently, classify them for you.
valueAtKey = DesignScript.Builtin.Dictionary.ValueAtKey(dictionary=selectionElementsByCategoryNameAndClassi, key=code_block)
flatten = List.Flatten(list=valueAtKey)
getgeoelement_element = Python(IN[1]=flatten)  # CPython3; unwired: IN[0]
# ---------- getgeoelement_element.python (48 lines) ----------
"""Copyright by: duengocnguyen@gmail.com"""
import clr 
import System
import math 
from System.Collections.Generic import *

clr.AddReference("ProtoGeometry")
from Autodesk.DesignScript.Geometry import *

clr.AddReference('RevitAPI')
import Autodesk
from Autodesk.Revit.DB import *

clr.AddReference('RevitAPIUI')
from Autodesk.Revit.UI import*
from  Autodesk.Revit.UI.Selection import*

clr.AddReference("RevitNodes")
import Revit
clr.ImportExtensions(Revit.Elements)
clr.ImportExtensions(Revit.GeometryConversion)

clr.AddReference("RevitServices")
import RevitServices
from RevitServices.Persistence import DocumentManager
from RevitServices.Transactions import TransactionManager

# Accessing the current Revit document and active view
doc = DocumentManager.Instance.CurrentDBDocument
view = doc.ActiveView
uidoc = DocumentManager.Instance.CurrentUIApplication.ActiveUIDocument
# #############################################################
# #                      FUNCTION                             #
# #############################################################
def getGeoElement(element): # Get geometry of element.
    geo = []
    opt = Options()
    opt.ComputeReferences = True
    opt.IncludeNonVisibleObjects = True
    opt.DetailLevel = ViewDetailLevel.Fine
    geoByElement = element.get_Geometry(opt)
    geo = [i for i in geoByElement]
    return geo
# #############################################################
# #                      GEOMETRY                             #
# #############################################################
elements = UnwrapElement(IN[1]) if isinstance(IN[1],list) else [UnwrapElement(IN[1])]
OUT = [getGeoElement(i) for i in elements]
# ----------------------------------------
flatten_2 = List.Flatten(list=getgeoelement_element)
filterTypesDBGeo = Python(IN[1]=flatten_2)  # CPython3; unwired: IN[0]
# ---------- filterTypesDBGeo.python (44 lines) ----------
import clr
import System
 
clr.AddReference("RevitServices")
import RevitServices
from RevitServices.Persistence import DocumentManager
from RevitServices.Transactions import TransactionManager

clr.AddReference("RevitNodes")
import Revit
clr.ImportExtensions(Revit.Elements)
clr.ImportExtensions(Revit.GeometryConversion)

clr.AddReference("RevitAPIUI")
from Autodesk.Revit.UI import*
clr.AddReference('RevitAPIUI')
from Autodesk.Revit.UI import Selection
from  Autodesk.Revit.UI.Selection import ISelectionFilter

clr.AddReference('RevitAPI')
from Autodesk.Revit.DB import*
from Autodesk.Revit.DB import Line, ModelLine, LinePattern, ElementId
import Autodesk.Revit.DB as RDB
doc = DocumentManager.Instance.CurrentDBDocument
View = doc.ActiveView
uidoc = DocumentManager.Instance.CurrentUIApplication.ActiveUIDocument
app  = uidoc.Application 
# #############################################################
# #                      FUNCTION                             #
# #############################################################
from Autodesk.Revit.DB import Line, GeometryInstance, Solid

def filterTypesDBGeo(lstGeo):
    mySet = set()
    for item in lstGeo:
        itemType = item.GetType().ToString()
        mySet.add(itemType)
    return mySet

# #############################################################
# #                      GEOMETRY                             #
# #############################################################
elements = UnwrapElement(IN[1]) if isinstance(IN[1],list) else [UnwrapElement(IN[1])]
OUT = filterTypesDBGeo(elements)
# ----------------------------------------
getdbsolidfromdbgeo_lstgeo = Python(IN[1]=getgeoelement_element)  # IronPython2; unwired: IN[0]
# ---------- getdbsolidfromdbgeo_lstgeo.python (46 lines) ----------
import clr
import System
 
clr.AddReference("RevitServices")
import RevitServices
from RevitServices.Persistence import DocumentManager
from RevitServices.Transactions import TransactionManager

clr.AddReference("RevitNodes")
import Revit
clr.ImportExtensions(Revit.Elements)
clr.ImportExtensions(Revit.GeometryConversion)

clr.AddReference("RevitAPIUI")
from Autodesk.Revit.UI import*
clr.AddReference('RevitAPIUI')
from Autodesk.Revit.UI import Selection
from  Autodesk.Revit.UI.Selection import ISelectionFilter

clr.AddReference('RevitAPI')
from Autodesk.Revit.DB import*
from Autodesk.Revit.DB import Line, ModelLine, LinePattern, ElementId
import Autodesk.Revit.DB as RDB
doc = DocumentManager.Instance.CurrentDBDocument
View = doc.ActiveView
uidoc = DocumentManager.Instance.CurrentUIApplication.ActiveUIDocument
app  = uidoc.Application 
# #############################################################
# #                      FUNCTION                             #
# #############################################################
def getDBSolidFromDBGeo(lstGeo):  # Way 1
    sol = []
    for i in lstGeo:
        if i.GetType() == Solid and i.Volume > 0:
            sol.append(i)
        elif i.GetType() == GeometryInstance:
            for j in i.GetInstanceGeometry():
                if isinstance(j, Solid):
                    if j.Volume > 0:
                        sol.append(j)
    return sol
# #############################################################
# #                      GEOMETRY                             #
# #############################################################
elements = UnwrapElement(IN[1]) if isinstance(IN[1],list) else [UnwrapElement(IN[1])]
OUT = [getDBSolidFromDBGeo(ele) for ele in elements]
# ----------------------------------------
getplanarfacesformsolid_solids = Python(IN[1]=getdbsolidfromdbgeo_lstgeo)  # IronPython2; unwired: IN[0]
# ---------- getplanarfacesformsolid_solids.python (48 lines) ----------
import clr
import System
 
clr.AddReference("RevitServices")
import RevitServices
from RevitServices.Persistence import DocumentManager
from RevitServices.Transactions import TransactionManager


clr.AddReference("RevitNodes")
import Revit
clr.ImportExtensions(Revit.Elements)
clr.ImportExtensions(Revit.GeometryConversion)

clr.AddReference("RevitAPIUI")
from Autodesk.Revit.UI import*
clr.AddReference('RevitAPIUI')
from Autodesk.Revit.UI import Selection
from  Autodesk.Revit.UI.Selection import ISelectionFilter

clr.AddReference('RevitAPI')
from Autodesk.Revit.DB import*
from Autodesk.Revit.DB import Line, ModelLine, LinePattern, ElementId
import Autodesk.Revit.DB as RDB
from Autodesk.Revit.DB import Line, GeometryInstance, Solid

doc = DocumentManager.Instance.CurrentDBDocument
View = doc.ActiveView
uidoc = DocumentManager.Instance.CurrentUIApplication.ActiveUIDocument
app  = uidoc.Application 
# #############################################################
# #                      FUNCTION                             #
# #############################################################
def getPlanarFacesFormSolid(solids): # Get PlanarFace from solids
    planarFaces = []
    for i in solids:
        var = i.Faces
        for j in var:
            if j.Reference != None:
                planarFaces.append(j)
    return planarFaces

# #############################################################
# #                      GEOMETRY                             #
# #############################################################

elements = UnwrapElement(IN[1]) if isinstance(IN[1],list) else [UnwrapElement(IN[1])]
OUT = [getPlanarFacesFormSolid(e) for e in elements]
# ----------------------------------------
getFaceNormal = Python(IN[1]=getplanarfacesformsolid_solids)  # CPython3; unwired: IN[0]
# ---------- getFaceNormal.python (40 lines) ----------
import clr
import System
 
clr.AddReference("RevitServices")
import RevitServices
from RevitServices.Persistence import DocumentManager
from RevitServices.Transactions import TransactionManager


clr.AddReference("RevitNodes")
import Revit
clr.ImportExtensions(Revit.Elements)
clr.ImportExtensions(Revit.GeometryConversion)

clr.AddReference("RevitAPIUI")
from Autodesk.Revit.UI import*
clr.AddReference('RevitAPIUI')
from Autodesk.Revit.UI import Selection
from  Autodesk.Revit.UI.Selection import ISelectionFilter

clr.AddReference('RevitAPI')
from Autodesk.Revit.DB import*
from Autodesk.Revit.DB import Line, ModelLine, LinePattern, ElementId
import Autodesk.Revit.DB as RDB
from Autodesk.Revit.DB import Line, GeometryInstance, Solid

doc = DocumentManager.Instance.CurrentDBDocument
View = doc.ActiveView
uidoc = DocumentManager.Instance.CurrentUIApplication.ActiveUIDocument
app  = uidoc.Application 
# #############################################################
# #                      FUNCTION                             #
# #############################################################
def getFaceNormal(dbPlanarFaces):
    return [e.FaceNormal for e in dbPlanarFaces]
# #############################################################
# #                      GEOMETRY                             #
# #############################################################
elements = UnwrapElement(IN[1]) if isinstance(IN[1],list) else [UnwrapElement(IN[1])]
OUT = [getFaceNormal(e) for e in elements]
# ----------------------------------------
filterverticaldbplanarface = Python(IN[1]=getplanarfacesformsolid_solids)  # "filterVerticalDBPlanarFace(dbPlanarFaces)"; CPython3; unwired: IN[0]
# ---------- filterverticaldbplanarface.python (52 lines) ----------
import clr
import System
 
clr.AddReference("RevitServices")
import RevitServices
from RevitServices.Persistence import DocumentManager
from RevitServices.Transactions import TransactionManager


clr.AddReference("RevitNodes")
import Revit
clr.ImportExtensions(Revit.Elements)
clr.ImportExtensions(Revit.GeometryConversion)

clr.AddReference("RevitAPIUI")
from Autodesk.Revit.UI import*
clr.AddReference('RevitAPIUI')
from Autodesk.Revit.UI import Selection
from  Autodesk.Revit.UI.Selection import ISelectionFilter

clr.AddReference('RevitAPI')
from Autodesk.Revit.DB import*
from Autodesk.Revit.DB import Line, ModelLine, LinePattern, ElementId
import Autodesk.Revit.DB as RDB
from Autodesk.Revit.DB import Line, GeometryInstance, Solid

doc = DocumentManager.Instance.CurrentDBDocument
View = doc.ActiveView
uidoc = DocumentManager.Instance.CurrentUIApplication.ActiveUIDocument
app  = uidoc.Application 
# #############################################################
# #                      FUNCTION                             #
# #############################################################
def isParalel(p,q):
    return p.CrossProduct(q).IsZeroLength()

def filterVerticalDBPlanarFace(dbPlanarFaces): # Get Vertical PlannarFaces 
    faV = []
    y = XYZ.BasisY
    for i in dbPlanarFaces:
        faNomal = i.FaceNormal
        check  = isParalel(y,faNomal)
        if check == True:
            faV.append(i)
    return faV

# #############################################################
# #                      GEOMETRY                             #
# #############################################################

elements = UnwrapElement(IN[1]) if isinstance(IN[1],list) else [UnwrapElement(IN[1])]
OUT = [filterVerticalDBPlanarFace(e) for e in elements]
# ----------------------------------------
getreferencearray_bbplanarfaces = Python(IN[1]=filterverticaldbplanarface)  # IronPython2; unwired: IN[0]
# ---------- getreferencearray_bbplanarfaces.python (43 lines) ----------
import clr
import System
 
clr.AddReference("RevitServices")
import RevitServices
from RevitServices.Persistence import DocumentManager
from RevitServices.Transactions import TransactionManager


clr.AddReference("RevitNodes")
import Revit
clr.ImportExtensions(Revit.Elements)
clr.ImportExtensions(Revit.GeometryConversion)

clr.AddReference("RevitAPIUI")
from Autodesk.Revit.UI import*
clr.AddReference('RevitAPIUI')
from Autodesk.Revit.UI import Selection
from  Autodesk.Revit.UI.Selection import ISelectionFilter

clr.AddReference('RevitAPI')
from Autodesk.Revit.DB import*
from Autodesk.Revit.DB import Line, ModelLine, LinePattern, ElementId
import Autodesk.Revit.DB as RDB
from Autodesk.Revit.DB import Line, GeometryInstance, Solid

doc = DocumentManager.Instance.CurrentDBDocument
View = doc.ActiveView
uidoc = DocumentManager.Instance.CurrentUIApplication.ActiveUIDocument
app  = uidoc.Application 
# #############################################################
# #                      FUNCTION                             #
# #############################################################
def getReferenceArray(bbPlanarFaces):
    reArray = ReferenceArray()
    for i in bbPlanarFaces:
        reArray.Append(i.Reference)
    return reArray
# #############################################################
# #                      GEOMETRY                             #
# #############################################################
elements = UnwrapElement(IN[1]) if isinstance(IN[1],list) else [UnwrapElement(IN[1])]
OUT = [getReferenceArray(e) for e in elements]
# ----------------------------------------
flatten_3 = List.Flatten(list=filterverticaldbplanarface)
conversionRtD = Custom[ConversionRtD](Objects=flatten_3)  # package BIM3DM; Return an object entity that can be displayed on the Dynamo interface.
getedgesplanarfaces = Python(IN[1]=filterverticaldbplanarface)  # "getEdgesPlanarFaces(dbPlanarFaces)"; CPython3; unwired: IN[0]
# ---------- getedgesplanarfaces.python (47 lines) ----------
import clr
import System
 
clr.AddReference("RevitServices")
import RevitServices
from RevitServices.Persistence import DocumentManager
from RevitServices.Transactions import TransactionManager


clr.AddReference("RevitNodes")
import Revit
clr.ImportExtensions(Revit.Elements)
clr.ImportExtensions(Revit.GeometryConversion)

clr.AddReference("RevitAPIUI")
from Autodesk.Revit.UI import*
clr.AddReference('RevitAPIUI')
from Autodesk.Revit.UI import Selection
from  Autodesk.Revit.UI.Selection import ISelectionFilter

clr.AddReference('RevitAPI')
from Autodesk.Revit.DB import*
from Autodesk.Revit.DB import Line, ModelLine, LinePattern, ElementId
import Autodesk.Revit.DB as RDB
from Autodesk.Revit.DB import Line, GeometryInstance, Solid

doc = DocumentManager.Instance.CurrentDBDocument
View = doc.ActiveView
uidoc = DocumentManager.Instance.CurrentUIApplication.ActiveUIDocument
app  = uidoc.Application 
# #############################################################
# #                      FUNCTION                             #
# #############################################################
def getEdgesPlanarFaces(dbPlanarFaces): # Get DBLines of PlanarFaces
    result = []
    var = dbPlanarFaces.EdgeLoops
    for i in var:
        re = []
        for j in i:
            re.append(j.AsCurve())
        result.append(re)
    return result
# #############################################################
# #                      GEOMETRY                             #
# #############################################################
elements = UnwrapElement(IN[1]) if isinstance(IN[1],list) else [UnwrapElement(IN[1])]
OUT = [getEdgesPlanarFaces(j) for e in elements for j in e]
# ----------------------------------------
getdblinesmax_dblines = Python(IN[1]=getedgesplanarfaces)  # CPython3; unwired: IN[0]
# ---------- getdblinesmax_dblines.python (53 lines) ----------
import clr
import System
 
clr.AddReference("RevitServices")
import RevitServices
from RevitServices.Persistence import DocumentManager
from RevitServices.Transactions import TransactionManager


clr.AddReference("RevitNodes")
import Revit
clr.ImportExtensions(Revit.Elements)
clr.ImportExtensions(Revit.GeometryConversion)

clr.AddReference("RevitAPIUI")
from Autodesk.Revit.UI import*
clr.AddReference('RevitAPIUI')
from Autodesk.Revit.UI import Selection
from  Autodesk.Revit.UI.Selection import ISelectionFilter

clr.AddReference('RevitAPI')
from Autodesk.Revit.DB import*
from Autodesk.Revit.DB import Line, ModelLine, LinePattern, ElementId
import Autodesk.Revit.DB as RDB
from Autodesk.Revit.DB import Line, GeometryInstance, Solid

doc = DocumentManager.Instance.CurrentDBDocument
View = doc.ActiveView
uidoc = DocumentManager.Instance.CurrentUIApplication.ActiveUIDocument
app  = uidoc.Application 
# #############################################################
# #                      FUNCTION                             #
# #############################################################
def getDbLinesMax(dbLines): # Get a min line of list line
    _length = []
    dbLineMax = []
    for i in dbLines:
        r1 = []
        for z in i:
            r1.append(z.Length)
        _length.append(r1)
    for j in range(len(dbLines)):
        r2 = []
        for l in dbLines[j]:
            if l.Length == max(_length[j]):
                r2.append(l)
        dbLineMax.append(r2)
    return dbLineMax
# #############################################################
# #                      GEOMETRY                             #
# #############################################################
elements = UnwrapElement(IN[1]) if isinstance(IN[1],list) else [UnwrapElement(IN[1])]
OUT = [getDbLinesMax(e) for e in elements]
# ----------------------------------------
code_block_2 = CodeBlock(a=getdblinesmax_dblines) { a[0][0]; }
firstItem = List.FirstItem(list=code_block_2)
create_dbline_from_crossproduct = Python(IN[1]=firstItem)  # IronPython2; unwired: IN[0]
# ---------- create_dbline_from_crossproduct.python (52 lines) ----------
import clr
import System
 
clr.AddReference("RevitServices")
import RevitServices
from RevitServices.Persistence import DocumentManager
from RevitServices.Transactions import TransactionManager


clr.AddReference("RevitNodes")
import Revit
clr.ImportExtensions(Revit.Elements)
clr.ImportExtensions(Revit.GeometryConversion)

clr.AddReference("RevitAPIUI")
from Autodesk.Revit.UI import*
clr.AddReference('RevitAPIUI')
from  Autodesk.Revit.UI.Selection import*
from  Autodesk.Revit.UI.Selection import ISelectionFilter

clr.AddReference('RevitAPI')
from Autodesk.Revit.DB import*
from Autodesk.Revit.DB import Line, ModelLine, LinePattern, ElementId
import Autodesk.Revit.DB as RDB
from Autodesk.Revit.DB import Line, GeometryInstance, Solid

doc = DocumentManager.Instance.CurrentDBDocument
View = doc.ActiveView
uidoc = DocumentManager.Instance.CurrentUIApplication.ActiveUIDocument
app  = uidoc.Application 
# #############################################################
# #                      FUNCTION                             #
# #############################################################

# #############################################################
# #                      GEOMETRY                             #
# #############################################################
getLineMax = IN[1]

vtxPlane = XYZ.BasisZ
vtxSection = XYZ.BasisY

ptsLine1 = getLineMax.GetEndPoint(0)
ptsLine2 = getLineMax.GetEndPoint(1)

pickPoint = uidoc.Selection.PickPoint("Select Point")

vtxFromLine = ptsLine1 - ptsLine2

direct = vtxPlane.CrossProduct(vtxFromLine) 
dbLine = Line.CreateBound(pickPoint,pickPoint+direct)
OUT = dbLine
# ----------------------------------------
python_script_2 = Python(IN[1]=create_dbline_from_crossproduct, IN[2]=flatten_3)  # CPython3; unwired: IN[0]
# ---------- python_script_2.python (52 lines) ----------
import clr
import System
 
clr.AddReference("RevitServices")
import RevitServices
from RevitServices.Persistence import DocumentManager
from RevitServices.Transactions import TransactionManager


clr.AddReference("RevitNodes")
import Revit
clr.ImportExtensions(Revit.Elements)
clr.ImportExtensions(Revit.GeometryConversion)

clr.AddReference("RevitAPIUI")
from Autodesk.Revit.UI import*
clr.AddReference('RevitAPIUI')
from  Autodesk.Revit.UI.Selection import*
from  Autodesk.Revit.UI.Selection import ISelectionFilter

clr.AddReference('RevitAPI')
from Autodesk.Revit.DB import*
from Autodesk.Revit.DB import Line, ModelLine, LinePattern, ElementId
import Autodesk.Revit.DB as RDB
from Autodesk.Revit.DB import Line, GeometryInstance, Solid

doc = DocumentManager.Instance.CurrentDBDocument
view = doc.ActiveView
uidoc = DocumentManager.Instance.CurrentUIApplication.ActiveUIDocument
app  = uidoc.Application 
# #############################################################
# #                      FUNCTION                             #
def getReferenceArray(dbPlanarFaces):
    reArray = ReferenceArray()
    for i in dbPlanarFaces:
        reArray.Append(i.Reference)
    return reArray
# #############################################################

# #############################################################
# #                      GEOMETRY                             #
# #############################################################

dbLine = IN[1]
planarFaces = IN[2]

TransactionManager.Instance.EnsureInTransaction(doc)
result = []
refs = getReferenceArray(planarFaces)
dim = doc.Create.NewDimension(view, dbLine, refs)
TransactionManager.Instance.TransactionTaskDone()
OUT = dim
# ----------------------------------------
code_block_3 = CodeBlock { ["Structural Framing"]; }
boolean_4 = BoolSelector(false)
selectionElementsByCategoryNameAndClassi_2 = Custom[SelectionElementsByCategoryNameAndClassification](categoryNames=code_block_3, reset=boolean_4)
valueAtKey_2 = DesignScript.Builtin.Dictionary.ValueAtKey(dictionary=selectionElementsByCategoryNameAndClassi_2, key=code_block_3)
flatten_4 = List.Flatten(list=valueAtKey_2)
getgeoelement_element_2 = Python(IN[1]=flatten_4)  # IronPython2; unwired: IN[0]
# ---------- getgeoelement_element_2.python (46 lines) ----------
import clr
import System
 
clr.AddReference("RevitServices")
import RevitServices
from RevitServices.Persistence import DocumentManager
from RevitServices.Transactions import TransactionManager


clr.AddReference("RevitNodes")
import Revit
clr.ImportExtensions(Revit.Elements)
clr.ImportExtensions(Revit.GeometryConversion)

clr.AddReference("RevitAPIUI")
from Autodesk.Revit.UI import*
clr.AddReference('RevitAPIUI')
from  Autodesk.Revit.UI.Selection import*
from  Autodesk.Revit.UI.Selection import ISelectionFilter

clr.AddReference('RevitAPI')
from Autodesk.Revit.DB import*
from Autodesk.Revit.DB import Line, ModelLine, LinePattern, ElementId
import Autodesk.Revit.DB as RDB
from Autodesk.Revit.DB import Line, GeometryInstance, Solid

doc = DocumentManager.Instance.CurrentDBDocument
view = doc.ActiveView
uidoc = DocumentManager.Instance.CurrentUIApplication.ActiveUIDocument
app  = uidoc.Application 
# #############################################################
# #                      FUNCTION                             #
def getGeoElement(element):
    opt = Options()
    opt.ComputeReferences = True
    opt.IncludeNonVisibleObjects = True
    opt.DetailLevel = ViewDetailLevel.Fine
    geoByElement = ele.get_Geometry(opt)
    return geoByElement
    

# #############################################################
# #                      GEOMETRY                             #
# #############################################################
elements = UnwrapElement(IN[1]) if isinstance(IN[1], list) else [UnwrapElement(IN[1])]
OUT = [getGeoElement(ele) for ele in elements]
# ----------------------------------------
getdbsolidfromdbgeo_geos = Python(IN[1]=getgeoelement_element_2)  # IronPython2; unwired: IN[0]
# ---------- getdbsolidfromdbgeo_geos.python (50 lines) ----------
import clr
import System
 
clr.AddReference("RevitServices")
import RevitServices
from RevitServices.Persistence import DocumentManager
from RevitServices.Transactions import TransactionManager


clr.AddReference("RevitNodes")
import Revit
clr.ImportExtensions(Revit.Elements)
clr.ImportExtensions(Revit.GeometryConversion)

clr.AddReference("RevitAPIUI")
from Autodesk.Revit.UI import*
clr.AddReference('RevitAPIUI')
from  Autodesk.Revit.UI.Selection import*
from  Autodesk.Revit.UI.Selection import ISelectionFilter

clr.AddReference('RevitAPI')
from Autodesk.Revit.DB import*
from Autodesk.Revit.DB import Line, ModelLine, LinePattern, ElementId
import Autodesk.Revit.DB as RDB
from Autodesk.Revit.DB import Line, GeometryInstance, Solid

doc = DocumentManager.Instance.CurrentDBDocument
view = doc.ActiveView
uidoc = DocumentManager.Instance.CurrentUIApplication.ActiveUIDocument
app  = uidoc.Application 
# #############################################################
# #                      FUNCTION                             #

def getDbSolidFromDbGeo(geos):
    solids = []
    for i in geos:
        if i.GetType() == Solid and i.Volume > 0:
            solids.append(i)
        elif i.GetType() == GeometryInstance:
            for j in i.GetInstanceGeometry():
                if instance(j, Solid):
                    if j.Volume > 0:
                        solids.append(j)
    return solids

# #############################################################
# #                      GEOMETRY                             #
# #############################################################
elements = UnwrapElement(IN[1]) if isinstance(IN[1], list) else [UnwrapElement(IN[1])]
OUT = [getDbSolidFromDbGeo(geo) for geo in elements]
# ----------------------------------------
getdbedgesbydbsolid_dbsolids = Python(IN[1]=getdbsolidfromdbgeo_geos)  # IronPython2; unwired: IN[0]
# ---------- getdbedgesbydbsolid_dbsolids.python (48 lines) ----------
import clr
import System
 
clr.AddReference("RevitServices")
import RevitServices
from RevitServices.Persistence import DocumentManager
from RevitServices.Transactions import TransactionManager


clr.AddReference("RevitNodes")
import Revit
clr.ImportExtensions(Revit.Elements)
clr.ImportExtensions(Revit.GeometryConversion)

clr.AddReference("RevitAPIUI")
from Autodesk.Revit.UI import*
clr.AddReference('RevitAPIUI')
from  Autodesk.Revit.UI.Selection import*
from  Autodesk.Revit.UI.Selection import ISelectionFilter

clr.AddReference('RevitAPI')
from Autodesk.Revit.DB import*
from Autodesk.Revit.DB import Line, ModelLine, LinePattern, ElementId
import Autodesk.Revit.DB as RDB
from Autodesk.Revit.DB import Line, GeometryInstance, Solid

doc = DocumentManager.Instance.CurrentDBDocument
view = doc.ActiveView
uidoc = DocumentManager.Instance.CurrentUIApplication.ActiveUIDocument
app  = uidoc.Application 
# #############################################################
# #                      FUNCTION                             #


def getDbEdgesByDbSolid(dbSolids):
    edgesDb = []
    for i in dbSolids:
        edgeArray = i.Edges
        edgesDb.append(edgeArray)
    return edgesDb



# #############################################################
# #                      GEOMETRY                             #
# #############################################################
elements = UnwrapElement(IN[1]) if isinstance(IN[1], list) else [UnwrapElement(IN[1])]
OUT = [getDbEdgesByDbSolid(eles) for eles in elements]
# ----------------------------------------
getplanarfacesbydbsolid_dbsolids = Python(IN[1]=getdbsolidfromdbgeo_geos)  # CPython3; unwired: IN[0]
# ---------- getplanarfacesbydbsolid_dbsolids.python (48 lines) ----------
import clr
import System
 
clr.AddReference("RevitServices")
import RevitServices
from RevitServices.Persistence import DocumentManager
from RevitServices.Transactions import TransactionManager


clr.AddReference("RevitNodes")
import Revit
clr.ImportExtensions(Revit.Elements)
clr.ImportExtensions(Revit.GeometryConversion)

clr.AddReference("RevitAPIUI")
from Autodesk.Revit.UI import*
clr.AddReference('RevitAPIUI')
from  Autodesk.Revit.UI.Selection import*
from  Autodesk.Revit.UI.Selection import ISelectionFilter

clr.AddReference('RevitAPI')
from Autodesk.Revit.DB import*
from Autodesk.Revit.DB import Line, ModelLine, LinePattern, ElementId
import Autodesk.Revit.DB as RDB
from Autodesk.Revit.DB import Line, GeometryInstance, Solid

doc = DocumentManager.Instance.CurrentDBDocument
view = doc.ActiveView
uidoc = DocumentManager.Instance.CurrentUIApplication.ActiveUIDocument
app  = uidoc.Application 
# #############################################################
# #                      FUNCTION                             #

def getPlanarFacesByDbSolid(dbSolids):
    planarFaces = []
    for i in dbSolids:
        faceArray = i.Faces
        for j in faceArray:
            if j.Reference != None:
                planarFaces.append(j)
        return faceArray
    return planarFaces

# #############################################################
# #                      GEOMETRY                             #
# #############################################################
elements = UnwrapElement(IN[1]) if isinstance(IN[1], list) else [UnwrapElement(IN[1])]
OUT = [getPlanarFacesByDbSolid(eles) for eles in elements]
# ----------------------------------------
getverticaldbplanarfaces = Python(IN[1]=getplanarfacesbydbsolid_dbsolids)  # "getVerticalDbPlanarFaces(dbPlanarFaces)"; CPython3; unwired: IN[0]
# ---------- getverticaldbplanarfaces.python (54 lines) ----------
import clr
import System
 
clr.AddReference("RevitServices")
import RevitServices
from RevitServices.Persistence import DocumentManager
from RevitServices.Transactions import TransactionManager


clr.AddReference("RevitNodes")
import Revit
clr.ImportExtensions(Revit.Elements)
clr.ImportExtensions(Revit.GeometryConversion)

clr.AddReference("RevitAPIUI")
from Autodesk.Revit.UI import*
clr.AddReference('RevitAPIUI')
from  Autodesk.Revit.UI.Selection import*
from  Autodesk.Revit.UI.Selection import ISelectionFilter

clr.AddReference('RevitAPI')
from Autodesk.Revit.DB import*
from Autodesk.Revit.DB import Line, ModelLine, LinePattern, ElementId
import Autodesk.Revit.DB as RDB
from Autodesk.Revit.DB import Line, GeometryInstance, Solid

doc = DocumentManager.Instance.CurrentDBDocument
view = doc.ActiveView
uidoc = DocumentManager.Instance.CurrentUIApplication.ActiveUIDocument
app  = uidoc.Application 
# #############################################################
# #                      FUNCTION                             #

def isParalel(p,q):
    return p.CrossProduct(q).IsZeroLength()

def getVerticalDbPlanarFaces(dbPlanarFaces):
    vPFaces =  []
    y = XYZ.BasisY
    for i in dbPlanarFaces:
        pfNormal = i.FaceNormal
        check = isParalel(y, pfNormal)
        if check:
            vPFaces.append(i)
    return vPFaces




# #############################################################
# #                      GEOMETRY                             #
# #############################################################
elements = UnwrapElement(IN[1]) if isinstance(IN[1], list) else [UnwrapElement(IN[1])]
OUT = [getVerticalDbPlanarFaces(eles) for eles in elements]
# ----------------------------------------
getdbedgesplanarfaces = Python(IN[1]=getverticaldbplanarfaces)  # "getDbEdgesPlanarFaces(dbPlanarFaces)"; IronPython2; unwired: IN[0]
# ---------- getdbedgesplanarfaces.python (62 lines) ----------
import clr
import System
 
clr.AddReference("RevitServices")
import RevitServices
from RevitServices.Persistence import DocumentManager
from RevitServices.Transactions import TransactionManager


clr.AddReference("RevitNodes")
import Revit
clr.ImportExtensions(Revit.Elements)
clr.ImportExtensions(Revit.GeometryConversion)

clr.AddReference("RevitAPIUI")
from Autodesk.Revit.UI import*
clr.AddReference('RevitAPIUI')
from  Autodesk.Revit.UI.Selection import*
from  Autodesk.Revit.UI.Selection import ISelectionFilter

clr.AddReference('RevitAPI')
from Autodesk.Revit.DB import*
from Autodesk.Revit.DB import Line, ModelLine, LinePattern, ElementId
import Autodesk.Revit.DB as RDB
from Autodesk.Revit.DB import Line, GeometryInstance, Solid

doc = DocumentManager.Instance.CurrentDBDocument
view = doc.ActiveView
uidoc = DocumentManager.Instance.CurrentUIApplication.ActiveUIDocument
app  = uidoc.Application 
# #############################################################
# #                      FUNCTION                             #


# def getDbEdgesPlanarFaces(dbPlanarFaces):
#     result = []
#     for eles in dbPlanarFaces:
#         re = []
#         for ele in eles:
#             vals = ele.EdgeLoops
#             re.append(vals)
#         result.append(re)
#     return result

def getDbEdgesPlanarFaces(dbPlanarFaces):
    result = []
    vals = dbPlanarFaces.EdgeLoops
    for edges in vals:
        # re = []
        for edge in edges:
            dbLine = edge.AsCurve()
            result.append(dbLine)
        # result.append(re)
    return result



# #############################################################
# #                      GEOMETRY                             #
# #############################################################
elements = UnwrapElement(IN[1]) if isinstance(IN[1], list) else [UnwrapElement(IN[1])]
OUT = [getDbEdgesPlanarFaces(ele) for eles in elements for ele in eles]
# ----------------------------------------
conversionRtD_2 = Custom[ConversionRtD]()  # unwired: Objects
getdbedgesplanarfaces_2 = Python(IN[1]=getverticaldbplanarfaces)  # "getDbEdgesPlanarFaces(dbPlanarFaces)"; IronPython2; unwired: IN[0]; same code as getedgesplanarfaces
getmaxdblines_dblines = Python(IN[1]=getdbedgesplanarfaces_2)  # IronPython2; unwired: IN[0]
# ---------- getmaxdblines_dblines.python (68 lines) ----------
import clr
import System
 
clr.AddReference("RevitServices")
import RevitServices
from RevitServices.Persistence import DocumentManager
from RevitServices.Transactions import TransactionManager


clr.AddReference("RevitNodes")
import Revit
clr.ImportExtensions(Revit.Elements)
clr.ImportExtensions(Revit.GeometryConversion)

clr.AddReference("RevitAPIUI")
from Autodesk.Revit.UI import*
clr.AddReference('RevitAPIUI')
from  Autodesk.Revit.UI.Selection import*
from  Autodesk.Revit.UI.Selection import ISelectionFilter

clr.AddReference('RevitAPI')
from Autodesk.Revit.DB import*
from Autodesk.Revit.DB import Line, ModelLine, LinePattern, ElementId
import Autodesk.Revit.DB as RDB
from Autodesk.Revit.DB import Line, GeometryInstance, Solid

doc = DocumentManager.Instance.CurrentDBDocument
view = doc.ActiveView
uidoc = DocumentManager.Instance.CurrentUIApplication.ActiveUIDocument
app  = uidoc.Application 
# #############################################################
# #                      FUNCTION                             #


# def getDbEdgesPlanarFaces(dbPlanarFaces):
#     result = []
#     for eles in dbPlanarFaces:
#         re = []
#         for ele in eles:
#             vals = ele.EdgeLoops
#             re.append(vals)
#         result.append(re)
#     return result

def getMaxDbLines(dbLines): # Get a min line of list line
    lengths = []
    dbMaxLine = []
    for lines in dbLines:
        r1 = []
        for line in lines:
            r1.append(line.Length)
        lengths.append(r1)

    for index in range(len(dbLines)):
        r2 = []
        for line in dbLines[index]:
            if line.Length == max(lengths[index]):
                r2.append(line)
        dbMaxLine.append(r2)
    return dbMaxLine



# #############################################################
# #                      GEOMETRY                             #
# #############################################################
elements = UnwrapElement(IN[1]) if isinstance(IN[1], list) else [UnwrapElement(IN[1])]
OUT = [getMaxDbLines(eles) for eles in elements]
# ----------------------------------------
code_block_4 = CodeBlock(a=getmaxdblines_dblines) { a[0][0]; }
firstItem_2 = List.FirstItem(list=code_block_4)
dbLine = Python(IN[1]=firstItem_2)  # IronPython2; unwired: IN[0]
# ---------- dbLine.python (51 lines) ----------
import clr
import System
 
clr.AddReference("RevitServices")
import RevitServices
from RevitServices.Persistence import DocumentManager
from RevitServices.Transactions import TransactionManager


clr.AddReference("RevitNodes")
import Revit
clr.ImportExtensions(Revit.Elements)
clr.ImportExtensions(Revit.GeometryConversion)

clr.AddReference("RevitAPIUI")
from Autodesk.Revit.UI import*
clr.AddReference('RevitAPIUI')
from  Autodesk.Revit.UI.Selection import*
from  Autodesk.Revit.UI.Selection import ISelectionFilter

clr.AddReference('RevitAPI')
from Autodesk.Revit.DB import*
from Autodesk.Revit.DB import Line, ModelLine, LinePattern, ElementId
import Autodesk.Revit.DB as RDB
from Autodesk.Revit.DB import Line, GeometryInstance, Solid

doc = DocumentManager.Instance.CurrentDBDocument
view = doc.ActiveView
uidoc = DocumentManager.Instance.CurrentUIApplication.ActiveUIDocument
app  = uidoc.Application 
# #############################################################
# #                      FUNCTION                             #


# #############################################################
# #                      GEOMETRY                             #
# #############################################################
maxLine = IN[1]


xyzMaxLine1 = maxLine.GetEndPoint(0)
xyzMaxLine2 = maxLine.GetEndPoint(1)

vtByDbLine = xyzMaxLine1 - xyzMaxLine2

xyzPictPoint = uidoc.Selection.PickPoint("Select a place to put DIM")

direct = vtByDbLine.CrossProduct(XYZ.BasisZ)

dbLine = Line.CreateBound(xyzPictPoint, xyzPictPoint + direct)
OUT = dbLine
# ----------------------------------------
flatten_5 = List.Flatten(list=getverticaldbplanarfaces)
newDimension = Python(IN[1]=dbLine, IN[2]=flatten_5)  # IronPython2; frozen; unwired: IN[0]
# ---------- newDimension.python (51 lines) ----------
import clr
import System
 
clr.AddReference("RevitServices")
import RevitServices
from RevitServices.Persistence import DocumentManager
from RevitServices.Transactions import TransactionManager


clr.AddReference("RevitNodes")
import Revit
clr.ImportExtensions(Revit.Elements)
clr.ImportExtensions(Revit.GeometryConversion)

clr.AddReference("RevitAPIUI")
from Autodesk.Revit.UI import*
clr.AddReference('RevitAPIUI')
from  Autodesk.Revit.UI.Selection import*
from  Autodesk.Revit.UI.Selection import ISelectionFilter

clr.AddReference('RevitAPI')
from Autodesk.Revit.DB import*
from Autodesk.Revit.DB import Line, ModelLine, LinePattern, ElementId
import Autodesk.Revit.DB as RDB
from Autodesk.Revit.DB import Line, GeometryInstance, Solid

doc = DocumentManager.Instance.CurrentDBDocument
view = doc.ActiveView
uidoc = DocumentManager.Instance.CurrentUIApplication.ActiveUIDocument
app  = uidoc.Application 
# #############################################################
# #                      FUNCTION                             #

def getReferencesArray(planarFaces):
    reArray = ReferenceArray()
    for i in planarFaces:
        reArray.Append(i.Reference)
    return reArray
# #############################################################
# #                      GEOMETRY                             #
# #############################################################
dbLine = IN[1]
planarFaces = IN[2]

TransactionManager.Instance.EnsureInTransaction(doc)
refs = getReferencesArray(planarFaces)
dim = doc.Create.NewDimension(view, dbLine, refs)
TransactionManager.Instance.TransactionTaskDone()


OUT = dim
# ----------------------------------------
getrightface_dbplanarfaces = Python(IN[1]=getplanarfacesbydbsolid_dbsolids)  # "getRightFace(dbPlanarFaces,viewIn)"; IronPython2; unwired: IN[0]
# ---------- getrightface_dbplanarfaces.python (46 lines) ----------
import clr
import System
 
clr.AddReference("RevitServices")
import RevitServices
from RevitServices.Persistence import DocumentManager
from RevitServices.Transactions import TransactionManager


clr.AddReference("RevitNodes")
import Revit
clr.ImportExtensions(Revit.Elements)
clr.ImportExtensions(Revit.GeometryConversion)

clr.AddReference("RevitAPIUI")
from Autodesk.Revit.UI import*
clr.AddReference('RevitAPIUI')
from  Autodesk.Revit.UI.Selection import*
from  Autodesk.Revit.UI.Selection import ISelectionFilter

clr.AddReference('RevitAPI')
from Autodesk.Revit.DB import*
from Autodesk.Revit.DB import Line, ModelLine, LinePattern, ElementId
import Autodesk.Revit.DB as RDB
from Autodesk.Revit.DB import Line, GeometryInstance, Solid

doc = DocumentManager.Instance.CurrentDBDocument
view = doc.ActiveView
uidoc = DocumentManager.Instance.CurrentUIApplication.ActiveUIDocument
app  = uidoc.Application 
# #############################################################
# #                      FUNCTION                             #

def getRightDbPlanarFaces(dbPlanarFaces,activeView): # Get Right PlanarFaces of a Element
    direct = view.RightDirection
    for i in dbPlanarFaces:
        var = i.FaceNormal
        if var.IsAlmostEqualTo(direct):
            return i
# #############################################################
# #                      GEOMETRY                             #
# #############################################################

elements = UnwrapElement(IN[1]) if isinstance(IN[1], list) else [UnwrapElement(IN[1])]

OUT = [getRightDbPlanarFaces(ele,view) for ele in elements]
# ----------------------------------------
getLeftDbPlanarFaces = Python(IN[1]=getplanarfacesbydbsolid_dbsolids)  # IronPython2; unwired: IN[0]
# ---------- getLeftDbPlanarFaces.python (46 lines) ----------
import clr
import System
 
clr.AddReference("RevitServices")
import RevitServices
from RevitServices.Persistence import DocumentManager
from RevitServices.Transactions import TransactionManager


clr.AddReference("RevitNodes")
import Revit
clr.ImportExtensions(Revit.Elements)
clr.ImportExtensions(Revit.GeometryConversion)

clr.AddReference("RevitAPIUI")
from Autodesk.Revit.UI import*
clr.AddReference('RevitAPIUI')
from  Autodesk.Revit.UI.Selection import*
from  Autodesk.Revit.UI.Selection import ISelectionFilter

clr.AddReference('RevitAPI')
from Autodesk.Revit.DB import*
from Autodesk.Revit.DB import Line, ModelLine, LinePattern, ElementId
import Autodesk.Revit.DB as RDB
from Autodesk.Revit.DB import Line, GeometryInstance, Solid

doc = DocumentManager.Instance.CurrentDBDocument
view = doc.ActiveView
uidoc = DocumentManager.Instance.CurrentUIApplication.ActiveUIDocument
app  = uidoc.Application 
# #############################################################
# #                      FUNCTION                             #

def getLeftDbPlanarFaces(dbPlanarFaces,activeView): # Get Right PlanarFaces of a Element
    direct = view.RightDirection
    for i in dbPlanarFaces:
        var = -1*i.FaceNormal
        if var.IsAlmostEqualTo(direct):
            return i
# #############################################################
# #                      GEOMETRY                             #
# #############################################################

elements = UnwrapElement(IN[1]) if isinstance(IN[1], list) else [UnwrapElement(IN[1])]

OUT = [getLeftDbPlanarFaces(ele,view) for ele in elements]
# ----------------------------------------
boolean_5 = BoolSelector(false)
getRightOrLeftPlanarFaces = Python(IN[1]=getplanarfacesbydbsolid_dbsolids, IN[2]=boolean_5)  # IronPython2; unwired: IN[0]
# ---------- getRightOrLeftPlanarFaces.python (55 lines) ----------
import clr
import System
 
clr.AddReference("RevitServices")
import RevitServices
from RevitServices.Persistence import DocumentManager
from RevitServices.Transactions import TransactionManager


clr.AddReference("RevitNodes")
import Revit
clr.ImportExtensions(Revit.Elements)
clr.ImportExtensions(Revit.GeometryConversion)

clr.AddReference("RevitAPIUI")
from Autodesk.Revit.UI import*
clr.AddReference('RevitAPIUI')
from  Autodesk.Revit.UI.Selection import*
from  Autodesk.Revit.UI.Selection import ISelectionFilter

clr.AddReference('RevitAPI')
from Autodesk.Revit.DB import*
from Autodesk.Revit.DB import Line, ModelLine, LinePattern, ElementId
import Autodesk.Revit.DB as RDB
from Autodesk.Revit.DB import Line, GeometryInstance, Solid

doc = DocumentManager.Instance.CurrentDBDocument
view = doc.ActiveView
uidoc = DocumentManager.Instance.CurrentUIApplication.ActiveUIDocument
app  = uidoc.Application 
# #############################################################
# #                      FUNCTION                             #

def getRightDbPlanarFaces(dbPlanarFaces,activeView): # Get Right PlanarFaces of a Element
    direct = view.RightDirection
    for i in dbPlanarFaces:
        var = i.FaceNormal
        if var.IsAlmostEqualTo(direct):
            return i
def getLeftDbPlanarFaces(dbPlanarFaces,activeView): # Get Right PlanarFaces of a Element
    direct = view.RightDirection
    for i in dbPlanarFaces:
        var = -1*i.FaceNormal
        if var.IsAlmostEqualTo(direct):
            return i
def getRightOrLeftPlanarFaces(dbPlanarFaces,activeView, reason = True): # Choose in one of Right and Left of Faces
    if reason == True: return getRightDbPlanarFaces(dbPlanarFaces,activeView)
    elif reason == False: return getLeftDbPlanarFaces(dbPlanarFaces, activeView)
# #############################################################
# #                      GEOMETRY                             #
# #############################################################

elements = UnwrapElement(IN[1]) if isinstance(IN[1], list) else [UnwrapElement(IN[1])]
option = IN[2]
OUT = [getRightOrLeftPlanarFaces(ele, view, option) for ele in elements]
# ----------------------------------------
getOriginOfDbPFaces = Python(IN[1]=getRightOrLeftPlanarFaces)  # IronPython2; unwired: IN[0]
# ---------- getOriginOfDbPFaces.python (44 lines) ----------
import clr
import System
 
clr.AddReference("RevitServices")
import RevitServices
from RevitServices.Persistence import DocumentManager
from RevitServices.Transactions import TransactionManager


clr.AddReference("RevitNodes")
import Revit
clr.ImportExtensions(Revit.Elements)
clr.ImportExtensions(Revit.GeometryConversion)

clr.AddReference("RevitAPIUI")
from Autodesk.Revit.UI import*
clr.AddReference('RevitAPIUI')
from  Autodesk.Revit.UI.Selection import*
from  Autodesk.Revit.UI.Selection import ISelectionFilter

clr.AddReference('RevitAPI')
from Autodesk.Revit.DB import*
from Autodesk.Revit.DB import Line, ModelLine, LinePattern, ElementId
import Autodesk.Revit.DB as RDB
from Autodesk.Revit.DB import Line, GeometryInstance, Solid

doc = DocumentManager.Instance.CurrentDBDocument
view = doc.ActiveView
uidoc = DocumentManager.Instance.CurrentUIApplication.ActiveUIDocument
app  = uidoc.Application 
# #############################################################
# #                      FUNCTION                             #
def getOriginOfDbPFaces(dbPlanarFaces):
    result = []
    for pl in dbPlanarFaces:
        result.append(pl.Origin)
    return result

# #############################################################
# #                      GEOMETRY                             #
# #############################################################

elements = UnwrapElement(IN[1]) if isinstance(IN[1], list) else [UnwrapElement(IN[1])]
OUT = getOriginOfDbPFaces(elements)
# ----------------------------------------
sortxyz_lstxyz = Python(IN[1]=getOriginOfDbPFaces)  # IronPython2; unwired: IN[0]
# ---------- sortxyz_lstxyz.python (45 lines) ----------
import clr
import System
 
clr.AddReference("RevitServices")
import RevitServices
from RevitServices.Persistence import DocumentManager
from RevitServices.Transactions import TransactionManager


clr.AddReference("RevitNodes")
import Revit
clr.ImportExtensions(Revit.Elements)
clr.ImportExtensions(Revit.GeometryConversion)

clr.AddReference("RevitAPIUI")
from Autodesk.Revit.UI import*
clr.AddReference('RevitAPIUI')
from  Autodesk.Revit.UI.Selection import*
from  Autodesk.Revit.UI.Selection import ISelectionFilter

clr.AddReference('RevitAPI')
from Autodesk.Revit.DB import*
from Autodesk.Revit.DB import Line, ModelLine, LinePattern, ElementId
import Autodesk.Revit.DB as RDB
from Autodesk.Revit.DB import Line, GeometryInstance, Solid

doc = DocumentManager.Instance.CurrentDBDocument
view = doc.ActiveView
uidoc = DocumentManager.Instance.CurrentUIApplication.ActiveUIDocument
app  = uidoc.Application 
# #############################################################
# #                      FUNCTION                             #
def sortXYZ(lstXyz):
    # Sort lstXyz by coordinates X, then Y, then Z
    sortedIndices = sorted(enumerate(lstXyz), key=lambda point: (point[1][1]))
    indices = [index for index, _ in sortedIndices]
    sortedPoints = [point for _, point in sortedIndices]
    return indices, sortedPoints

# #############################################################
# #                      GEOMETRY                             #
# #############################################################

elements = UnwrapElement(IN[1]) if isinstance(IN[1], list) else [UnwrapElement(IN[1])]
OUT = sortXYZ(elements)
# ----------------------------------------
code_block_5 = CodeBlock(index=sortxyz_lstxyz) { index[0]; }
getItemAtIndex = List.GetItemAtIndex(list=getRightOrLeftPlanarFaces, index=code_block_5)
conversionRtD_3 = Custom[ConversionRtD](Objects=getItemAtIndex)
conversionRtD_4 = Custom[ConversionRtD](Objects=getdbedgesplanarfaces_2)
select_model_element = DSModelElementSelection()  # 1 picked in the model
geometry = Element.Geometry(element=select_model_element)
conversionRtD_5 = Custom[ConversionRtD](Objects=getRightOrLeftPlanarFaces)
conversionRtD_6 = Custom[ConversionRtD](Objects=getOriginOfDbPFaces)
UI = Python()  # CPython3; unwired: IN[0]
# ---------- UI.python (104 lines) ----------
import clr
import System
 
clr.AddReference("RevitServices")
import RevitServices
from RevitServices.Persistence import DocumentManager
from RevitServices.Transactions import TransactionManager

clr.AddReference("RevitNodes")
import Revit
clr.ImportExtensions(Revit.Elements)
clr.ImportExtensions(Revit.GeometryConversion)

clr.AddReference("RevitAPIUI")
from Autodesk.Revit.UI import*
clr.AddReference('RevitAPIUI')
from Autodesk.Revit.UI import Selection
from  Autodesk.Revit.UI.Selection import ISelectionFilter

clr.AddReference('RevitAPI')
from Autodesk.Revit.DB import*
#########################################################################
clr.AddReference('System.Windows.Forms')
clr.AddReference('System.Drawing')
# clr.AddReference('System.Windows.Forms.DataVisualization')
import System.Windows.Forms
import System.Drawing
from System.Drawing import *
from System.Windows.Forms import *
from System.Collections.Generic import *
#########################################################################
doc = DocumentManager.Instance.CurrentDBDocument
View = doc.ActiveView
uidoc = DocumentManager.Instance.CurrentUIApplication.ActiveUIDocument
#########################################################################


class MainForm(Form):
	def __init__(self):
		self.InitializeComponent()
	
	def InitializeComponent(self):
		self._btnOk = System.Windows.Forms.Button()
		self._comboBox1 = System.Windows.Forms.ComboBox()
		self._textBox1 = System.Windows.Forms.TextBox()
		self._btnCancel = System.Windows.Forms.Button()
		self.SuspendLayout()
		# 
		# btnOk
		# 
		self._btnOk.Location = System.Drawing.Point(89, 199)
		self._btnOk.Name = "btnOk"
		self._btnOk.Size = System.Drawing.Size(75, 23)
		self._btnOk.TabIndex = 0
		self._btnOk.Text = "OK"
		self._btnOk.UseVisualStyleBackColor = True
		self._btnOk.Click += self.BtnOkClick
		# 
		# comboBox1
		# 
		self._comboBox1.FormattingEnabled = True
		self._comboBox1.Location = System.Drawing.Point(103, 91)
		self._comboBox1.Name = "comboBox1"
		self._comboBox1.Size = System.Drawing.Size(121, 21)
		self._comboBox1.TabIndex = 1
		# 
		# textBox1
		# 
		self._textBox1.Location = System.Drawing.Point(103, 135)
		self._textBox1.Name = "textBox1"
		self._textBox1.Size = System.Drawing.Size(100, 20)
		self._textBox1.TabIndex = 2
		# 
		# btnCancel
		# 
		self._btnCancel.Location = System.Drawing.Point(181, 199)
		self._btnCancel.Name = "btnCancel"
		self._btnCancel.Size = System.Drawing.Size(75, 23)
		self._btnCancel.TabIndex = 3
		self._btnCancel.Text = "Cancel"
		self._btnCancel.UseVisualStyleBackColor = True
		self._btnCancel.Click += self.BtnCancelClick
		# 
		# MainForm
		# 
		self.ClientSize = System.Drawing.Size(284, 261)
		self.Controls.Add(self._btnCancel)
		self.Controls.Add(self._textBox1)
		self.Controls.Add(self._comboBox1)
		self.Controls.Add(self._btnOk)
		self.Name = "MainForm"
		self.Text = "TestUI"
		self.ResumeLayout(False)
		self.PerformLayout()


	def BtnOkClick(self, sender, e):
		pass

	def BtnCancelClick(self, sender, e):
		self.Close()
		pass

Application.Run(MainForm())
# ----------------------------------------
