# Dynamo graph Geometry_Lesson_17.dyn (Dynamo 2.18.1.5096)
# packages: BIM3DM 2.1.16

select_level = Python()  # CPython3; unwired: IN[0]
# ---------- select_level.python (46 lines) ----------
"""Copyright(c) 2019 by: duengocnguyen@gmail.com"""
'https://www.youtube.com/channel/UCt2JhCDDFxpYho575WTMZ4g'
"""________________Welcome to BIM3DM-DYNAMO API___________________"""
import clr 
import sys
sys.path.append(r'C:\Program Files\Autodesk\Revit 2020\AddIns\DynamoForRevit\IronPython.StdLib.2.7.8')
import math 
from System.Collections.Generic import *

clr.AddReference("ProtoGeometry")
from Autodesk.DesignScript.Geometry import *

clr.AddReference('RevitAPI')
import Autodesk
from Autodesk.Revit.DB import *

clr.AddReference('RevitAPIUI')
from Autodesk.Revit.UI import*
from  Autodesk.Revit.UI.Selection import*

clr.AddReference("RevitNodes")
import Revit
clr.ImportExtensions(Revit.Elements)
clr.ImportExtensions(Revit.GeometryConversion)

clr.AddReference("RevitServices")
import RevitServices
from RevitServices.Persistence import DocumentManager
from RevitServices.Transactions import TransactionManager

doc = DocumentManager.Instance.CurrentDBDocument
view = doc.ActiveView
uidoc = DocumentManager.Instance.CurrentUIApplication.ActiveUIDocument

#Preparing input from dynamo to revit
element = UnwrapElement(IN[0])

#Do some action in a Transaction
#TransactionManager.Instance.EnsureInTransaction(doc)
"""Now, You Can Code """



#TransactionManager.Instance.TransactionTaskDone()

OUT = FilteredElementCollector(doc).OfCategory(BuiltInCategory.OST_Levels).WhereElementIsNotElementType().ToElements()
# ----------------------------------------

# group: Design Script
boolean = BoolSelector(true)
python_script = Python(IN[0]=boolean)  # CPython3
# ---------- python_script.python (4 lines) ----------
#f = open(r"U:\17_TrainingAdvanceDynamo\2_WORKING\Tool\Dynamo\Training-Dynamo-2024\DesignScript.py", "r")

f = open(r"A:\Library-Dynamo-Python-CSharp\test.py", "r")
OUT = f.read() 
# ----------------------------------------
python_script_from_string = PythonStringNode(script=python_script, IN[1]=select_level)  # CPython3; unwired: IN[0]

conversionRtD = Custom[ConversionRtD](Objects=python_script_from_string)  # package BIM3DM; Return an object entity that can be displayed on the Dynamo interface.

# group: DtR
flatten = List.Flatten(list=python_script_from_string)
python_script_2 = Python(IN[0]=flatten)  # CPython3
# ---------- python_script_2.python (48 lines) ----------
"""Copyright(c) 2019 by: duengocnguyen@gmail.com"""
'https://www.youtube.com/channel/UCt2JhCDDFxpYho575WTMZ4g'
"""________________Welcome to BIM3DM-DYNAMO API___________________"""
import clr 
import sys
sys.path.append(r'C:\Program Files\Autodesk\Revit 2020\AddIns\DynamoForRevit\IronPython.StdLib.2.7.8')
import math 
from System.Collections.Generic import *

clr.AddReference("ProtoGeometry")
from Autodesk.DesignScript.Geometry import *

clr.AddReference('RevitAPI')
import Autodesk
from Autodesk.Revit.DB import *

clr.AddReference('RevitAPIUI')
from Autodesk.Revit.UI import*
from  Autodesk.Revit.UI.Selection import*

clr.AddReference("RevitNodes")
import Revit
clr.ImportExtensions(Revit.Elements)
clr.ImportExtensions(Revit.GeometryConversion)
clr.AddReference('DSCoreNodes')
from DSCore import *

clr.AddReference("RevitServices")
import RevitServices
from RevitServices.Persistence import DocumentManager
from RevitServices.Transactions import TransactionManager

doc = DocumentManager.Instance.CurrentDBDocument
view = doc.ActiveView
uidoc = DocumentManager.Instance.CurrentUIApplication.ActiveUIDocument

#Preparing input from dynamo to revit
elements = UnwrapElement(IN[0])

#Do some action in a Transaction
#TransactionManager.Instance.EnsureInTransaction(doc)
"""Now, You Can Code """



#TransactionManager.Instance.TransactionTaskDone()

OUT = [ele.ToProtoType() for ele in elements]
# ----------------------------------------

python_script_3 = Python()  # CPython3; unwired: IN[0]
# ---------- python_script_3.python (46 lines) ----------
"""Copyright(c) 2019 by: duengocnguyen@gmail.com"""
'https://www.youtube.com/channel/UCt2JhCDDFxpYho575WTMZ4g'
"""________________Welcome to BIM3DM-DYNAMO API___________________"""
import clr 
import sys
sys.path.append(r'C:\Program Files\Autodesk\Revit 2020\AddIns\DynamoForRevit\IronPython.StdLib.2.7.8')
import math 
from System.Collections.Generic import *

clr.AddReference("ProtoGeometry")
from Autodesk.DesignScript.Geometry import *

clr.AddReference('RevitAPI')
import Autodesk
from Autodesk.Revit.DB import *

clr.AddReference('RevitAPIUI')
from Autodesk.Revit.UI import*
from  Autodesk.Revit.UI.Selection import*

clr.AddReference("RevitNodes")
import Revit
clr.ImportExtensions(Revit.Elements)
clr.ImportExtensions(Revit.GeometryConversion)

clr.AddReference("RevitServices")
import RevitServices
from RevitServices.Persistence import DocumentManager
from RevitServices.Transactions import TransactionManager

doc = DocumentManager.Instance.CurrentDBDocument
view = doc.ActiveView
uidoc = DocumentManager.Instance.CurrentUIApplication.ActiveUIDocument

#Preparing input from dynamo to revit
element = UnwrapElement(IN[0])

#Do some action in a Transaction
#TransactionManager.Instance.EnsureInTransaction(doc)
"""Now, You Can Code """



#TransactionManager.Instance.TransactionTaskDone()

OUT = element
# ----------------------------------------
form_1 = Python()  # IronPython2; frozen; unwired: IN[0]
# ---------- form_1.python (136 lines) ----------
import clr
import System
 
clr.AddReference("RevitServices")
import RevitServices
from RevitServices.Persistence import DocumentManager
from RevitServices.Transactions import TransactionManager

clr.AddReference("RevitNodes")
import Revit
clr.ImportExtensions(Revit.Elements)
clr.ImportExtensions(Revit.GeometryConversion)

clr.AddReference("RevitAPIUI")
from Autodesk.Revit.UI import*
clr.AddReference('RevitAPIUI')
from Autodesk.Revit.UI import Selection
from  Autodesk.Revit.UI.Selection import ISelectionFilter

clr.AddReference('RevitAPI')
from Autodesk.Revit.DB import*
#########################################################################
clr.AddReference('System.Windows.Forms')
clr.AddReference('System.Drawing')
# clr.AddReference('System.Windows.Forms.DataVisualization')
import System.Windows.Forms
import System.Drawing
from System.Drawing import *
from System.Windows.Forms import *
from System.Collections.Generic import *
#########################################################################
doc = DocumentManager.Instance.CurrentDBDocument
View = doc.ActiveView
uidoc = DocumentManager.Instance.CurrentUIApplication.ActiveUIDocument

#########################################################################


class MainForm(Form):
	def __init__(self):
		self.InitializeComponent()
	
	def InitializeComponent(self):
		self._listView1 = System.Windows.Forms.ListView()
		self._cbbx = System.Windows.Forms.ComboBox()
		self._button1 = System.Windows.Forms.Button()
		self._button2 = System.Windows.Forms.Button()
		self.SuspendLayout()
		# 
		# listView1
		# 
		self._listView1.Location = System.Drawing.Point(5, 54)
		self._listView1.Name = "listView1"
		self._listView1.Size = System.Drawing.Size(366, 339)
		self._listView1.TabIndex = 0
		self._listView1.UseCompatibleStateImageBehavior = False
		# 
		# cbbx
		# 
		self._cbbx.FormattingEnabled = True
		self._cbbx.Location = System.Drawing.Point(5, 27)
		self._cbbx.Name = "cbbx"
		self._cbbx.Size = System.Drawing.Size(366, 21)
		self._cbbx.TabIndex = 1
		self._cbbx.SelectedIndexChanged += self.ComboBox1SelectedIndexChanged
		self._cbbx.Items.AddRange(System.Array[System.Object](["a", "b", "c", "d"]))

		# 
		# button1
		# 
		self._button1.Location = System.Drawing.Point(204, 399)
		self._button1.Name = "button1"
		self._button1.Size = System.Drawing.Size(75, 23)
		self._button1.TabIndex = 2
		self._button1.Text = "Cancel"
		self._button1.UseVisualStyleBackColor = True
		# 
		# button2
		# 
		self._button2.Location = System.Drawing.Point(285, 399)
		self._button2.Name = "button2"
		self._button2.Size = System.Drawing.Size(75, 23)
		self._button2.TabIndex = 3
		self._button2.Text = "Ok"
		self._button2.UseVisualStyleBackColor = True
		# 
		# MainForm
		# 
		self.AllowDrop = True
		self.AutoScroll = True
		self.AutoSize = True
		self.AutoSizeMode = System.Windows.Forms.AutoSizeMode.GrowAndShrink
		self.BackColor = System.Drawing.SystemColors.ButtonHighlight
		self.ClientSize = System.Drawing.Size(382, 425)
		self.Controls.Add(self._button2)
		self.Controls.Add(self._button1)
		self.Controls.Add(self._cbbx)
		self.Controls.Add(self._listView1)
		self.ForeColor = System.Drawing.SystemColors.ActiveCaptionText
		self.FormBorderStyle = System.Windows.Forms.FormBorderStyle.Fixed3D
		self.HelpButton = True
		self.Name = "MainForm"
		self.ShowIcon = False
		self.StartPosition = System.Windows.Forms.FormStartPosition.CenterScreen
		self.Text = "Form"
		self.TopMost = True
		self.Load += self.MainFormLoad
		self.ResumeLayout(False)


	def MainFormLoad(self, sender, e):
			pass

	def ComboBox1SelectedIndexChanged(self, sender, e):
		selected_item = self._cbbx.SelectedItem

		if selected_item == "a":
			self.UpdateListView(0, 10)
		elif selected_item == "b":
			self.UpdateListView(11, 20)
		elif selected_item == "c":
			self.UpdateListView(21, 30)
		elif selected_item == "d":
			self.UpdateListView(50, 100)
			pass

	def UpdateListView(self, start, end):
		self._listView1.Items.Clear()
		data = System.Array[object]([str(i) for i in range(start, end + 1)])
		for item in data:
			self._listView1.Items.Add(item)




Application.Run(MainForm())
# ----------------------------------------
form_2 = Python()  # CPython3; frozen; unwired: IN[0]
# ---------- form_2.python (71 lines) ----------
import clr
import System
 
clr.AddReference("RevitServices")
import RevitServices
from RevitServices.Persistence import DocumentManager
from RevitServices.Transactions import TransactionManager


clr.AddReference("RevitNodes")
import Revit
clr.ImportExtensions(Revit.Elements)
clr.ImportExtensions(Revit.GeometryConversion)

clr.AddReference("RevitAPIUI")
from Autodesk.Revit.UI import*
clr.AddReference('RevitAPIUI')
from  Autodesk.Revit.UI.Selection import*
from  Autodesk.Revit.UI.Selection import ISelectionFilter

clr.AddReference('RevitAPI')
from Autodesk.Revit.DB import*
from Autodesk.Revit.DB import Line, ModelLine, LinePattern, ElementId
import Autodesk.Revit.DB as RDB
from Autodesk.Revit.DB import Line, GeometryInstance, Solid
#########################################################################
clr.AddReference('System.Windows.Forms')
clr.AddReference('System.Drawing')
# clr.AddReference('System.Windows.Forms.DataVisualization')
import System.Windows.Forms
import System.Drawing
from System.Drawing import *
from System.Windows.Forms import *
from System.Collections.Generic import *
#########################################################################
doc = DocumentManager.Instance.CurrentDBDocument
View = doc.ActiveView
uidoc = DocumentManager.Instance.CurrentUIApplication.ActiveUIDocument

#########################################################################

class MainForm(Form):
	def __init__(self):
		self.InitializeComponent()
	
	def InitializeComponent(self):
		self._label1 = System.Windows.Forms.Label()
		self.SuspendLayout()
		# 
		# label1
		# 
		self._label1.Location = System.Drawing.Point(191, 172)
		self._label1.Name = "label1"
		self._label1.Size = System.Drawing.Size(100, 23)
		self._label1.TabIndex = 0
		self._label1.Text = "HELLO WORLD"
		self._label1.TextAlign = System.Drawing.ContentAlignment.MiddleCenter
		# 
		# MainForm
		# 
		self.ClientSize = System.Drawing.Size(533, 397)
		self.Controls.Add(self._label1)
		self.Name = "MainForm"
		self.StartPosition = System.Windows.Forms.FormStartPosition.CenterScreen
		self.Text = "Form1"
		self.TopMost = True
		self.ResumeLayout(False)


		
Application.Run(MainForm())
# ----------------------------------------
form_3 = Python()  # CPython3; frozen; unwired: IN[0]
# ---------- form_3.python (163 lines) ----------
import clr
import System
 
clr.AddReference("RevitServices")
import RevitServices
from RevitServices.Persistence import DocumentManager
from RevitServices.Transactions import TransactionManager

clr.AddReference("RevitNodes")
import Revit
clr.ImportExtensions(Revit.Elements)
clr.ImportExtensions(Revit.GeometryConversion)

clr.AddReference("RevitAPIUI")
from Autodesk.Revit.UI import*
clr.AddReference('RevitAPIUI')
from Autodesk.Revit.UI import Selection
from  Autodesk.Revit.UI.Selection import ISelectionFilter

clr.AddReference('RevitAPI')
from Autodesk.Revit.DB import*
#########################################################################
clr.AddReference('System.Windows.Forms')
clr.AddReference('System.Drawing')
# clr.AddReference('System.Windows.Forms.DataVisualization')
import System.Windows.Forms
import System.Drawing
from System.Drawing import *
from System.Windows.Forms import *
from System.Collections.Generic import *
#########################################################################
doc = DocumentManager.Instance.CurrentDBDocument
View = doc.ActiveView
uidoc = DocumentManager.Instance.CurrentUIApplication.ActiveUIDocument

class MainForm(Form):
	def __init__(self):
		self.InitializeComponent()
	
	def InitializeComponent(self):
		self._Schedules = System.Windows.Forms.GroupBox()
		self._lstSche = System.Windows.Forms.ListBox()
		self._rdbtAll = System.Windows.Forms.RadioButton()
		self._groupBox1 = System.Windows.Forms.GroupBox()
		self._label1 = System.Windows.Forms.Label()
		self._textBox1 = System.Windows.Forms.TextBox()
		self._button1 = System.Windows.Forms.Button()
		self._bttExport = System.Windows.Forms.Button()
		self._bttCancel = System.Windows.Forms.Button()
		self._Schedules.SuspendLayout()
		self._groupBox1.SuspendLayout()
		self.SuspendLayout()
		# 
		# Schedules
		# 
		self._Schedules.Controls.Add(self._rdbtAll)
		self._Schedules.Controls.Add(self._lstSche)
		self._Schedules.Location = System.Drawing.Point(14, 13)
		self._Schedules.Name = "Schedules"
		self._Schedules.Size = System.Drawing.Size(467, 154)
		self._Schedules.TabIndex = 0
		self._Schedules.TabStop = False
		self._Schedules.Text = "Schedules"
		# 
		# lstSche
		# 
		self._lstSche.FormattingEnabled = True
		self._lstSche.Location = System.Drawing.Point(6, 19)
		self._lstSche.Name = "lstSche"
		self._lstSche.Size = System.Drawing.Size(453, 108)
		self._lstSche.TabIndex = 0
		# 
		# rdbtAll
		# 
		self._rdbtAll.Location = System.Drawing.Point(7, 127)
		self._rdbtAll.Name = "rdbtAll"
		self._rdbtAll.Size = System.Drawing.Size(104, 24)
		self._rdbtAll.TabIndex = 1
		self._rdbtAll.TabStop = True
		self._rdbtAll.Text = "Check All/None"
		self._rdbtAll.UseVisualStyleBackColor = True
		# 
		# groupBox1
		# 
		self._groupBox1.Controls.Add(self._button1)
		self._groupBox1.Controls.Add(self._textBox1)
		self._groupBox1.Controls.Add(self._label1)
		self._groupBox1.Location = System.Drawing.Point(14, 175)
		self._groupBox1.Name = "groupBox1"
		self._groupBox1.Size = System.Drawing.Size(467, 55)
		self._groupBox1.TabIndex = 1
		self._groupBox1.TabStop = False
		self._groupBox1.Text = "Export Options"
		# 
		# label1
		# 
		self._label1.Location = System.Drawing.Point(7, 20)
		self._label1.Name = "label1"
		self._label1.Size = System.Drawing.Size(100, 23)
		self._label1.TabIndex = 0
		self._label1.Text = "Output folder:"
		# 
		# textBox1
		# 
		self._textBox1.Location = System.Drawing.Point(80, 20)
		self._textBox1.Name = "textBox1"
		self._textBox1.Size = System.Drawing.Size(298, 20)
		self._textBox1.TabIndex = 1
		# 
		# button1
		# 
		self._button1.Location = System.Drawing.Point(384, 20)
		self._button1.Name = "button1"
		self._button1.Size = System.Drawing.Size(75, 23)
		self._button1.TabIndex = 2
		self._button1.Text = "Browse..."
		self._button1.UseVisualStyleBackColor = True
		# 
		# bttExport
		# 
		self._bttExport.Location = System.Drawing.Point(317, 236)
		self._bttExport.Name = "bttExport"
		self._bttExport.Size = System.Drawing.Size(75, 23)
		self._bttExport.TabIndex = 2
		self._bttExport.Text = "Export"
		self._bttExport.UseVisualStyleBackColor = True
		# 
		# bttCancel
		# 
		self._bttCancel.Location = System.Drawing.Point(398, 236)
		self._bttCancel.Name = "bttCancel"
		self._bttCancel.Size = System.Drawing.Size(75, 23)
		self._bttCancel.TabIndex = 3
		self._bttCancel.Text = "Cacel"
		self._bttCancel.UseVisualStyleBackColor = True
		# 
		# MainForm
		# 
		self.BackColor = System.Drawing.SystemColors.ButtonHighlight
		self.ClientSize = System.Drawing.Size(495, 264)
		self.Controls.Add(self._bttCancel)
		self.Controls.Add(self._bttExport)
		self.Controls.Add(self._groupBox1)
		self.Controls.Add(self._Schedules)
		self.Name = "MainForm"
		self.ShowIcon = False
		self.Text = "Export Schedule Dynamo Winform"
		self._Schedules.ResumeLayout(False)
		self._groupBox1.ResumeLayout(False)
		self._groupBox1.PerformLayout()
		self.ResumeLayout(False)








form  = MainForm()
Application.Run(form)

OUT = 0
# ----------------------------------------
form_4_export_schedule_to_excel = Python()  # CPython3; frozen; unwired: IN[0]
# ---------- form_4_export_schedule_to_excel.python (261 lines) ----------
import clr
import System
 
clr.AddReference("RevitServices")
import RevitServices
from RevitServices.Persistence import DocumentManager
from RevitServices.Transactions import TransactionManager

clr.AddReference("RevitNodes")
import Revit
clr.ImportExtensions(Revit.Elements)
clr.ImportExtensions(Revit.GeometryConversion)

clr.AddReference("RevitAPIUI")
from Autodesk.Revit.UI import*
clr.AddReference('RevitAPIUI')
from Autodesk.Revit.UI import Selection
from  Autodesk.Revit.UI.Selection import ISelectionFilter

clr.AddReference('RevitAPI')
from Autodesk.Revit.DB import*
#########################################################################
clr.AddReference('System.Windows.Forms')
clr.AddReference('System.Drawing')
clr.AddReference('System.Windows.Forms.DataVisualization')
import System.Windows.Forms
import System.Drawing
from System.Drawing import *
from System.Windows.Forms import *
from System.Collections.Generic import *
#########################################################################
doc = DocumentManager.Instance.CurrentDBDocument
View = doc.ActiveView
uidoc = DocumentManager.Instance.CurrentUIApplication.ActiveUIDocument
#########################################################################
naCate = [i.Name for i in doc.Settings.Categories]
fil = "Schedules"
getIndex_Item = naCate.index(fil)
catebyName = UnwrapElement(Revit.Elements.Category.ByName(naCate[getIndex_Item]))

bic = System.Enum.ToObject(BuiltInCategory, catebyName.Id.IntegerValue)
filters = FilteredElementCollector(doc).OfCategory(bic).ToElements()
sche_Name = filters

class MainForm(Form):
	def __init__(self):
		self.InitializeComponent()
	
	def InitializeComponent(self):
		self._groupBox1 = System.Windows.Forms.GroupBox()
		self._groupBox2 = System.Windows.Forms.GroupBox()
		self._clbNaSchedu = System.Windows.Forms.CheckedListBox()
		self._tbxTotalItems = System.Windows.Forms.TextBox()
		self._cbxAllNone = System.Windows.Forms.CheckBox()
		self._label1 = System.Windows.Forms.Label()
		self._label2 = System.Windows.Forms.Label()
		self._txtbBrowse = System.Windows.Forms.TextBox()
		self._bttBrowse = System.Windows.Forms.Button()
		self._bttExport = System.Windows.Forms.Button()
		self._bttCancel = System.Windows.Forms.Button()
		self._label3 = System.Windows.Forms.Label()
		self._groupBox1.SuspendLayout()
		self._groupBox2.SuspendLayout()
		self.SuspendLayout()
		# 
		# groupBox1
		# 
		self._groupBox1.Controls.Add(self._label1)
		self._groupBox1.Controls.Add(self._cbxAllNone)
		self._groupBox1.Controls.Add(self._tbxTotalItems)
		self._groupBox1.Controls.Add(self._clbNaSchedu)
		self._groupBox1.Location = System.Drawing.Point(9, 6)
		self._groupBox1.Name = "groupBox1"
		self._groupBox1.Size = System.Drawing.Size(445, 176)
		self._groupBox1.TabIndex = 0
		self._groupBox1.TabStop = False
		self._groupBox1.Text = "Schedules"
		# 
		# groupBox2
		# 
		self._groupBox2.Controls.Add(self._bttBrowse)
		self._groupBox2.Controls.Add(self._txtbBrowse)
		self._groupBox2.Controls.Add(self._label2)
		self._groupBox2.Location = System.Drawing.Point(9, 188)
		self._groupBox2.Name = "groupBox2"
		self._groupBox2.Size = System.Drawing.Size(445, 52)
		self._groupBox2.TabIndex = 1
		self._groupBox2.TabStop = False
		self._groupBox2.Text = "Export Options"
		# 
		# clbNaSchedu
		# 
		self._clbNaSchedu.CheckOnClick = True
		self._clbNaSchedu.AllowDrop = True
		self._clbNaSchedu.DisplayMember = "Name"
		self._clbNaSchedu.FormattingEnabled = True
		self._clbNaSchedu.Location = System.Drawing.Point(7, 20)
		self._clbNaSchedu.Name = "clbNaSchedu"
		self._clbNaSchedu.Size = System.Drawing.Size(432, 124)
		self._clbNaSchedu.TabIndex = 0
		self._clbNaSchedu.SelectedIndexChanged += self.ClbNaScheduSelectedIndexChanged
		for i in sche_Name:
			self._clbNaSchedu.Items.Add(i)	
		# 
		# tbxTotalItems
		# 
		self._tbxTotalItems.Location = System.Drawing.Point(387, 150)
		self._tbxTotalItems.Name = "tbxTotalItems"
		self._tbxTotalItems.Size = System.Drawing.Size(52, 20)
		self._tbxTotalItems.TabIndex = 1
		self._tbxTotalItems.TextChanged += self.TbxTotalItemsTextChanged
		# 
		# cbxAllNone
		# 
		self._cbxAllNone.Location = System.Drawing.Point(7, 150)
		self._cbxAllNone.Name = "cbxAllNone"
		self._cbxAllNone.Size = System.Drawing.Size(104, 24)
		self._cbxAllNone.TabIndex = 2
		self._cbxAllNone.Text = "Select All/None"
		self._cbxAllNone.UseVisualStyleBackColor = True
		self._cbxAllNone.CheckedChanged += self.CbxAllNoneCheckedChanged
	
		# 
		# label1
		# 
		self._label1.Location = System.Drawing.Point(314, 148)
		self._label1.Name = "label1"
		self._label1.Size = System.Drawing.Size(67, 23)
		self._label1.TabIndex = 3
		self._label1.Text = "Total Items:"
		self._label1.TextAlign = System.Drawing.ContentAlignment.MiddleLeft
		# 
		# label2
		# 
		self._label2.Location = System.Drawing.Point(7, 20)
		self._label2.Name = "label2"
		self._label2.Size = System.Drawing.Size(74, 23)
		self._label2.TabIndex = 0
		self._label2.Text = "Out Folder:"
		# 
		# txtbBrowse
		# 
		self._txtbBrowse.Location = System.Drawing.Point(67, 17)
		self._txtbBrowse.Name = "txtbBrowse"
		self._txtbBrowse.Size = System.Drawing.Size(275, 20)
		self._txtbBrowse.TabIndex = 2
		self._txtbBrowse.TextChanged += self.TxtbBrowseTextChanged
		# 
		# bttBrowse
		# 
		self._bttBrowse.Location = System.Drawing.Point(348, 15)
		self._bttBrowse.Name = "bttBrowse"
		self._bttBrowse.Size = System.Drawing.Size(75, 23)
		self._bttBrowse.TabIndex = 3
		self._bttBrowse.Text = "Browse..."
		self._bttBrowse.UseVisualStyleBackColor = True
		self._bttBrowse.Click += self.BttBrowseClick
		# 
		# bttExport
		# 
		self._bttExport.Location = System.Drawing.Point(298, 246)
		self._bttExport.Name = "bttExport"
		self._bttExport.Size = System.Drawing.Size(75, 23)
		self._bttExport.TabIndex = 2
		self._bttExport.Text = "Export"
		self._bttExport.UseVisualStyleBackColor = True
		self._bttExport.Click += self.BttExportClick
		# 
		# bttCancel
		# 
		self._bttCancel.Location = System.Drawing.Point(379, 246)
		self._bttCancel.Name = "bttCancel"
		self._bttCancel.Size = System.Drawing.Size(75, 23)
		self._bttCancel.TabIndex = 3
		self._bttCancel.Text = "Cancel"
		self._bttCancel.UseVisualStyleBackColor = True
		self._bttCancel.Click += self.BttCancelClick
		# 
		# label3
		# 
		self._label3.Font = System.Drawing.Font("Microsoft Sans Serif", 8.25, System.Drawing.FontStyle.Italic, System.Drawing.GraphicsUnit.Point, 0)
		self._label3.Location = System.Drawing.Point(16, 246)
		self._label3.Name = "label3"
		self._label3.Size = System.Drawing.Size(138, 23)
		self._label3.TabIndex = 4
		self._label3.Text = "BIM3DM - Dynamo API"
		# 
		# MainForm
		# 
		self.BackColor = System.Drawing.SystemColors.ButtonHighlight
		self.ClientSize = System.Drawing.Size(461, 272)
		self.Controls.Add(self._label3)
		self.Controls.Add(self._bttCancel)
		self.Controls.Add(self._bttExport)
		self.Controls.Add(self._groupBox2)
		self.Controls.Add(self._groupBox1)
		self.Name = "MainForm"
		self.ShowIcon = False
		self.Text = "Export Schedules"
		self._groupBox1.ResumeLayout(False)
		self._groupBox1.PerformLayout()
		self._groupBox2.ResumeLayout(False)
		self._groupBox2.PerformLayout()
		self.ResumeLayout(False)


	def ClbNaScheduSelectedIndexChanged(self, sender, e):
		pass

	def CbxAllNoneCheckedChanged(self, sender, e):
		var = self._clbNaSchedu.Items.Count
		self._tbxTotalItems.Text = str(var)
		rangers = range(var)
		for i in rangers:
			if self._cbxAllNone.Checked == True:
				self._clbNaSchedu.SetItemChecked(i, True)
			else:
				self._clbNaSchedu.SetItemChecked(i,False)
		pass

	def TbxTotalItemsTextChanged(self, sender, e):
		pass

	def TxtbBrowseTextChanged(self, sender, e):
		pass

	def BttBrowseClick(self, sender, e):
		fileDialog = FolderBrowserDialog()
		fileDialog.ShowDialog()
		self._txtbBrowse.Text = fileDialog.SelectedPath
		pass

	def BttCancelClick(self, sender, e):
		self.Close()
		pass
	def BttExportClick(self, sender, e):
		selected = []
		for i in self._clbNaSchedu.CheckedItems:
			selected.append(i)
#_________________________________________________________________#
		nameSched = []
		for i in selected:
			nameSched.append(i.Name + ".xls")
		path = self._txtbBrowse.Text
#_________________________________________________________________#
		self.result_list = []
		for index, sched in enumerate(selected):
			schedule = UnwrapElement(sched)
			fileName = nameSched[index]
			try:
				export_options = ViewScheduleExportOptions()
				schedule.Export(path,fileName,export_options)
				self.result_list.append("Schedule Exported")
			except:
				self.result_list.append("Eport Failure")
		
		self.Close()

		pass
f = MainForm()
Application.Run(f)
# ----------------------------------------
code_block = CodeBlock()
# ---------- code_block.designscript (3 lines) ----------
//elements = FilteredElementCollector(doc).OfCategory(BuiltInCategory.OST_Levels).WhereElementIsNotElementType().ToElements()

//elements = FilteredElementCollector(doc).OfClass(Family).ToElements()
# ----------------------------------------
combobox = Python()  # CPython3; frozen; unwired: IN[0]
# ---------- combobox.python (78 lines) ----------
import clr
import System
 
clr.AddReference("RevitServices")
import RevitServices
from RevitServices.Persistence import DocumentManager
from RevitServices.Transactions import TransactionManager

clr.AddReference("RevitNodes")
import Revit
clr.ImportExtensions(Revit.Elements)
clr.ImportExtensions(Revit.GeometryConversion)

clr.AddReference("RevitAPIUI")
from Autodesk.Revit.UI import*
clr.AddReference('RevitAPIUI')
from Autodesk.Revit.UI import Selection
from  Autodesk.Revit.UI.Selection import ISelectionFilter

clr.AddReference('RevitAPI')
from Autodesk.Revit.DB import*
#########################################################################
clr.AddReference('System.Windows.Forms')
clr.AddReference('System.Drawing')
# clr.AddReference('System.Windows.Forms.DataVisualization')
import System.Windows.Forms
import System.Drawing
from System.Drawing import *
from System.Windows.Forms import *
from System.Collections.Generic import *
#########################################################################
doc = DocumentManager.Instance.CurrentDBDocument
View = doc.ActiveView
uidoc = DocumentManager.Instance.CurrentUIApplication.ActiveUIDocument
#########################################################################


import System.Drawing
import System.Windows.Forms

from System.Drawing import *
from System.Windows.Forms import *

elements = FilteredElementCollector(doc).OfClass(Family).ToElements()


class MainForm(Form):
	def __init__(self):
		self.InitializeComponent()
	
	def InitializeComponent(self):
		self._cbb1 = System.Windows.Forms.ComboBox()
		self.SuspendLayout()
		# 
		# cbb1
		# 
		self._cbb1.DisplayMember = "Name"
		self._cbb1.FormattingEnabled = True
		self._cbb1.Location = System.Drawing.Point(87, 100)
		self._cbb1.Name = "cbb1"
		self._cbb1.Size = System.Drawing.Size(121, 21)
		self._cbb1.TabIndex = 0
		self._cbb1.SelectedIndexChanged += self.Cbb1SelectedIndexChanged
		self._cbb1.Items.AddRange(System.Array[System.Object](elements))
		# 
		# MainForm
		# 
		self.ClientSize = System.Drawing.Size(284, 261)
		self.Controls.Add(self._cbb1)
		self.Name = "MainForm"
		self.Text = "TestUI"
		self.ResumeLayout(False)


	def Cbb1SelectedIndexChanged(self, sender, e):
		pass

Application.Run(MainForm())
# ----------------------------------------
select_level_2 = Python()  # CPython3; frozen; unwired: IN[0]; same code as select_level
add_tool_form = Python(IN[1]=select_level_2)  # CPython3; unwired: IN[0]
# ---------- add_tool_form.python (272 lines) ----------
import clr
import System
 
clr.AddReference("RevitServices")
import RevitServices
from RevitServices.Persistence import DocumentManager
from RevitServices.Transactions import TransactionManager

clr.AddReference("RevitNodes")
import Revit
clr.ImportExtensions(Revit.Elements)
clr.ImportExtensions(Revit.GeometryConversion)

clr.AddReference("RevitAPIUI")
from Autodesk.Revit.UI import*
clr.AddReference('RevitAPIUI')
from Autodesk.Revit.UI import Selection
from  Autodesk.Revit.UI.Selection import ISelectionFilter

clr.AddReference('RevitAPI')
from Autodesk.Revit.DB import*
#########################################################################
clr.AddReference('System.Windows.Forms')
clr.AddReference('System.Drawing')
import System.Windows.Forms
import System.Drawing
from System.Drawing import *
from System.Windows.Forms import *
from System.Collections.Generic import *
#########################################################################
doc = DocumentManager.Instance.CurrentDBDocument
View = doc.ActiveView
uidoc = DocumentManager.Instance.CurrentUIApplication.ActiveUIDocument
#########################################################################

levels = IN[1]

class MainForm(Form):
	def __init__(self):
		self.InitializeComponent()
	
	def InitializeComponent(self):
		self._label1 = System.Windows.Forms.Label()
		self._txtbPanel = System.Windows.Forms.TextBox()
		self._label2 = System.Windows.Forms.Label()
		self._label4 = System.Windows.Forms.Label()
		self._cbbSourceFile = System.Windows.Forms.ComboBox()
		self._label5 = System.Windows.Forms.Label()
		self._txtbIconPath = System.Windows.Forms.TextBox()
		self._label6 = System.Windows.Forms.Label()
		self._btnSelIcon = System.Windows.Forms.Button()
		self._btnCancel = System.Windows.Forms.Button()
		self._btnOk = System.Windows.Forms.Button()
		self._txtbBtn = System.Windows.Forms.TextBox()
		self._groupBox1 = System.Windows.Forms.GroupBox()
		self._groupBox2 = System.Windows.Forms.GroupBox()
		self._cbbxTest = System.Windows.Forms.ComboBox()
		self._label3 = System.Windows.Forms.Label()
		self._clbTest = System.Windows.Forms.CheckedListBox()
		self._groupBox1.SuspendLayout()
		self._groupBox2.SuspendLayout()
		self.SuspendLayout()
		# 
		# label1
		# 
		self._label1.Font = System.Drawing.Font("Tahoma", 9.75, System.Drawing.FontStyle.Regular, System.Drawing.GraphicsUnit.Point, 0)
		self._label1.Location = System.Drawing.Point(19, 32)
		self._label1.Name = "label1"
		self._label1.Size = System.Drawing.Size(81, 23)
		self._label1.TabIndex = 0
		self._label1.Text = "Panel Name:"
		self._label1.TextAlign = System.Drawing.ContentAlignment.MiddleLeft
		# 
		# txtbPanel
		# 
		self._txtbPanel.Location = System.Drawing.Point(125, 32)
		self._txtbPanel.Name = "txtbPanel"
		self._txtbPanel.Size = System.Drawing.Size(183, 23)
		self._txtbPanel.TabIndex = 1
		# 
		# label2
		# 
		self._label2.Font = System.Drawing.Font("Tahoma", 9.75, System.Drawing.FontStyle.Regular, System.Drawing.GraphicsUnit.Point, 0)
		self._label2.Location = System.Drawing.Point(314, 32)
		self._label2.Name = "label2"
		self._label2.Size = System.Drawing.Size(100, 23)
		self._label2.TabIndex = 2
		self._label2.Text = "Button Name:"
		self._label2.TextAlign = System.Drawing.ContentAlignment.MiddleLeft
		# 
		# label4
		# 
		self._label4.Font = System.Drawing.Font("Tahoma", 9.75, System.Drawing.FontStyle.Regular, System.Drawing.GraphicsUnit.Point, 0)
		self._label4.Location = System.Drawing.Point(45, 98)
		self._label4.Name = "label4"
		self._label4.Size = System.Drawing.Size(81, 23)
		self._label4.TabIndex = 4
		self._label4.Text = "Source File:"
		self._label4.TextAlign = System.Drawing.ContentAlignment.MiddleLeft
		# 
		# cbbSourceFile
		# 
		self._cbbSourceFile.FormattingEnabled = True
		self._cbbSourceFile.Location = System.Drawing.Point(151, 100)
		self._cbbSourceFile.Name = "cbbSourceFile"
		self._cbbSourceFile.Size = System.Drawing.Size(183, 21)
		self._cbbSourceFile.TabIndex = 5
		# 
		# label5
		# 
		self._label5.Font = System.Drawing.Font("Tahoma", 9.75, System.Drawing.FontStyle.Regular, System.Drawing.GraphicsUnit.Point, 0)
		self._label5.Location = System.Drawing.Point(19, 22)
		self._label5.Name = "label5"
		self._label5.Size = System.Drawing.Size(69, 23)
		self._label5.TabIndex = 6
		self._label5.Text = "Icon Path:"
		self._label5.TextAlign = System.Drawing.ContentAlignment.MiddleLeft
		# 
		# txtbIconPath
		# 
		self._txtbIconPath.Location = System.Drawing.Point(125, 22)
		self._txtbIconPath.Name = "txtbIconPath"
		self._txtbIconPath.Size = System.Drawing.Size(478, 23)
		self._txtbIconPath.TabIndex = 7
		# 
		# label6
		# 
		self._label6.Font = System.Drawing.Font("Tahoma", 9.75, System.Drawing.FontStyle.Regular, System.Drawing.GraphicsUnit.Point, 0)
		self._label6.Location = System.Drawing.Point(19, 57)
		self._label6.Name = "label6"
		self._label6.Size = System.Drawing.Size(100, 23)
		self._label6.TabIndex = 8
		self._label6.Text = "Select A Icon:"
		self._label6.TextAlign = System.Drawing.ContentAlignment.MiddleLeft
		# 
		# btnSelIcon
		# 
		self._btnSelIcon.BackColor = System.Drawing.SystemColors.ButtonFace
		self._btnSelIcon.Location = System.Drawing.Point(125, 57)
		self._btnSelIcon.Name = "btnSelIcon"
		self._btnSelIcon.Size = System.Drawing.Size(86, 23)
		self._btnSelIcon.TabIndex = 9
		self._btnSelIcon.Text = "Icon"
		self._btnSelIcon.UseVisualStyleBackColor = False
		self._btnSelIcon.Click += self.BtnSelIconClick
		# 
		# btnCancel
		# 
		self._btnCancel.BackColor = System.Drawing.SystemColors.ButtonFace
		self._btnCancel.Location = System.Drawing.Point(404, 238)
		self._btnCancel.Name = "btnCancel"
		self._btnCancel.Size = System.Drawing.Size(114, 30)
		self._btnCancel.TabIndex = 10
		self._btnCancel.Text = "Cancel"
		self._btnCancel.UseVisualStyleBackColor = False
		self._btnCancel.Click += self.BtnCancelClick
		# 
		# btnOk
		# 
		self._btnOk.BackColor = System.Drawing.SystemColors.ButtonFace
		self._btnOk.Location = System.Drawing.Point(524, 238)
		self._btnOk.Name = "btnOk"
		self._btnOk.Size = System.Drawing.Size(114, 30)
		self._btnOk.TabIndex = 11
		self._btnOk.Text = "OK"
		self._btnOk.UseVisualStyleBackColor = False
		self._btnOk.Click += self.BtnOkClick
		# 
		# txtbBtn
		# 
		self._txtbBtn.Location = System.Drawing.Point(420, 32)
		self._txtbBtn.Name = "txtbBtn"
		self._txtbBtn.Size = System.Drawing.Size(183, 23)
		self._txtbBtn.TabIndex = 12
		# 
		# groupBox1
		# 
		self._groupBox1.Controls.Add(self._label5)
		self._groupBox1.Controls.Add(self._txtbIconPath)
		self._groupBox1.Controls.Add(self._label6)
		self._groupBox1.Controls.Add(self._btnSelIcon)
		self._groupBox1.Font = System.Drawing.Font("Tahoma", 9.75, System.Drawing.FontStyle.Regular, System.Drawing.GraphicsUnit.Point, 0)
		self._groupBox1.Location = System.Drawing.Point(26, 127)
		self._groupBox1.Name = "groupBox1"
		self._groupBox1.Size = System.Drawing.Size(637, 91)
		self._groupBox1.TabIndex = 13
		self._groupBox1.TabStop = False
		self._groupBox1.Text = "Icon"
		# 
		# groupBox2
		# 
		self._groupBox2.Controls.Add(self._label1)
		self._groupBox2.Controls.Add(self._txtbPanel)
		self._groupBox2.Controls.Add(self._txtbBtn)
		self._groupBox2.Controls.Add(self._label2)
		self._groupBox2.Font = System.Drawing.Font("Tahoma", 9.75, System.Drawing.FontStyle.Regular, System.Drawing.GraphicsUnit.Point, 0)
		self._groupBox2.Location = System.Drawing.Point(26, 12)
		self._groupBox2.Name = "groupBox2"
		self._groupBox2.Size = System.Drawing.Size(637, 72)
		self._groupBox2.TabIndex = 14
		self._groupBox2.TabStop = False
		self._groupBox2.Text = "Button"
		# 
		# cbbxTest
		# 
		self._cbbxTest.FormattingEnabled = True
		self._cbbxTest.Location = System.Drawing.Point(136, 238)
		self._cbbxTest.Name = "cbbxTest"
		self._cbbxTest.Size = System.Drawing.Size(172, 21)
		self._cbbxTest.TabIndex = 15
		self._cbbxTest.Items.AddRange(System.Array[System.Object](levels))
		# 
		# label3
		# 
		self._label3.Font = System.Drawing.Font("Tahoma", 9.75, System.Drawing.FontStyle.Regular, System.Drawing.GraphicsUnit.Point, 0)
		self._label3.Location = System.Drawing.Point(26, 236)
		self._label3.Name = "label3"
		self._label3.Size = System.Drawing.Size(100, 23)
		self._label3.TabIndex = 16
		self._label3.Text = "Test CBB"
		self._label3.TextAlign = System.Drawing.ContentAlignment.MiddleLeft
		# 
		# clbTest
		# 
		self._clbTest.FormattingEnabled = True
		self._clbTest.Location = System.Drawing.Point(136, 278)
		self._clbTest.Name = "clbTest"
		self._clbTest.Size = System.Drawing.Size(172, 94)
		self._clbTest.TabIndex = 17
		for lv in levels:
			self._clbTest.Items.Add(lv)
		# 
		# MainForm
		# 
		self.BackColor = System.Drawing.SystemColors.ButtonHighlight
		self.ClientSize = System.Drawing.Size(668, 384)
		self.Controls.Add(self._clbTest)
		self.Controls.Add(self._label3)
		self.Controls.Add(self._cbbxTest)
		self.Controls.Add(self._groupBox2)
		self.Controls.Add(self._groupBox1)
		self.Controls.Add(self._btnOk)
		self.Controls.Add(self._btnCancel)
		self.Controls.Add(self._cbbSourceFile)
		self.Controls.Add(self._label4)
		self.Name = "MainForm"
		self.StartPosition = System.Windows.Forms.FormStartPosition.CenterScreen
		self.Text = "Add Tool"
		self.TopMost = True
		self._groupBox1.ResumeLayout(False)
		self._groupBox1.PerformLayout()
		self._groupBox2.ResumeLayout(False)
		self._groupBox2.PerformLayout()
		self.ResumeLayout(False)


	def BtnCancelClick(self, sender, e):
		self.Close()
		pass

	def BtnOkClick(self, sender, e):
		self.Close()
		pass

	def BtnSelIconClick(self, sender, e):
		self.Close()
		pass

mainForm = MainForm()
Application.Run(mainForm)

OUT = levels
# ----------------------------------------
