# Dynamo graph PointTranslation.dyn (Dynamo 2.18.1.5096)

# group: VS Code
boolean = BoolSelector(true)
python_script = Python(IN[0]=boolean)  # IronPython2
# ---------- python_script.python (5 lines) ----------
re  = open(r"A:\Library-Dynamo-Python-CSharp\test.py", "r")

interpret = re.read()

OUT =  interpret
# ----------------------------------------
python_script_from_string = PythonStringNode(script=python_script)  # CPython3; unwired: IN[0], IN[1], IN[2], IN[3]

select_edges = SelectEdges()  # 3 picked in the model
xTranslation = DoubleSlider(1, range=-10..10 step 1)
yTranslation = DoubleSlider(6, range=-10..10 step 1)
zTranslation = DoubleSlider(-2, range=-10..10 step 1)
moveLinesByVector = Python(IN[0]=select_edges, IN[1]=xTranslation, IN[2]=yTranslation, IN[3]=zTranslation)  # CPython3
# ---------- moveLinesByVector.python (48 lines) ----------
import clr 
import System
import math 
from System.Collections.Generic import *


clr.AddReference('RevitAPI')
import Autodesk
from Autodesk.Revit.DB import *

clr.AddReference('RevitAPIUI')
from Autodesk.Revit.UI import*
from  Autodesk.Revit.UI.Selection import*

clr.AddReference("RevitNodes")
import Revit
clr.ImportExtensions(Revit.Elements)
clr.ImportExtensions(Revit.GeometryConversion)

clr.AddReference("ProtoGeometry")
from Autodesk.DesignScript.Geometry import *

clr.AddReference("RevitServices")
import RevitServices
from RevitServices.Persistence import DocumentManager
from RevitServices.Transactions import TransactionManager

doc = DocumentManager.Instance.CurrentDBDocument
view = doc.ActiveView
uidoc = DocumentManager.Instance.CurrentUIApplication.ActiveUIDocument
#########################################################################
def moveLinesByVector(lines, vector):
    newLines = []
    for line in lines:
        newStartPoint = line.StartPoint.Add(vector)
        newEndPoint = line.EndPoint.Add(vector)
        newLine = Line.ByStartPointEndPoint(newStartPoint, newEndPoint)
        newLines.append(newLine)
    return newLines



elements = [UnwrapElement(IN[0])] if not isinstance(IN[0], list) else UnwrapElement(IN[0])
xTranslation = IN[1]
yTranslation = IN[2]
zTranslation = IN[3]
vector = Vector.ByCoordinates(xTranslation, yTranslation, zTranslation)
OUT = moveLinesByVector(elements, vector)
# ----------------------------------------
