# Dynamo graph PointTranslation_Select_Edges.dyn (Dynamo 2.18.1.5096)

# group: VS Code
boolean = BoolSelector(false)
python_script = Python(IN[0]=boolean)  # IronPython2
# ---------- python_script.python (5 lines) ----------
re  = open(r"A:\Library-Dynamo-Python-CSharp\test.py", "r")

interpret = re.read()

OUT =  interpret
# ----------------------------------------
python_script_from_string = PythonStringNode(script=python_script)  # CPython3; unwired: IN[0], IN[1]

select_edges = SelectEdges()  # 3 picked in the model
select_edge = DSEdgeSelection()  # 1 picked in the model
getPointByLines = Python(IN[0]=select_edge)  # CPython3
# ---------- getPointByLines.python (40 lines) ----------
import clr 
import System
import math 
from System.Collections.Generic import *


clr.AddReference('RevitAPI')
import Autodesk
from Autodesk.Revit.DB import *

clr.AddReference('RevitAPIUI')
from Autodesk.Revit.UI import*
from  Autodesk.Revit.UI.Selection import*

clr.AddReference("RevitNodes")
import Revit
clr.ImportExtensions(Revit.Elements)
clr.ImportExtensions(Revit.GeometryConversion)

clr.AddReference("ProtoGeometry")
from Autodesk.DesignScript.Geometry import *

clr.AddReference("RevitServices")
import RevitServices
from RevitServices.Persistence import DocumentManager
from RevitServices.Transactions import TransactionManager

doc = DocumentManager.Instance.CurrentDBDocument
view = doc.ActiveView
uidoc = DocumentManager.Instance.CurrentUIApplication.ActiveUIDocument
#########################################################################
elements = [UnwrapElement(IN[0])] if not isinstance(IN[0], list) else UnwrapElement(IN[0])
def getPointByLines(lines):
    points = []
    for line in lines:
        start_point = Point.ByCoordinates(line.StartPoint.X, line.StartPoint.Y, line.StartPoint.Z)
        end_point = Point.ByCoordinates(line.EndPoint.X, line.EndPoint.Y, line.EndPoint.Z)
        points.append([start_point, end_point])
    return points
OUT = getPointByLines(elements)
# ----------------------------------------
flatten = List.Flatten(list=getPointByLines)
findMatchingPoints = Python(IN[0]=select_edges, IN[1]=flatten)  # CPython3
# ---------- findMatchingPoints.python (53 lines) ----------
import clr 
import System
import math 
from System.Collections.Generic import *


clr.AddReference('RevitAPI')
import Autodesk
from Autodesk.Revit.DB import *

clr.AddReference('RevitAPIUI')
from Autodesk.Revit.UI import*
from  Autodesk.Revit.UI.Selection import*

clr.AddReference("RevitNodes")
import Revit
clr.ImportExtensions(Revit.Elements)
clr.ImportExtensions(Revit.GeometryConversion)

clr.AddReference("ProtoGeometry")
from Autodesk.DesignScript.Geometry import *

clr.AddReference("RevitServices")
import RevitServices
from RevitServices.Persistence import DocumentManager
from RevitServices.Transactions import TransactionManager

doc = DocumentManager.Instance.CurrentDBDocument
view = doc.ActiveView
uidoc = DocumentManager.Instance.CurrentUIApplication.ActiveUIDocument
#########################################################################
def unwrapInput(inputValue):
    if isinstance(inputValue, list):
        return UnwrapElement(inputValue)
    else:
        return [UnwrapElement(inputValue)]
    
def findMatchingPoints(lines, points):
    matchingPoints = []
    for line in lines:
        startPoint = line.StartPoint
        endPoint = line.EndPoint
        for point in points:
            if startPoint.IsAlmostEqualTo(point):
                matchingPoints.append(point)
            if endPoint.IsAlmostEqualTo(point):
                matchingPoints.append(point)
    return matchingPoints

lines = unwrapInput(IN[0])
points = unwrapInput(IN[1])
matchingPoints = findMatchingPoints(lines, points)
OUT = matchingPoints
# ----------------------------------------
number_slider = DoubleSlider(0, range=-1000..1000 step 10)
number_slider_2 = DoubleSlider(0, range=-1000..1000 step 10)
number_slider_3 = DoubleSlider(250, range=-1000..1000 step 10)
code_block = CodeBlock(p=findMatchingPoints, x=number_slider, y=number_slider_2, z=number_slider_3) { p.X + x; p.Y + y; p.Z + z; }
byCoordinates = Point.ByCoordinates(x=code_block.out0, y=code_block.out1, z=code_block.out2)
