# Dynamo graph Selection_Lesson_12.dyn "Selection_3" (Dynamo 2.18.1.5096)
# packages: Genius Loci 2021.4.13, spring nodes 204.1.0

# group: Select Edge/Edges
select_edge = DSEdgeSelection()  # 1 picked in the model
boolean = BoolSelector(true)
select_edges = Python(IN[0]=boolean)  # IronPython2
# ---------- select_edges.python (25 lines) ----------
import clr 

clr.AddReference("RevitAPIUI")
from  Autodesk.Revit.UI import *

clr.AddReference("RevitServices")
import RevitServices
from RevitServices.Persistence import DocumentManager
doc = DocumentManager.Instance.CurrentDBDocument
uidoc=DocumentManager.Instance.CurrentUIApplication.ActiveUIDocument
  
clr.AddReference("RevitNodes")
import Revit
clr.ImportExtensions(Revit.Elements)
clr.ImportExtensions(Revit.GeometryConversion)



refs = uidoc.Selection.PickObjects(Selection.ObjectType.Edge, "Select the desired edges and press Finish")
edges = []
for i in xrange(len(refs)):
	el1 = doc.GetElement(refs[i].ElementId)
	edge = el1.GetGeometryObjectFromReference(refs[i])
	edges.append(edge.AsCurve().ToProtoType())
OUT = edges,el1
# ----------------------------------------
boolean_2 = BoolSelector(true)  # frozen
select_edge_2 = Python(IN[0]=boolean_2)  # IronPython2
# ---------- select_edge_2.python (24 lines) ----------
import clr 

clr.AddReference("RevitAPIUI")
from  Autodesk.Revit.UI import *

clr.AddReference("RevitServices")
import RevitServices
from RevitServices.Persistence import DocumentManager
doc = DocumentManager.Instance.CurrentDBDocument
uidoc=DocumentManager.Instance.CurrentUIApplication.ActiveUIDocument
  
clr.AddReference("RevitNodes")
import Revit
clr.ImportExtensions(Revit.Elements)
clr.ImportExtensions(Revit.GeometryConversion)


ref =  uidoc.Selection.PickObject(Selection.ObjectType.Edge, "Select the desired edges and press Finish")

fa = doc.GetElement(ref.ElementId)

edge = fa.GetGeometryObjectFromReference(ref)

OUT = edge.AsCurve().ToProtoType(),fa
# ----------------------------------------
watch = Watch(select_edge_2)
select_edges_2 = SelectEdges()  # 4 picked in the model; frozen

select_faces = SelectFaces()  # 2 picked in the model
categories = Categories("OST_StructuralColumns")
selectByCateOrType = Custom[SelectByCateOrType](CategoryOrType=categories)  # package Genius Loci; Collect elements by Category, Element Type or Family Type in the given document. The transform CS is returned only with a LinkInstance input.
levels = Levels("3FL")
categories_2 = Categories("OST_StructuralColumns")
selectByCateOrTypeAndLevel = Custom[SelectByCateOrTypeAndLevel](level=levels, CategoryOrType=categories_2)  # package Genius Loci; Collects elements by Category, Element Type, Wall/Floor/Roof/CeilingType or Family Type and Level in the active or given document. With linked documents, use the "Collector of Levels" node to obtain the linked level input.
views = Views("geo_Ele")
categories_3 = Categories("OST_StructuralColumns")
selectByCateOrTypeAndView = Custom[SelectByCateOrTypeAndView](view=views, CategoryOrType=categories_3)  # package Genius Loci; Collects elements by Category, Element Type or Family Type and View in the active or given document.
string = StringInput("Structural Columns")
selectByFilter = Custom[SelectByFilter](FilterName=string)  # package Genius Loci; Retrieves elements by the name of the selection set or rule-based filter.
views_2 = Views("geo_Ele")
selectByView = Custom[SelectByView](view=views_2)  # package Genius Loci; Collects elements visible in the View of the active or given document.
element_types = ElementTypes("Wall")
all_elements_of_class = Custom[All Elements of Class+](elementClass=element_types)  # package Genius Loci; Get the instances of the given class. Works with Element Class, FamilyType, ViewFamilyType, Wall/Floor/Roof/CeilingType, GroupType, FilledRegionType and TextNoteType.
collector_of_detail_items_types = Custom[Collector of Detail Items Types]()  # package Genius Loci; Retrieves all the Detail Items Family Types in the model.
boolean_3 = BoolSelector(true)
get_revitselection = Custom[Get RevitSelection](refresh=boolean_3)  # package Genius Loci; Gets the selection from the Revit UI. Use a boolean to refresh the selection.
categories_4 = Categories("OST_StructuralFraming")
select_model_element = DSModelElementSelection()  # 1 picked in the model
geometry = Element.Geometry(element=select_model_element)
boundingBox = Geometry.BoundingBox(geometry=geometry)
selectByCategoryAndBoundingBox = Custom[SelectByCategoryAndBoundingBox](category=categories_4, boundingBox=boundingBox)  # package Genius Loci; Collect elements by category from a BoundingBox.
selectByCategoryAndBoundingBox_2 = Python(IN[0]=categories_4, IN[1]=boundingBox)  # IronPython2; unwired: IN[2]
# ---------- selectByCategoryAndBoundingBox_2.python (62 lines) ----------
#By Einar_Raknes

import clr
clr.AddReference('RevitAPI')
clr.AddReference('System')
clr.AddReference('RevitNodes')
clr.AddReference('RevitServices')
import Revit
import RevitServices
from Autodesk.Revit.DB import *
from System.Collections.Generic import List
from RevitServices.Persistence import DocumentManager
clr.ImportExtensions(Revit.Elements)
clr.ImportExtensions(Revit.GeometryConversion)

#Functions for list handling
def ProcessList(_func, _list):
   return map( lambda x: ProcessList(_func, x) if type(x)==list else _func(x), _list )

#Preparing input from dynamo to revit
def ToRevit(item):
	return item.ToRevitType(True)

if isinstance(IN[0], list):
	cats = ProcessList(UnwrapElement, IN[0])
else:
	cats = [UnwrapElement(IN[0])]

if isinstance(IN[1], list):
	bblist = ProcessList(ToRevit, IN[1])
else:
	bblist = [ToRevit(IN[1])]

if isinstance(IN[0], list):
	inputdocs = ProcessList(UnwrapElement, IN[2])
else:
	inputdocs = [UnwrapElement(IN[2])]
	
#Part of script from Clockwork
for inputdoc in inputdocs :
	if inputdoc == None:
		doc = DocumentManager.Instance.CurrentDBDocument
	elif inputdoc.GetType().ToString() == "Autodesk.Revit.DB.Document":
		doc = inputdoc
	elif inputdoc.GetType().ToString() == "Autodesk.Revit.DB.RevitLinkInstance":
		doc = inputdoc.GetLinkDocument()
	else: doc = None

catlist = []
for cat in cats:
	catlist.append(cat.Id)
filtercats = List[ElementId](catlist)
catfilter = ElementMulticategoryFilter(filtercats)

def collectElementsInBB(bb):
	outline = Outline(bb.Min, bb.Max)
	bbfilter = BoundingBoxIntersectsFilter(outline)
	andfilter = LogicalAndFilter(catfilter,bbfilter)
	collector = FilteredElementCollector(doc).WherePasses(andfilter)
	return [e.ToDSType(True) for e in collector]

OUT = ProcessList(collectElementsInBB, bblist)[0]
# ----------------------------------------
views_3 = Views("geo_Ele")
categories_5 = Categories("OST_Floors")
selectByCategoryInHostView = Custom[SelectByCategoryInHostView](view=views_3, category=categories_5)  # package Genius Loci; Collects the elements of the given document by category and host view (3D view, Plan View or Section View). The transform CS is returned only with a LinkInstance input.
boolean_4 = BoolSelector(false)  # frozen
select_faces_pickobject = Python(IN[0]=boolean_4)  # IronPython2
# ---------- select_faces_pickobject.python (28 lines) ----------
import clr

clr.AddReference('RevitAPI')
from Autodesk.Revit.DB import*
clr.AddReference('RevitServices')
from RevitServices.Persistence import DocumentManager
clr.AddReference('RevitNodes')
import Revit
clr.AddReference('RevitAPIUI')
from Autodesk.Revit.UI.Selection import ObjectType
clr.ImportExtensions(Revit.Elements)
clr.ImportExtensions(Revit.GeometryConversion)

doc = DocumentManager.Instance.CurrentDBDocument
uidoc = DocumentManager.Instance.CurrentUIApplication.ActiveUIDocument
faces = []
dsfaces = []

faces.append(uidoc.Selection.PickObjects(ObjectType.Face,'Select Faces'))
for f in faces:
	for r in f:
		e = uidoc.Document.GetElement(r)
		dsface = e.GetGeometryObjectFromReference(r).ToProtoType(True)
		[f.Tags.AddTag("RevitFaceReference", r) for f in dsface]
		dsfaces.append(dsface)

		
OUT = dsfaces
# ----------------------------------------

# group: Data-Shapes
boolean_5 = BoolSelector(false)
select_point_on_element = Custom[Select Point on Element](Refresh=boolean_5)  # frozen; package Genius Loci; Select the point(s) on the face(s) and get the reference(s).
boolean_6 = BoolSelector(false)
select_point_s_pickobject = Python(IN[0]=boolean_6)  # IronPython2; frozen
# ---------- select_point_s_pickobject.python (25 lines) ----------
import clr
clr.AddReference('RevitServices')
import RevitServices
from RevitServices.Persistence import DocumentManager
doc = DocumentManager.Instance.CurrentDBDocument
uiapp = DocumentManager.Instance.CurrentUIApplication

clr.AddReference('RevitAPIUI')
from Autodesk.Revit.UI.Selection import ObjectType

# Import ToDSType  (bool) extension method
clr.AddReference("RevitNodes")
import Revit
# Adds ToProtoType, ToRevitType geometry conversion extension methods to objects
clr.ImportExtensions(Revit.GeometryConversion)

pickedRef,coords=[],[]

sel = uiapp.ActiveUIDocument.Selection
pickedRef=sel.PickObjects(ObjectType.PointOnElement, "Select Points on Face")

for ref in pickedRef :
	coords.append(ref.GlobalPoint.ToPoint())

OUT = coords,pickedRef
# ----------------------------------------
code_block = CodeBlock(x=select_point_s_pickobject) { x[0]; x[1]; }
code_block_2 = CodeBlock(Reference=code_block.out1) { Reference; }
code_block_3 = CodeBlock(Point=code_block.out0) { Point; }

# group: Springs
ꟿ_selectfaces = Custom[ꟿ SelectFaces+]()  # package spring nodes
boolean_7 = BoolSelector(true)
python_script = Python(IN[0]=boolean_7)  # IronPython2; frozen
# ---------- python_script.python (43 lines) ----------
#Copyright(c) 2016, Dimitar Venkov
# @5devene, dimitar.ven@gmail.com

import clr

clr.AddReference("RevitAPIUI")
from  Autodesk.Revit.UI import *

clr.AddReference("RevitServices")
import RevitServices
from RevitServices.Persistence import DocumentManager
doc = DocumentManager.Instance.CurrentDBDocument
uidoc=DocumentManager.Instance.CurrentUIApplication.ActiveUIDocument

clr.AddReference("RevitNodes")
import Revit
clr.ImportExtensions(Revit.Elements)
clr.ImportExtensions(Revit.GeometryConversion)

clr.AddReference('RevitAPI')
from Autodesk.Revit.DB import *

def output1(x):
	if len(x) == 1: return x[0]
	else : return x

surfaces, gpoints = [], []
sel1 = uidoc.Selection
ot1 = Selection.ObjectType.Face
ref_list = sel1.PickObjects(ot1, "Select the faces and press Finish.")
for ref in ref_list:
	el1 = doc.GetElement(ref.ElementId)
	sf0 = el1.GetGeometryObjectFromReference(ref)
	if isinstance(el1, FamilyInstance):
		tf1 = el1.GetTransform().ToCoordinateSystem()
		sf1 = sf0.Convert(ref, tf1)
	else:
		sf1 = sf0.ToProtoType(True)
	for i in sf1: i.Tags.AddTag("RevitFaceReference", ref)
	surfaces.append(output1(sf1) )
	gpoints.append(ref.GlobalPoint.ToPoint(True) )

OUT = output1(surfaces), output1(gpoints)
# ----------------------------------------
code_block_4 = CodeBlock(r=python_script) { r[0]; r[1]; }
code_block_5 = CodeBlock(pickPoints=code_block_4.out1) { pickPoints; }
code_block_6 = CodeBlock(faces=code_block_4.out0) { faces; }

# group: Select Model Element
select_model_element_2 = DSModelElementSelection()  # 1 picked in the model; graph input
boolean_8 = BoolSelector(false)  # frozen
select_model_element_3 = Python(IN[0]=boolean_8)  # IronPython2
# ---------- select_model_element_3.python (28 lines) ----------
import clr
clr.AddReference('RevitAPI')
import Autodesk
from Autodesk.Revit.DB import *

clr.AddReference("RevitServices")
import RevitServices
from RevitServices.Persistence import DocumentManager

clr.AddReference("RevitAPIUI")
from  Autodesk.Revit.UI import *

clr.AddReference("RevitNodes")
import Revit
clr.ImportExtensions(Revit.GeometryConversion)



doc = DocumentManager.Instance.CurrentDBDocument
uidoc=DocumentManager.Instance.CurrentUIApplication.ActiveUIDocument

sel  = uidoc.Selection

obType = Selection.ObjectType.Element
ref = sel.PickObject(obType, "🐶🐶🐶 Please!!!Seclect Model Elemnets.🐶🐶🐶🐶 ")
element = doc.GetElement(ref.ElementId)

OUT = element
# ----------------------------------------
isolateelements_elementes = Python(IN[1]=select_model_element_3)  # CPython3; unwired: IN[0]
# ---------- isolateelements_elementes.python (48 lines) ----------
import clr
import System
 
clr.AddReference("RevitServices")
import RevitServices
from RevitServices.Persistence import DocumentManager
from RevitServices.Transactions import TransactionManager

clr.AddReference("RevitNodes")
import Revit
clr.ImportExtensions(Revit.Elements)
clr.ImportExtensions(Revit.GeometryConversion)

clr.AddReference("RevitAPIUI")
from Autodesk.Revit.UI import*
clr.AddReference('RevitAPIUI')
from Autodesk.Revit.UI import Selection
from  Autodesk.Revit.UI.Selection import ISelectionFilter

clr.AddReference('RevitAPI')
from Autodesk.Revit.DB import*

from System.Collections.Generic import*

#########################################################################
doc = DocumentManager.Instance.CurrentDBDocument
view = doc.ActiveView
uidoc = DocumentManager.Instance.CurrentUIApplication.ActiveUIDocument
################################################################
def isolateElements(elements):
    try:
        TransactionManager.Instance.EnsureInTransaction(doc)
        reset = view.DisableTemporaryViewMode(TemporaryViewMode.TemporaryHideIsolate)
        ids = List[ElementId]()
        for i in elements:
            ids.Add(i.Id)
        view.IsolateElementsTemporary(ids)
        return ids
        TransactionManager.Instance.TransactionTaskDone()
    except Exception as e:
        TransactionManager.Instance.ForceCloseTransaction()
        return "An error occurred: " + str(e)

################################################################
elements = UnwrapElement(IN[1]) if isinstance(IN[1],list) else [UnwrapElement(IN[1])]


OUT = isolateElements(elements)
# ----------------------------------------

# group: Select Face/Faces
select_face = DSFaceSelection()  # 1 picked in the model
select_faces_2 = SelectFaces()  # 2 picked in the model
boolean_9 = BoolSelector(true)  # frozen
select_face_2 = Python(IN[0]=boolean_9)  # IronPython2
# ---------- select_face_2.python (23 lines) ----------
import clr

clr.AddReference('RevitAPI')
from Autodesk.Revit.DB import*
clr.AddReference('RevitServices')
from RevitServices.Persistence import DocumentManager
clr.AddReference('RevitNodes')
import Revit
clr.AddReference('RevitAPIUI')
from Autodesk.Revit.UI.Selection import ObjectType
clr.ImportExtensions(Revit.Elements)
clr.ImportExtensions(Revit.GeometryConversion)

doc = DocumentManager.Instance.CurrentDBDocument
uidoc = DocumentManager.Instance.CurrentUIApplication.ActiveUIDocument

dsfaces = []

f = uidoc.Selection.PickObject(ObjectType.Face,'Select Faces')
e = uidoc.Document.GetElement(f.ElementId)
dsface = e.GetGeometryObjectFromReference(f)
plane = dsface.GetSurface()
OUT = plane
# ----------------------------------------
toplane_level_3 = Python(IN[0]=select_face_2)  # IronPython2
# ---------- toplane_level_3.python (43 lines) ----------
"""Copyright by: duengocnguyen@gmail.com"""
import clr 
import sys
sys.path.append(r'C:\Program Files\Autodesk\Revit 2020\AddIns\DynamoForRevit\IronPython.StdLib.2.7.8')
import math 
from System.Collections.Generic import *

clr.AddReference("ProtoGeometry")
from Autodesk.DesignScript.Geometry import *

clr.AddReference('RevitAPI')
import Autodesk
from Autodesk.Revit.DB import *

clr.AddReference('RevitAPIUI')
from Autodesk.Revit.UI import*
from  Autodesk.Revit.UI.Selection import*

clr.AddReference("RevitNodes")
import Revit
clr.ImportExtensions(Revit.Elements)
clr.ImportExtensions(Revit.GeometryConversion)

clr.AddReference("RevitServices")
import RevitServices
from RevitServices.Persistence import DocumentManager
from RevitServices.Transactions import TransactionManager

doc = DocumentManager.Instance.CurrentDBDocument
view = doc.ActiveView
uidoc = DocumentManager.Instance.CurrentUIApplication.ActiveUIDocument

#Preparing input from dynamo to revit
element = UnwrapElement(IN[0])

#Do some action in a Transaction
#TransactionManager.Instance.EnsureInTransaction(doc)
"""Now, You Can Code """



#TransactionManager.Instance.TransactionTaskDone()
OUT = [i.ToPlane() for i in [IN[0]]]
# ----------------------------------------
boolean_10 = BoolSelector(true)  # frozen
getedgesascurveloops_by = Python(IN[0]=boolean_10)  # "GetEdgesAsCurveLoops by Planarfaces"; IronPython2
# ---------- getedgesascurveloops_by.python (41 lines) ----------
"""Copyright(c) 2019 by: duengocnguyen@gmail.com"""

import clr 
import sys
sys.path.append(r'C:\Program Files\Autodesk\Revit 2020\AddIns\DynamoForRevit\IronPython.StdLib.2.7.8')
import math 
from System.Collections.Generic import *

clr.AddReference("ProtoGeometry")
from Autodesk.DesignScript.Geometry import *

clr.AddReference('RevitAPI')
import Autodesk
from Autodesk.Revit.DB import *

clr.AddReference('RevitAPIUI')
from Autodesk.Revit.UI import*
from  Autodesk.Revit.UI.Selection import*

clr.AddReference("RevitNodes")
import Revit
clr.ImportExtensions(Revit.Elements)
clr.ImportExtensions(Revit.GeometryConversion)

clr.AddReference("RevitServices")
import RevitServices
from RevitServices.Persistence import DocumentManager
from RevitServices.Transactions import TransactionManager

doc = DocumentManager.Instance.CurrentDBDocument
view = doc.ActiveView
uidoc = DocumentManager.Instance.CurrentUIApplication.ActiveUIDocument

ref = uidoc.Selection.PickObjects(ObjectType.Face, 'Select Face')
re = []
for i in ref:
	e = uidoc.Document.GetElement(i.ElementId)
	retri_Ele= e.GetGeometryObjectFromReference(i)
	re.append(retri_Ele.GetEdgesAsCurveLoops())
	
OUT = re
# ----------------------------------------
toprototype_level3 = Python(IN[1]=getedgesascurveloops_by)  # IronPython2; unwired: IN[0]
# ---------- toprototype_level3.python (43 lines) ----------
"""Copyright(c) 2019 by: duengocnguyen@gmail.com"""

import clr 
import sys
sys.path.append(r'C:\Program Files\Autodesk\Revit 2020\AddIns\DynamoForRevit\IronPython.StdLib.2.7.8')
import math 
from System.Collections.Generic import *

clr.AddReference("ProtoGeometry")
from Autodesk.DesignScript.Geometry import *

clr.AddReference('RevitAPI')
import Autodesk
from Autodesk.Revit.DB import *

clr.AddReference('RevitAPIUI')
from Autodesk.Revit.UI import*
from  Autodesk.Revit.UI.Selection import*

clr.AddReference("RevitNodes")
import Revit
clr.ImportExtensions(Revit.Elements)
clr.ImportExtensions(Revit.GeometryConversion)

clr.AddReference("RevitServices")
import RevitServices
from RevitServices.Persistence import DocumentManager
from RevitServices.Transactions import TransactionManager

doc = DocumentManager.Instance.CurrentDBDocument
view = doc.ActiveView
uidoc = DocumentManager.Instance.CurrentUIApplication.ActiveUIDocument

#Preparing input from dynamo to revit
element = UnwrapElement(IN[0])

#Do some action in a Transaction
#TransactionManager.Instance.EnsureInTransaction(doc)
"""Now, You Can Code """


OUT = [j.ToProtoType() for i in IN[1] for j in i]
#TransactionManager.Instance.TransactionTaskDone()
# ----------------------------------------
toprototype_level4 = Python(IN[1]=getedgesascurveloops_by)  # IronPython2; unwired: IN[0]
# ---------- toprototype_level4.python (43 lines) ----------
"""Copyright(c) 2019 by: duengocnguyen@gmail.com"""

import clr 
import sys
sys.path.append(r'C:\Program Files\Autodesk\Revit 2020\AddIns\DynamoForRevit\IronPython.StdLib.2.7.8')
import math 
from System.Collections.Generic import *

clr.AddReference("ProtoGeometry")
from Autodesk.DesignScript.Geometry import *

clr.AddReference('RevitAPI')
import Autodesk
from Autodesk.Revit.DB import *

clr.AddReference('RevitAPIUI')
from Autodesk.Revit.UI import*
from  Autodesk.Revit.UI.Selection import*

clr.AddReference("RevitNodes")
import Revit
clr.ImportExtensions(Revit.Elements)
clr.ImportExtensions(Revit.GeometryConversion)

clr.AddReference("RevitServices")
import RevitServices
from RevitServices.Persistence import DocumentManager
from RevitServices.Transactions import TransactionManager

doc = DocumentManager.Instance.CurrentDBDocument
view = doc.ActiveView
uidoc = DocumentManager.Instance.CurrentUIApplication.ActiveUIDocument

#Preparing input from dynamo to revit
element = UnwrapElement(IN[0])

#Do some action in a Transaction
#TransactionManager.Instance.EnsureInTransaction(doc)
"""Now, You Can Code """


OUT = [t.ToProtoType() for i in IN[1] for j in i for t in j]
#TransactionManager.Instance.TransactionTaskDone()
# ----------------------------------------
boolean_11 = BoolSelector(true)  # frozen
select_faces_3 = Python(IN[0]=boolean_11)  # IronPython2
# ---------- select_faces_3.python (28 lines) ----------
import clr

clr.AddReference('RevitAPI')
from Autodesk.Revit.DB import*
clr.AddReference('RevitServices')
from RevitServices.Persistence import DocumentManager
clr.AddReference('RevitNodes')
import Revit
clr.AddReference('RevitAPIUI')
from Autodesk.Revit.UI.Selection import ObjectType
clr.ImportExtensions(Revit.Elements)
clr.ImportExtensions(Revit.GeometryConversion)

doc = DocumentManager.Instance.CurrentDBDocument
uidoc = DocumentManager.Instance.CurrentUIApplication.ActiveUIDocument


faces = []
dsfaces = []

faces.append(uidoc.Selection.PickObjects(ObjectType.Face,'Select Faces'))

for f in faces:
	for r in f:
		e = uidoc.Document.GetElement(r)
		dsface = e.GetGeometryObjectFromReference(r).ToProtoType(True)
		dsfaces.append(dsface) 
OUT = dsfaces
# ----------------------------------------
python_script_2 = Python(IN[1]=select_faces_3)  # CPython3; unwired: IN[0]
# ---------- python_script_2.python (8 lines) ----------
objects = IN[1]

re = []
for obj in objects:
    for item in obj:
        re.append(item)

OUT = re
# ----------------------------------------
flatten = List.Flatten(list=select_faces_3)

# group: Pick Point
boolean_12 = BoolSelector(true)  # frozen
pick_point = Python(IN[0]=boolean_12)  # IronPython2
# ---------- pick_point.python (36 lines) ----------
"""Copyright(c) 2019 by: duengocnguyen@gmail.com"""
import clr
clr.AddReference('RevitAPI')
import Autodesk
from Autodesk.Revit.DB import *

clr.AddReference("RevitServices")
import RevitServices
from RevitServices.Persistence import DocumentManager

clr.AddReference("RevitAPIUI")
from  Autodesk.Revit.UI import *

clr.AddReference('ProtoGeometry')
from Autodesk.DesignScript.Geometry import *

clr.AddReference('DSCoreNodes') 
import DSCore
from DSCore import *

clr.AddReference("RevitNodes")
import Revit
clr.ImportExtensions(Revit.Elements)
clr.ImportExtensions(Revit.GeometryConversion)

doc = DocumentManager.Instance.CurrentDBDocument
uidoc=DocumentManager.Instance.CurrentUIApplication.ActiveUIDocument

# ObjectSnapTypes.Endpoint.Intersections : Bắt điểm cuối và điểm giao


point = uidoc.Selection.PickPoint(Selection.ObjectSnapTypes.Endpoints.Intersections,"🐶🐶🐶 Please!!! Pick Point Endpoint or Intersections: 🐶🐶🐶🐶 ")

  
 
OUT = point.ToPoint()
# ----------------------------------------
watch_2 = Watch(pick_point)
boolean_13 = BoolSelector(true)
pick_point_2 = Python(IN[0]=boolean_13)  # IronPython2; frozen
# ---------- pick_point_2.python (122 lines) ----------
"""Copyright(c) 2019 by: duengocnguyen@gmail.com"""
import clr
import sys
clr.AddReference('RevitAPI')
from Autodesk.Revit.DB import *

clr.AddReference('RevitAPIUI')
from Autodesk.Revit.UI import Selection
from  Autodesk.Revit.UI.Selection import ISelectionFilter

clr.AddReference("ProtoGeometry")
from Autodesk.DesignScript.Geometry import*

clr.AddReference('RevitNodes')
import Revit
clr.ImportExtensions(Revit.Elements)
clr.ImportExtensions(Revit.GeometryConversion)

clr.AddReference('RevitServices')
from RevitServices.Persistence import DocumentManager

clr.AddReference('DSCoreNodes')
from DSCore import *
clr.AddReference('System.Windows.Forms')
clr.AddReference('System.Drawing')

import System.Drawing
import System.Windows.Forms

from System.Drawing import *
from System.Windows.Forms import *
doc = DocumentManager.Instance.CurrentDBDocument
uidoc = DocumentManager.Instance.CurrentUIApplication.ActiveUIDocument
UIunit = Document.GetUnits(doc).GetFormatOptions(UnitType.UT_Length).DisplayUnits
class MainForm(Form):
	def __init__(self):
		self.InitializeComponent()
	
	def InitializeComponent(self):
		self._groupBox1 = System.Windows.Forms.GroupBox()
		self._btnPickPoint = System.Windows.Forms.Button()
		self._btnOK = System.Windows.Forms.Button()
		self._btnCancel = System.Windows.Forms.Button()
		self._groupBox1.SuspendLayout()
		self.SuspendLayout()
		# 
		# groupBox1
		# 
		self._groupBox1.Controls.Add(self._btnPickPoint)
		self._groupBox1.Location = System.Drawing.Point(3, 1)
		self._groupBox1.Name = "groupBox1"
		self._groupBox1.Size = System.Drawing.Size(310, 69)
		self._groupBox1.TabIndex = 0
		self._groupBox1.TabStop = False
		self._groupBox1.Text = "PickPoint Selection"
		# 
		# btnPickPoint
		# 
		self._btnPickPoint.Location = System.Drawing.Point(93, 28)
		self._btnPickPoint.Name = "btnPickPoint"
		self._btnPickPoint.Size = System.Drawing.Size(130, 23)
		self._btnPickPoint.TabIndex = 0
		self._btnPickPoint.Text = "Pick Point"
		self._btnPickPoint.UseVisualStyleBackColor = True
		self._btnPickPoint.Click += self.BtnPickPointClick
		# 
		# btnOK
		# 
		self._btnOK.Location = System.Drawing.Point(58, 78)
		self._btnOK.Name = "btnOK"
		self._btnOK.Size = System.Drawing.Size(75, 23)
		self._btnOK.TabIndex = 1
		self._btnOK.Text = "OK"
		self._btnOK.UseVisualStyleBackColor = True
		self._btnOK.Click += self.BtnOKClick
		# 
		# btnCancel
		# 
		self._btnCancel.Location = System.Drawing.Point(193, 78)
		self._btnCancel.Name = "btnCancel"
		self._btnCancel.Size = System.Drawing.Size(75, 23)
		self._btnCancel.TabIndex = 2
		self._btnCancel.Text = "Cancel"
		self._btnCancel.UseVisualStyleBackColor = True
		self._btnCancel.Click += self.BtnCancelClick
		# 
		# MainForm
		# 
		self.BackColor = System.Drawing.SystemColors.ControlLightLight
		self.ClientSize = System.Drawing.Size(321, 109)
		self.Controls.Add(self._btnCancel)
		self.Controls.Add(self._btnOK)
		self.Controls.Add(self._groupBox1)
		self.MaximizeBox = False
		self.Name = "MainForm"
		self.ShowIcon = False
		self.SizeGripStyle = System.Windows.Forms.SizeGripStyle.Hide
		self.StartPosition = System.Windows.Forms.FormStartPosition.CenterParent
		self.Text = "MethodSelections"
		self.TopMost = True
		self._groupBox1.ResumeLayout(False)
		self.ResumeLayout(False)
		self.out = []
		self.point = []
	def BtnPickPointClick(self, sender, e):
		pts = uidoc.Selection.PickPoint()
		self.point = XYZ(UnitUtils.ConvertToInternalUnits(pts.X,UIunit),
		UnitUtils.ConvertToInternalUnits(pts.Y,UIunit),
		UnitUtils.ConvertToInternalUnits(pts.Z,UIunit))
		pass

	def BtnOKClick(self, sender, e):
		self.Close()
		pass

	def BtnCancelClick(self, sender, e):
		self.point =[]
		self.Close()
		pass
form = MainForm()
Application.Run(form)
OUT = form.point
# ----------------------------------------

boolean_14 = BoolSelector(false)
categories_6 = Categories("OST_Walls")
select_model_categories = Python(IN[0]=boolean_14, IN[1]=categories_6)  # IronPython2; frozen
# ---------- select_model_categories.python (52 lines) ----------
import clr
clr.AddReference('RevitAPI')
import Autodesk
from Autodesk.Revit.DB import *

clr.AddReference("RevitServices")
import RevitServices
from RevitServices.Persistence import DocumentManager

clr.AddReference("RevitAPIUI")
from  Autodesk.Revit.UI import *

clr.AddReference('ProtoGeometry')
from Autodesk.DesignScript.Geometry import *

clr.AddReference('DSCoreNodes') 
import DSCore
from DSCore import *

clr.AddReference("RevitNodes")
import Revit
clr.ImportExtensions(Revit.Elements)
clr.ImportExtensions(Revit.GeometryConversion)

doc = DocumentManager.Instance.CurrentDBDocument
uidoc=DocumentManager.Instance.CurrentUIApplication.ActiveUIDocument

class CustomISelectionFilter(Selection.ISelectionFilter):
	def __init__(self,x):
		self.x = x
	def AllowElement(slef,e)
		if e.Category.Name in self.x
			return True
		else:
			return False
			


dataEnteringnode = IN
cat = UnwrapElement(IN[1])

result  = []

list = uidoc.Selection.PickOjects(Slection.OjectType.Element,CustomISelectionFilter(cat.Name),"🐶🐶🐶 Please!!! Selection Model Elements 🐶🐶🐶🐶 ")


for r in list:
	element = doc.GetElement(r.ElementId)
	result.Add(element.ToDSType(True))


OUT = result
# ----------------------------------------

# group: Select Model Elements
select_model_elements = DSModelElementsSelection()  # 364 picked in the model
boolean_15 = BoolSelector(false)
select_model_elements_2 = Python(IN[0]=boolean_15)  # IronPython2; frozen
# ---------- select_model_elements_2.python (28 lines) ----------
import clr
clr.AddReference('RevitAPI')
import Autodesk
from Autodesk.Revit.DB import *

clr.AddReference("RevitServices")
import RevitServices
from RevitServices.Persistence import DocumentManager

clr.AddReference("RevitAPIUI")
from  Autodesk.Revit.UI import *

clr.AddReference("RevitNodes")
import Revit
clr.ImportExtensions(Revit.Elements)

doc = DocumentManager.Instance.CurrentDBDocument
uidoc=DocumentManager.Instance.CurrentUIApplication.ActiveUIDocument

obType = Selection.ObjectType.Element
refs = uidoc.Selection.PickObjects(obType, "🐶🐶🐶 Please!!!Seclect Model Elemnets.🐶🐶🐶🐶 ")
result = []
for ref in refs:
	element = doc.GetElement(ref.ElementId)
	result.Add(element.ToDSType(True))
	
	
OUT = result
# ----------------------------------------
isolateelements_elementes_2 = Python(IN[1]=select_model_elements_2)  # CPython3; unwired: IN[0]
# ---------- isolateelements_elementes_2.python (46 lines) ----------
import clr
import System
 
clr.AddReference("RevitServices")
import RevitServices
from RevitServices.Persistence import DocumentManager
from RevitServices.Transactions import TransactionManager

clr.AddReference("RevitNodes")
import Revit
clr.ImportExtensions(Revit.Elements)
clr.ImportExtensions(Revit.GeometryConversion)

clr.AddReference("RevitAPIUI")
from Autodesk.Revit.UI import*
clr.AddReference('RevitAPIUI')
from Autodesk.Revit.UI import Selection
from  Autodesk.Revit.UI.Selection import ISelectionFilter

clr.AddReference('RevitAPI')
from Autodesk.Revit.DB import*

from System.Collections.Generic import*

#########################################################################
doc = DocumentManager.Instance.CurrentDBDocument
view = doc.ActiveView
uidoc = DocumentManager.Instance.CurrentUIApplication.ActiveUIDocument
################################################################
def isolateElements(elements):
    try:
        TransactionManager.Instance.EnsureInTransaction(doc)
        reset = view.DisableTemporaryViewMode(TemporaryViewMode.TemporaryHideIsolate)
        ids = List[ElementId]()
        for i in elements:
            ids.Add(i.Id)
        view.IsolateElementsTemporary(ids)
        return ids
        TransactionManager.Instance.TransactionTaskDone()
    except Exception as e:
        TransactionManager.Instance.ForceCloseTransaction()
        return "An error occurred: " + str(e)

################################################################
selectedEles = UnwrapElement(IN[1])
OUT = isolateElements(selectedEles)
# ----------------------------------------

# group: class SelectionFilter(ISelectionFilter)
all_elements_of_categories_in = Python()  # "All Elements Of Categories in View"; IronPython2; frozen; unwired: IN[0], IN[1]
# ---------- all_elements_of_categories_in.python (38 lines) ----------
#Copyright (c) mostafa el ayoubi
#Data-Shapes www.data-shapes.net 2019 mostafa.elayoubi@data-shapes.io

import clr
clr.AddReference('RevitAPI')
from Autodesk.Revit.DB import*

clr.AddReference('ProtoGeometry')
from Autodesk.DesignScript.Geometry import *

clr.AddReference('RevitServices')
from RevitServices.Persistence import DocumentManager

import System
from System.Collections.Generic import*

doc = DocumentManager.Instance.CurrentDBDocument

def tolist(input):
	if isinstance(input,list):
		return input
	else:
		return [input]


view = UnwrapElement(IN[0])

categories = tolist(IN[1])
catfilters = []

for i in categories:
	catfilters.append(ElementCategoryFilter(System.Enum.ToObject(BuiltInCategory, int(str(i.Id)))))
catfilterlist = List[ElementFilter](catfilters)
filter = LogicalOrFilter(catfilterlist)

elems = FilteredElementCollector(doc,view.Id).WherePasses(filter).ToElements()

OUT = elems
# ----------------------------------------
boolean_16 = BoolSelector(true)
filterCatergories = Python(IN[0]=boolean_16)  # IronPython2; frozen
# ---------- filterCatergories.python (28 lines) ----------
import clr
clr.AddReference('RevitAPI')
from Autodesk.Revit.DB import *

clr.AddReference("RevitNodes")
import Revit
clr.ImportExtensions(Revit.Elements)
clr.ImportExtensions(Revit.GeometryConversion)

clr.AddReference("RevitServices")
import RevitServices
from RevitServices.Persistence import DocumentManager
from RevitServices.Transactions import TransactionManager

doc = DocumentManager.Instance.CurrentDBDocument
categories = doc.Settings.Categories

mdlcat = []
typecat = []
emp = []
for i in categories:
	typecat.append(i.CategoryType)
	if i.CategoryType == CategoryType.Model:
		mdlcat.append(Revit.Elements.Category.ById(i.Id.IntegerValue))
	else:
		emp.append(())

OUT = mdlcat
# ----------------------------------------
boolean_17 = BoolSelector(true)
categories_7 = Categories("OST_StructuralFraming")
winform_select_by_category = Python(IN[0]=boolean_17, IN[1]=categories_7)  # IronPython2; frozen
# ---------- winform_select_by_category.python (136 lines) ----------
#Copyright(c) 2018 pvnhinh92@gmail.com

import clr
import sys

clr.AddReference('RevitAPI')
from Autodesk.Revit.DB import *

clr.AddReference('RevitAPIUI')
from Autodesk.Revit.UI import Selection
from  Autodesk.Revit.UI.Selection import ISelectionFilter

clr.AddReference('RevitNodes')
import Revit
clr.ImportExtensions(Revit.Elements)
clr.ImportExtensions(Revit.GeometryConversion)

clr.AddReference('RevitServices')
from RevitServices.Persistence import DocumentManager

clr.AddReference('DSCoreNodes')
from DSCore import *
doc = DocumentManager.Instance.CurrentDBDocument
uidoc = DocumentManager.Instance.CurrentUIApplication.ActiveUIDocument


clr.AddReference('System.Windows.Forms')
clr.AddReference('System.Drawing')
clr.AddReference('System.Windows.Forms.DataVisualization')

import System.Windows.Forms
import System.Drawing

from System.Drawing import *
from System.Windows.Forms import *
from System.Collections.Generic import *

class selectionfilter(ISelectionFilter):
	def __init__(self,category):
		self.category = category
	def AllowElement(self,element):
		if element.Category.Name in [c.Name for c in self.category]:
			return True
		else:
			return False
	def AllowReference(reference,point):
		return False
	
class MainForm(Form):
	def __init__(self):
		self.InitializeComponent()
	
	def InitializeComponent(self):

		self.El =()


		self._selec = System.Windows.Forms.Button()
		self._button1 = System.Windows.Forms.Button()
		self._button2 = System.Windows.Forms.Button()
		self.SuspendLayout()
		# 
		# selec
		# 
		self._selec.Cursor = System.Windows.Forms.Cursors.Hand
		self._selec.Location = System.Drawing.Point(48, 12)
		self._selec.Name = "selec"
		self._selec.Size = System.Drawing.Size(173, 36)
		self._selec.TabIndex = 1
		self._selec.Text = "Select Model Elements"
		self._selec.UseVisualStyleBackColor = True
		self._selec.Click += self.sele
		# 
		# button1
		# 
		self._button1.Cursor = System.Windows.Forms.Cursors.Hand
		self._button1.Location = System.Drawing.Point(32, 71)
		self._button1.Name = "button1"
		self._button1.Size = System.Drawing.Size(73, 23)
		self._button1.TabIndex = 2
		self._button1.Text = "OK"
		self._button1.UseVisualStyleBackColor = True
		self._button1.Click += self.ok
		# 
		# button2
		# 
		self._button2.Cursor = System.Windows.Forms.Cursors.Hand
		self._button2.Location = System.Drawing.Point(164, 71)
		self._button2.Name = "button2"
		self._button2.Size = System.Drawing.Size(73, 23)
		self._button2.TabIndex = 3
		self._button2.Text = "Cancel"
		self._button2.UseVisualStyleBackColor = True
		self._button2.Click += self.close
		# 
		# MainForm
		# 
		self.AutoScaleDimensions = System.Drawing.SizeF(6, 13)
		self.AutoScaleMode = System.Windows.Forms.AutoScaleMode.Font
		self.AutoSizeMode = System.Windows.Forms.AutoSizeMode.GrowAndShrink
		self.AutoValidate = System.Windows.Forms.AutoValidate.EnablePreventFocusChange
		self.CausesValidation = False
		self.ClientSize = System.Drawing.Size(275, 106)
		self.Controls.Add(self._button2)
		self.Controls.Add(self._button1)
		self.Controls.Add(self._selec)
		self.MaximizeBox = False
		self.MinimizeBox = False
		self.Name = "MainForm"
		self.ShowIcon = False
		self.StartPosition = System.Windows.Forms.FormStartPosition.CenterScreen
		self.Text = "Select Elements"
		self.TopMost = True
		self.ResumeLayout(False)

	def close(self, sender, e):
		self.Ele=[]
		self.Close()
	def sele(self, sender,e):
		try:
			category = [UnwrapElement(IN[1])]
			selfilt = selectionfilter(category)
			self.El = uidoc.Selection.PickObjects(Selection.ObjectType.Element,selfilt,'abs')
			self.selelem = (doc.GetElement(i.ElementId) for i in self.El)
			self.Ele = (i.ToDSType(True	) for i in self.selelem )
		except:
				pass

	def ok(self,sender, e):
		self.Close()


f = MainForm()
Application.Run(f)

OUT = f.Ele
# ----------------------------------------
boolean_18 = BoolSelector(false)
selectionFilter = Python(IN[0]=boolean_18)  # IronPython2; frozen
# ---------- selectionFilter.python (47 lines) ----------
"""Copyright by: duengocnguyen@gmail.com"""
import clr 
import sys
sys.path.append(r'C:\Program Files\Autodesk\Revit 2020\AddIns\DynamoForRevit\IronPython.StdLib.2.7.8')
import math 
from System.Collections.Generic import *

clr.AddReference("ProtoGeometry")
from Autodesk.DesignScript.Geometry import *

clr.AddReference('RevitAPI')
import Autodesk
from Autodesk.Revit.DB import *

clr.AddReference('RevitAPIUI')
from Autodesk.Revit.UI import*
from  Autodesk.Revit.UI.Selection import*

clr.AddReference("RevitNodes")
import Revit
clr.ImportExtensions(Revit.Elements)
clr.ImportExtensions(Revit.GeometryConversion)

clr.AddReference("RevitServices")
import RevitServices
from RevitServices.Persistence import DocumentManager
from RevitServices.Transactions import TransactionManager

doc = DocumentManager.Instance.CurrentDBDocument
view = doc.ActiveView
uidoc = DocumentManager.Instance.CurrentUIApplication.ActiveUIDocument

class SelectionFilter(ISelectionFilter):
	def __init__(self, ctgName):
		self.ctgName = ctgName
	def AllowElement(self, element):
		if element.Category.Name == self.ctgName:
			return True
		else:
			return False
	def AllowReference(ref, xyZ):
		return False

selection_filter = SelectionFilter("Structural Framing")

ele = uidoc.Selection.PickElementsByRectangle(selection_filter, "Select")
OUT = ele
# ----------------------------------------
boolean_19 = BoolSelector(false)  # frozen
categories_8 = Categories("OST_StructuralColumns")
pickobjects_filter_by_categories = Python(IN[0]=boolean_19, IN[1]=categories_8)  # IronPython2
# ---------- pickobjects_filter_by_categories.python (53 lines) ----------
"""Copyright(c) 2019 by: duengocnguyen@gmail.com"""
import clr
import sys

clr.AddReference('RevitAPI')
from Autodesk.Revit.DB import *

clr.AddReference('RevitAPIUI')
from Autodesk.Revit.UI import Selection
from  Autodesk.Revit.UI.Selection import ISelectionFilter

clr.AddReference('RevitNodes')
import Revit
clr.ImportExtensions(Revit.Elements)
clr.ImportExtensions(Revit.GeometryConversion)

clr.AddReference('RevitServices')
from RevitServices.Persistence import DocumentManager

clr.AddReference('DSCoreNodes')
from DSCore import *
doc = DocumentManager.Instance.CurrentDBDocument
uidoc = DocumentManager.Instance.CurrentUIApplication.ActiveUIDocument

doc = DocumentManager.Instance.CurrentDBDocument
view = doc.ActiveView
uidoc = DocumentManager.Instance.CurrentUIApplication.ActiveUIDocument

#Preparing input from dynamo to revit
#Do some action in a Transaction
#TransactionManager.Instance.EnsureInTransaction(doc)
"""Now, You Can Code """



#TransactionManager.Instance.TransactionTaskDone()
class selectionfilter(ISelectionFilter):
	def __init__(self,category):
		self.category = category
	def AllowElement(self,element):
		if element.Category.Name in [c.Name for c in self.category]:
			return True
		else:
			return False
	def AllowReference(reference,point):
		return False

category = [UnwrapElement(IN[1])]
selfilt = selectionfilter(category)
ele = uidoc.Selection.PickObjects(Selection.ObjectType.Element,selfilt,"Select")
selEle = (doc.GetElement(i.ElementId) for i in ele)
get_Ele = (i.ToDSType(True) for i in selEle)
OUT = get_Ele  
# ----------------------------------------
boolean_20 = BoolSelector(true)
categories_9 = Categories("OST_StructuralFraming")
pickelementsbyrectanglefilter_by = Python(IN[0]=boolean_20, IN[1]=categories_9)  # "PickElementsByRectangleFilter by Categories"; IronPython2; frozen
# ---------- pickelementsbyrectanglefilter_by.python (44 lines) ----------
"""Copyright(c) 2019 by: duengocnguyen@gmail.com"""
import clr
import sys

clr.AddReference('RevitAPI')
from Autodesk.Revit.DB import *

clr.AddReference('RevitAPIUI')
from Autodesk.Revit.UI import Selection
from  Autodesk.Revit.UI.Selection import ISelectionFilter

clr.AddReference('RevitNodes')
import Revit
clr.ImportExtensions(Revit.Elements)
clr.ImportExtensions(Revit.GeometryConversion)

clr.AddReference('RevitServices')
from RevitServices.Persistence import DocumentManager

clr.AddReference('DSCoreNodes')
from DSCore import *
doc = DocumentManager.Instance.CurrentDBDocument
uidoc = DocumentManager.Instance.CurrentUIApplication.ActiveUIDocument

doc = DocumentManager.Instance.CurrentDBDocument
view = doc.ActiveView
uidoc = DocumentManager.Instance.CurrentUIApplication.ActiveUIDocument


class selectionfilter(ISelectionFilter):
	def __init__(self,category):
		self.category = category
	def AllowElement(self,element):
		if element.Category.Name in [c.Name for c in self.category]:
			return True
		else:
			return False
	def AllowReference(reference,point):
		return False

category = [UnwrapElement(IN[1])]
selfilt = selectionfilter(category)
ele = uidoc.Selection.PickElementsByRectangle(selfilt,"Select")
OUT = ele 
# ----------------------------------------
boolean_21 = BoolSelector(false)  # frozen
isolateElementsTemporary = Python(IN[0]=boolean_21)  # IronPython2; frozen; unwired: IN[1]
# ---------- isolateElementsTemporary.python (60 lines) ----------
"""Copyright(c) 2019 by: duengocnguyen@gmail.com"""

import clr 
import sys
sys.path.append(r'C:\Program Files\Autodesk\Revit 2020\AddIns\DynamoForRevit\IronPython.StdLib.2.7.8')
import math 
from System.Collections.Generic import * 

clr.AddReference("ProtoGeometry")
from Autodesk.DesignScript.Geometry import *

clr.AddReference('RevitAPI')
import Autodesk
from Autodesk.Revit.DB import *

clr.AddReference('RevitAPIUI')
from Autodesk.Revit.UI import*
from  Autodesk.Revit.UI.Selection import*

clr.AddReference("RevitNodes")
import Revit
clr.ImportExtensions(Revit.Elements)
clr.ImportExtensions(Revit.GeometryConversion)

clr.AddReference("RevitServices")
import RevitServices
from RevitServices.Persistence import DocumentManager
from RevitServices.Transactions import TransactionManager

doc = DocumentManager.Instance.CurrentDBDocument
view = doc.ActiveView
uidoc = DocumentManager.Instance.CurrentUIApplication.ActiveUIDocument

class selectionfilter(ISelectionFilter):
	def __init__(self, category1,category2,category3):
		self.category1 = category1
		self.category2 = category2
		self.category3 = category3
		

	def AllowElement(self, element):
		if element.Category.Name == self.category1 or element.Category.Name ==self.category2 or element.Category.Name ==self.category3:
			return True
		else:
			return False
	def AllowReference(reference, point):
		return False

ele = selectionfilter("Structural Columns","Structural Framing", "Floors")
ele_All = uidoc.Selection.PickElementsByRectangle(ele, "Selects")

IDS = List[Autodesk.Revit.DB.ElementId]()
for i in ele_All:
    IDS.Add(i.Id)

TransactionManager.Instance.EnsureInTransaction(doc)
isolate_Ele = view.IsolateElementsTemporary(IDS)
TransactionManager.Instance.TransactionTaskDone()

OUT = ele_All
# ----------------------------------------
type = Object.Type(object=isolateElementsTemporary)
boolean_22 = BoolSelector(true)
winform_isolateelementstemporary = Python(IN[0]=boolean_21)  # IronPython2; unwired: IN[1]
# ---------- winform_isolateelementstemporary.python (150 lines) ----------
"""Copyright by: duengocnguyen@gmail.com"""
import clr
import System
 
clr.AddReference("RevitServices")
import RevitServices
from RevitServices.Persistence import DocumentManager
from RevitServices.Transactions import TransactionManager

clr.AddReference("RevitNodes")
import Revit
clr.ImportExtensions(Revit.Elements)
clr.ImportExtensions(Revit.GeometryConversion)

clr.AddReference("RevitAPIUI")
from Autodesk.Revit.UI import*
clr.AddReference('RevitAPIUI')
from Autodesk.Revit.UI import Selection
from  Autodesk.Revit.UI.Selection import ISelectionFilter

clr.AddReference('RevitAPI')
from Autodesk.Revit.DB import*
#########################################################################
clr.AddReference('System.Windows.Forms')
clr.AddReference('System.Drawing')
clr.AddReference('System.Windows.Forms.DataVisualization')
import System.Windows.Forms
import System.Drawing
from System.Windows.Forms import*
from System.Drawing import*
from System.Collections.Generic import*
#########################################################################
doc = DocumentManager.Instance.CurrentDBDocument
View = doc.ActiveView
uidoc = DocumentManager.Instance.CurrentUIApplication.ActiveUIDocument
#########################################################################


class selectionfilter(ISelectionFilter):
	def __init__(self, category1,category2):
		self.category1 = category1
		self.category2 = category2

	def AllowElement(self, element):
		if element.Category.Name == self.category1 or element.Category.Name ==self.category2:
			return True
		else:
			return False
	def AllowReference(reference, point):
		return False

favourrite_categories = ["Structural Framing + Structural Columns","Structural Framing + Structural Foundation",
						"Structural Foundation + Structural Columns"]
def isolate_Element(self,text,nameCate1,nameCate2):
	TransactionManager.Instance.EnsureInTransaction(doc)
	if self._cbbCate.Text == text:
		# reset temporary hide/isolate before filtering elements
		reset = View.DisableTemporaryViewMode(TemporaryViewMode.TemporaryHideIsolate)
		ele = selectionfilter(nameCate1,nameCate2)
		ele_All = uidoc.Selection.PickElementsByRectangle(ele, "Selects")
		IDS = List[ElementId]()
		for i in ele_All:
			IDS.Add(i.Id)
		View.IsolateElementsTemporary(IDS)
	TransactionManager.Instance.TransactionTaskDone()


class MainForm(Form):
	def __init__(self):
		self.InitializeComponent()
	
	def InitializeComponent(self):
		self._groupBox1 = System.Windows.Forms.GroupBox()
		self._label1 = System.Windows.Forms.Label()
		self._cbbCate = System.Windows.Forms.ComboBox()
		self._bttCancel = System.Windows.Forms.Button()
		self._groupBox1.SuspendLayout()
		self.SuspendLayout()
		# 
		# groupBox1
		# 
		self._groupBox1.Controls.Add(self._bttCancel)
		self._groupBox1.Controls.Add(self._cbbCate)
		self._groupBox1.Controls.Add(self._label1)
		self._groupBox1.Location = System.Drawing.Point(12, 6)
		self._groupBox1.Name = "groupBox1"
		self._groupBox1.Size = System.Drawing.Size(532, 50)
		self._groupBox1.TabIndex = 0
		self._groupBox1.TabStop = False
		# 
		# label1
		# 
		self._label1.ImageAlign = System.Drawing.ContentAlignment.MiddleLeft
		self._label1.Location = System.Drawing.Point(15, 16)
		self._label1.Name = "label1"
		self._label1.Size = System.Drawing.Size(158, 23)
		self._label1.TabIndex = 0
		self._label1.Text = "Select Category Of Element:"
		self._label1.TextAlign = System.Drawing.ContentAlignment.MiddleLeft
		# 
		# cbbCate
		# 
		self._cbbCate.FormattingEnabled = True
		self._cbbCate.Location = System.Drawing.Point(161, 18)
		self._cbbCate.Name = "cbbCate"
		self._cbbCate.Size = System.Drawing.Size(275, 21)
		self._cbbCate.TabIndex = 1
		self._cbbCate.SelectedIndexChanged += self.CbbCateSelectedIndexChanged
		self._cbbCate.Items.AddRange(System.Array[System.Object](favourrite_categories))
		# 
		# bttCancel
		# 
		self._bttCancel.BackColor = System.Drawing.Color.Cyan
		self._bttCancel.BackgroundImageLayout = System.Windows.Forms.ImageLayout.Center
		self._bttCancel.Cursor = System.Windows.Forms.Cursors.AppStarting
		self._bttCancel.Location = System.Drawing.Point(442, 18)
		self._bttCancel.Name = "bttCancel"
		self._bttCancel.Size = System.Drawing.Size(75, 23)
		self._bttCancel.TabIndex = 2
		self._bttCancel.Text = "Cancel"
		self._bttCancel.UseVisualStyleBackColor = False
		self._bttCancel.Click += self.BttCancelClick
		# 
		# MainForm
		# 
		self.BackColor = System.Drawing.SystemColors.ButtonHighlight
		self.ClientSize = System.Drawing.Size(550, 70)
		self.Controls.Add(self._groupBox1)
		self.Name = "MainForm"
		self.ShowIcon = False
		self.StartPosition = System.Windows.Forms.FormStartPosition.CenterScreen
		self.Text = "ISOLATE ELEMENT"
		self._groupBox1.ResumeLayout(False)
		self.ResumeLayout(False)


	def CbbCateSelectedIndexChanged(self, sender, e):
		TransactionManager.Instance.EnsureInTransaction(doc)
		#ele_1 = isolate_Element(self,"Structural Framings + Structural Column","Structural Framings","Structural Column")
		self.types = self._cbbCate.SelectedItem	
  		TransactionManager.Instance.TransactionTaskDone()
		self.Close()
		pass
	def BttCancelClick(self, sender, e):
		self.Close()

		pass
f = MainForm()
Application.Run(f)
OUT = f.types
# ----------------------------------------
types = Python(IN[0]=winform_isolateelementstemporary)  # CPython3
# ---------- types.python (3 lines) ----------
strType = IN[0]
types = strType.split('+')
OUT = [t.strip() for t in types]
# ----------------------------------------
python_script_3 = Python(IN[0]=boolean_22, IN[1]=types)  # IronPython2
# ---------- python_script_3.python (51 lines) ----------
"""Copyright by: duengocnguyen@gmail.com"""
import clr 
import sys
sys.path.append(r'C:\Program Files\Autodesk\Revit 2020\AddIns\DynamoForRevit\IronPython.StdLib.2.7.8')
import math 
from System.Collections.Generic import *

clr.AddReference("ProtoGeometry")
from Autodesk.DesignScript.Geometry import *

clr.AddReference('RevitAPI')
import Autodesk
from Autodesk.Revit.DB import *

clr.AddReference('RevitAPIUI')
from Autodesk.Revit.UI import*
from  Autodesk.Revit.UI.Selection import*

clr.AddReference("RevitNodes")
import Revit
clr.ImportExtensions(Revit.Elements)
clr.ImportExtensions(Revit.GeometryConversion)

clr.AddReference("RevitServices")
import RevitServices
from RevitServices.Persistence import DocumentManager
from RevitServices.Transactions import TransactionManager

doc = DocumentManager.Instance.CurrentDBDocument
view = doc.ActiveView
uidoc = DocumentManager.Instance.CurrentUIApplication.ActiveUIDocument

class SelectionFilter(ISelectionFilter):
    def __init__(self, categories):
        self.categories = categories  # Lưu trữ danh sách các danh mục

    def AllowElement(self, element):
        if element.Category.Name in self.categories:
            return True
        else:
            return False

    def AllowReference(self, reference, xyz):
        return False

# Ví dụ sử dụng
categories = IN[1]
ele = SelectionFilter(categories)
elSelectAll = uidoc.Selection.PickElementsByRectangle(ele, "Selects")

OUT = elSelectAll
# ----------------------------------------

# group: Winfrom
boolean_23 = BoolSelector(false)
categories_10 = Categories("OST_StructuralColumns")
winform_pickobjects_element_by = Python(IN[0]=boolean_23, IN[1]=categories_10)  # "Winform + PickObjects+ Element by Catergory"; IronPython2; frozen
# ---------- winform_pickobjects_element_by.python (136 lines) ----------
"""Copyright(c) 2019 by: duengocnguyen@gmail.com"""

import clr
import sys

clr.AddReference('RevitAPI')
from Autodesk.Revit.DB import *

clr.AddReference('RevitAPIUI')
from Autodesk.Revit.UI import Selection
from  Autodesk.Revit.UI.Selection import ISelectionFilter

clr.AddReference('RevitNodes')
import Revit
clr.ImportExtensions(Revit.Elements)
clr.ImportExtensions(Revit.GeometryConversion)

clr.AddReference('RevitServices')
from RevitServices.Persistence import DocumentManager

clr.AddReference('DSCoreNodes')
from DSCore import *
doc = DocumentManager.Instance.CurrentDBDocument
uidoc = DocumentManager.Instance.CurrentUIApplication.ActiveUIDocument


clr.AddReference('System.Windows.Forms')
clr.AddReference('System.Drawing')
clr.AddReference('System.Windows.Forms.DataVisualization')

import System.Windows.Forms
import System.Drawing

from System.Drawing import *
from System.Windows.Forms import *
from System.Collections.Generic import *

class selectionfilter(ISelectionFilter):
	def __init__(self,category):
		self.category = category
	def AllowElement(self,element):
		if element.Category.Name in [c.Name for c in self.category]:
			return True
		else:
			return False
	def AllowReference(reference,point):
		return False
	
class MainForm(Form):
	def __init__(self):
		self.InitializeComponent()
	
	def InitializeComponent(self):

		self.El =()


		self._selec = System.Windows.Forms.Button()
		self._button1 = System.Windows.Forms.Button()
		self._button2 = System.Windows.Forms.Button()
		self.SuspendLayout()
		# 
		# selec
		# 
		self._selec.Cursor = System.Windows.Forms.Cursors.Hand
		self._selec.Location = System.Drawing.Point(48, 12)
		self._selec.Name = "selec"
		self._selec.Size = System.Drawing.Size(173, 36)
		self._selec.TabIndex = 1
		self._selec.Text = "Select Model Elements"
		self._selec.UseVisualStyleBackColor = True
		self._selec.Click += self.sele
		# 
		# button1
		# 
		self._button1.Cursor = System.Windows.Forms.Cursors.Hand
		self._button1.Location = System.Drawing.Point(32, 71)
		self._button1.Name = "button1"
		self._button1.Size = System.Drawing.Size(73, 23)
		self._button1.TabIndex = 2
		self._button1.Text = "OK"
		self._button1.UseVisualStyleBackColor = True
		self._button1.Click += self.ok
		# 
		# button2
		# 
		self._button2.Cursor = System.Windows.Forms.Cursors.Hand
		self._button2.Location = System.Drawing.Point(164, 71)
		self._button2.Name = "button2"
		self._button2.Size = System.Drawing.Size(73, 23)
		self._button2.TabIndex = 3
		self._button2.Text = "Cancel"
		self._button2.UseVisualStyleBackColor = True
		self._button2.Click += self.close
		# 
		# MainForm
		# 
		self.AutoScaleDimensions = System.Drawing.SizeF(6, 13)
		self.AutoScaleMode = System.Windows.Forms.AutoScaleMode.Font
		self.AutoSizeMode = System.Windows.Forms.AutoSizeMode.GrowAndShrink
		self.AutoValidate = System.Windows.Forms.AutoValidate.EnablePreventFocusChange
		self.CausesValidation = False
		self.ClientSize = System.Drawing.Size(275, 106)
		self.Controls.Add(self._button2)
		self.Controls.Add(self._button1)
		self.Controls.Add(self._selec)
		self.MaximizeBox = False
		self.MinimizeBox = False
		self.Name = "MainForm"
		self.ShowIcon = False
		self.StartPosition = System.Windows.Forms.FormStartPosition.CenterScreen
		self.Text = "Select Elements"
		self.TopMost = True
		self.ResumeLayout(False)

	def close(self, sender, e):
		self.Ele=[]
		self.Close()
	def sele(self, sender,e):
		try:
			category = [UnwrapElement(IN[1])]
			selfilt = selectionfilter(category)
			self.El = uidoc.Selection.PickObjects(Selection.ObjectType.Element,selfilt,'abs')
			self.selelem = (doc.GetElement(i.ElementId) for i in self.El)
			self.Ele = (i.ToDSType(True	) for i in self.selelem )
		except:
				pass

	def ok(self,sender, e):
		self.Close()


f = MainForm()
Application.Run(f)

OUT = f.Ele
# ----------------------------------------
boolean_24 = BoolSelector(true)
winform_filter_by_category = Python(IN[0]=boolean_24)  # IronPython2; frozen
# ---------- winform_filter_by_category.python (174 lines) ----------
"""Copyright(c) 2019 by: duengocnguyen@gmail.com"""
import clr
clr.AddReference('System.Windows.Forms')
clr.AddReference('System.Drawing')
clr.AddReference('RevitAPI')
from Autodesk.Revit.DB import *

clr.AddReference("RevitNodes")
import Revit
clr.ImportExtensions(Revit.Elements)
clr.ImportExtensions(Revit.GeometryConversion)

clr.AddReference("RevitServices")
import RevitServices
from RevitServices.Persistence import DocumentManager
from RevitServices.Transactions import TransactionManager

import System.Drawing
import System.Windows.Forms

from System.Drawing import *
from System.Windows.Forms import *
doc = DocumentManager.Instance.CurrentDBDocument
view = doc.ActiveView
categories = doc.Settings.Categories
ModelCat =[]
for i in categories:
	if i.CategoryType == CategoryType.Model:
		ModelCat.append(Revit.Elements.Category.ById(i.Id.IntegerValue))

class MainForm(Form):
	def __init__(self):
		self.InitializeComponent()
	
	def InitializeComponent(self):
		self._groupBox1 = System.Windows.Forms.GroupBox()
		self._label1 = System.Windows.Forms.Label()
		self._cbxType = System.Windows.Forms.ComboBox()
		self._button1 = System.Windows.Forms.Button()
		self._btnCancel = System.Windows.Forms.Button()
		self._checkAllNone = System.Windows.Forms.CheckBox()
		self._lstView = System.Windows.Forms.ListView()
		self._groupBox1.SuspendLayout()
		self.SuspendLayout()
		# 
		# groupBox1
		# 
		self._groupBox1.Controls.Add(self._cbxType)
		self._groupBox1.Controls.Add(self._label1)
		self._groupBox1.Location = System.Drawing.Point(4, -3)
		self._groupBox1.Name = "groupBox1"
		self._groupBox1.Size = System.Drawing.Size(348, 64)
		self._groupBox1.TabIndex = 0
		self._groupBox1.TabStop = False
		# 
		# label1
		# 
		self._label1.Location = System.Drawing.Point(6, 27)
		self._label1.Name = "label1"
		self._label1.Size = System.Drawing.Size(100, 23)
		self._label1.TabIndex = 1
		self._label1.Text = "ComboBox:"
		# 
		# cbxType
		# 
		self._cbxType.CausesValidation = False
		self._cbxType.FormattingEnabled = True
		self._cbxType.Location = System.Drawing.Point(70, 24)
		self._cbxType.Name = "cbxType"
		self._cbxType.Size = System.Drawing.Size(271, 21)
		self._cbxType.Sorted = True
		self._cbxType.TabIndex = 2
		self._cbxType.TabStop = False
		self._cbxType.Items.AddRange(System.Array[System.Object](ModelCat))
		self._cbxType.SelectedIndexChanged += self.CbxTypeSelectedIndexChanged
		# 
		# button1
		# 
		self._button1.Location = System.Drawing.Point(193, 340)
		self._button1.Name = "button1"
		self._button1.Size = System.Drawing.Size(75, 23)
		self._button1.TabIndex = 1
		self._button1.Text = "OK"
		self._button1.UseVisualStyleBackColor = True
		self._button1.Click += self.Button1Click
		# 
		# btnCancel
		# 
		self._btnCancel.Location = System.Drawing.Point(277, 340)
		self._btnCancel.Name = "btnCancel"
		self._btnCancel.Size = System.Drawing.Size(75, 23)
		self._btnCancel.TabIndex = 2
		self._btnCancel.Text = "Cancel"
		self._btnCancel.UseVisualStyleBackColor = True
		self._btnCancel.Click += self.BtnCancelClick
		# 
		# checkAllNone
		# 
		self._checkAllNone.Location = System.Drawing.Point(4, 298)
		self._checkAllNone.Name = "checkAllNone"
		self._checkAllNone.Size = System.Drawing.Size(104, 24)
		self._checkAllNone.TabIndex = 8
		self._checkAllNone.Text = "Select All/None"
		self._checkAllNone.UseVisualStyleBackColor = True
		self._checkAllNone.CheckedChanged += self.CheckAllNoneCheckedChanged
		# 
		# lstView
		# 
		self._lstView.AllowColumnReorder = True
		self._lstView.BorderStyle = System.Windows.Forms.BorderStyle.FixedSingle
		self._lstView.CheckBoxes = True
		self._lstView.Location = System.Drawing.Point(4, 68)
		self._lstView.Name = "lstView"
		self._lstView.Size = System.Drawing.Size(348, 222)
		self._lstView.Sorting = System.Windows.Forms.SortOrder.Ascending
		self._lstView.TabIndex = 9
		self._lstView.TabStop = False
		self._lstView.UseCompatibleStateImageBehavior = False
		self._lstView.View = System.Windows.Forms.View.List
		# 

		# MainForm
		# 
		self.AutoSizeMode = System.Windows.Forms.AutoSizeMode.GrowAndShrink
		self.BackColor = System.Drawing.SystemColors.ControlLightLight
		self.ClientSize = System.Drawing.Size(357, 373)
		self.Controls.Add(self._lstView)
		self.Controls.Add(self._checkAllNone)
		self.Controls.Add(self._btnCancel)
		self.Controls.Add(self._button1)
		self.Controls.Add(self._groupBox1)
		self.MaximizeBox = False
		self.Name = "MainForm"
		self.ShowIcon = False
		self.SizeGripStyle = System.Windows.Forms.SizeGripStyle.Hide
		self.StartPosition = System.Windows.Forms.FormStartPosition.CenterParent
		self.Text = "Day03"
		self._groupBox1.ResumeLayout(False)
		self.ResumeLayout(False)
		self.ElementFiltered=[]
		
	def Button1Click(self, sender, e):
		self.Close()
		pass

	def BtnCancelClick(self, sender, e):
		self.Close()
		pass

	def CbxTypeSelectedIndexChanged(self, sender, e):
		self._lstView.Items.Clear()
		catergoryFilter = []
		self.listBoxSelected = [self._cbxType.SelectedItem]
		for i in self.listBoxSelected:
			catergoryFilter.append(ElementCategoryFilter(System.Enum.ToObject(BuiltInCategory,int(str(i.Id)))))
		filter = LogicalOrFilter(catergoryFilter)
		self.ElementFiltered = FilteredElementCollector(doc,view.Id).WherePasses(filter).ToElements()
		for i in self.ElementFiltered:
			self._lstView.Items.Add(Element.Name.__get__(i))
		pass

	def CheckAllNoneCheckedChanged(self, sender, e):
		if self._checkAllNone.Checked == True:
			for i in self._lstView.Items:			
				i.Checked = True
		else:
			for i in self._lstView.Items:			
				i.Checked = False

		pass
		
f = MainForm()
Application.Run(f)
OUT =f.ElementFiltered
# ----------------------------------------

# group: Alert
taskDialog = Python()  # IronPython2; frozen; unwired: IN[0], IN[1], IN[2]
# ---------- taskDialog.python (17 lines) ----------
import clr
import msvcrt
clr.AddReference('RevitAPIUI')
from Autodesk.Revit.UI import*

check = IN[0]
content = IN[1]

result = str(IN[1])

button = TaskDialogCommonButtons.None

if check == True:
    TaskDialog.Show('Result',result,button)
else:
    result = "Set True to run"
OUT = result
# ----------------------------------------
set_run = BoolSelector(true)
input_1 = DoubleInput(5)
input_2 = DoubleInput(5)
code_block_7 = CodeBlock(a=input_1, b=input_2) { a+b; }
reset = BoolSelector(false)
python_script_4 = Python(IN[0]=set_run, IN[1]=code_block_7, IN[2]=reset)  # IronPython2; frozen
# ---------- python_script_4.python (17 lines) ----------
import clr
import msvcrt
clr.AddReference('RevitAPIUI')
from Autodesk.Revit.UI import*

check = IN[0]
content = IN[1]

result = str(IN[1])

button = TaskDialogCommonButtons.Ok

if check == True:
    TaskDialog.Show('Result',result,button)
else:
    result = "Set True to run"
OUT = result
# ----------------------------------------

filter_family_symbol = Python()  # IronPython2; unwired: IN[0]
# ---------- filter_family_symbol.python (46 lines) ----------
"""Copyright(c) 2019 by: duengocnguyen@gmail.com"""

import clr 
import sys
sys.path.append(r'C:\Program Files\Autodesk\Revit 2020\AddIns\DynamoForRevit\IronPython.StdLib.2.7.8')
import math 
from System.Collections.Generic import *

clr.AddReference("ProtoGeometry")
from Autodesk.DesignScript.Geometry import *

clr.AddReference('RevitAPI')
import Autodesk
from Autodesk.Revit.DB import *

clr.AddReference('RevitAPIUI')
from Autodesk.Revit.UI import*
from  Autodesk.Revit.UI.Selection import*

clr.AddReference("RevitNodes")
import Revit
clr.ImportExtensions(Revit.Elements)
clr.ImportExtensions(Revit.GeometryConversion)

clr.AddReference("RevitServices")
import RevitServices
from RevitServices.Persistence import DocumentManager
from RevitServices.Transactions import TransactionManager

doc = DocumentManager.Instance.CurrentDBDocument
view = doc.ActiveView
uidoc = DocumentManager.Instance.CurrentUIApplication.ActiveUIDocument
#Way1:
fsymbol = FilteredElementCollector(doc).OfCategory(BuiltInCategory.OST_Grids).WhereElementIsNotElementType().ToElements();
#Way2:
lvls = FilteredElementCollector(doc).OfClass(Level).WhereElementIsNotElementType().ToElements()
##GetName:
#Way1:
naSymbol = []
for i in fsymbol:
	var = i.ToDSType(True)
	naSymbol.append(var.Name)
#Way2:
Lev = [Element.Name.__get__(i)for i in lvls]

OUT = naSymbol
# ----------------------------------------
boolean_25 = BoolSelector(false)
python_script_5 = Python(IN[0]=boolean_25)  # IronPython2; frozen
# ---------- python_script_5.python (36 lines) ----------
"""Copyright(c) 2019 by: duengocnguyen@gmail.com"""

import clr 
import sys
sys.path.append(r'C:\Program Files\Autodesk\Revit 2020\AddIns\DynamoForRevit\IronPython.StdLib.2.7.8')
import math 
from System.Collections.Generic import *

clr.AddReference("ProtoGeometry")
from Autodesk.DesignScript.Geometry import *

clr.AddReference('RevitAPI')
import Autodesk
from Autodesk.Revit.DB import *

clr.AddReference('RevitAPIUI')
from Autodesk.Revit.UI import*
from  Autodesk.Revit.UI.Selection import*

clr.AddReference("RevitNodes")
import Revit
clr.ImportExtensions(Revit.Elements)
clr.ImportExtensions(Revit.GeometryConversion)

clr.AddReference("RevitServices")
import RevitServices
from RevitServices.Persistence import DocumentManager
from RevitServices.Transactions import TransactionManager

doc = DocumentManager.Instance.CurrentDBDocument
view = doc.ActiveView
uidoc = DocumentManager.Instance.CurrentUIApplication.ActiveUIDocument

selectedIds = uidoc.Selection.GetElementIds()
alert = TaskDialog.Show("Revit", "Number of selected elements: " + selectedIds.Count.ToString())
OUT = selectedIds
# ----------------------------------------
boolean_26 = BoolSelector(false)  # frozen
python_script_6 = Python(IN[0]=boolean_26)  # IronPython2
# ---------- python_script_6.python (3 lines) ----------
f = open(r'A:\\TRAINING DYNAMO API\\PART 14 SHORT VIDEO\\Class\\script.py')

OUT = f.read()
# ----------------------------------------
python_script_from_string = PythonStringNode(script=python_script_6, IN[0]=boolean_26)  # IronPython2
boolean_27 = BoolSelector(true)  # frozen
python_script_7 = Python(IN[0]=boolean_27)  # IronPython2
# ---------- python_script_7.python (2 lines) ----------
f = open(r'A:\\TRAINING DYNAMO API\\PART 14 SHORT VIDEO\\Class\\lib_Select.py')
OUT = f.read()
# ----------------------------------------
python_script_from_string_2 = PythonStringNode(script=python_script_7)  # IronPython2; unwired: IN[0]
select_edge_3 = Python(IN[0]=boolean_2)  # IronPython2
# ---------- select_edge_3.python (24 lines) ----------
import clr 

clr.AddReference("RevitAPIUI")
from  Autodesk.Revit.UI import *

clr.AddReference("RevitServices")
import RevitServices
from RevitServices.Persistence import DocumentManager
doc = DocumentManager.Instance.CurrentDBDocument
uidoc=DocumentManager.Instance.CurrentUIApplication.ActiveUIDocument
  
clr.AddReference("RevitNodes")
import Revit
clr.ImportExtensions(Revit.Elements)
clr.ImportExtensions(Revit.GeometryConversion)


ref =  uidoc.Selection.PickObject(Selection.ObjectType.Edge, "Select the desired edges and press Finish")

fa = doc.GetElement(ref.ElementId)

edge = fa.GetGeometryObjectFromReference(ref)

OUT = edge.AsCurve(),fa
# ----------------------------------------
code_block_8 = CodeBlock(a=select_edge_3) { [a[0]]; }
code_block_9 = CodeBlock(a=select_edge_2) { [a[0]]; }
python_script_8 = Python(IN[0]=code_block_9)  # CPython3
# ---------- python_script_8.python (39 lines) ----------
"""Copyright(c) 2019 by: duengocnguyen@gmail.com"""
'https://www.youtube.com/channel/UCt2JhCDDFxpYho575WTMZ4g'
"""________________Welcome to BIM3DM-DYNAMO API___________________"""
import clr 
import sys
sys.path.append(r'C:\Program Files\Autodesk\Revit 2020\AddIns\DynamoForRevit\IronPython.StdLib.2.7.8')
import math 
from System.Collections.Generic import *

clr.AddReference("ProtoGeometry")
from Autodesk.DesignScript.Geometry import *

clr.AddReference('RevitAPI')
import Autodesk
from Autodesk.Revit.DB import *

clr.AddReference('RevitAPIUI')
from Autodesk.Revit.UI import*
from  Autodesk.Revit.UI.Selection import*

clr.AddReference("RevitNodes")
import Revit
clr.ImportExtensions(Revit.Elements)
clr.ImportExtensions(Revit.GeometryConversion)

clr.AddReference("RevitServices")
import RevitServices
from RevitServices.Persistence import DocumentManager
from RevitServices.Transactions import TransactionManager

doc = DocumentManager.Instance.CurrentDBDocument
view = doc.ActiveView
uidoc = DocumentManager.Instance.CurrentUIApplication.ActiveUIDocument

#Preparing input from dynamo to revit
elements = UnwrapElement(IN[0])


OUT = [e.ToRevitType() for e in elements]
# ----------------------------------------
python_script_9 = Python(IN[0]=python_script_8)  # CPython3
# ---------- python_script_9.python (39 lines) ----------
"""Copyright(c) 2019 by: duengocnguyen@gmail.com"""
'https://www.youtube.com/channel/UCt2JhCDDFxpYho575WTMZ4g'
"""________________Welcome to BIM3DM-DYNAMO API___________________"""
import clr 
import sys
sys.path.append(r'C:\Program Files\Autodesk\Revit 2020\AddIns\DynamoForRevit\IronPython.StdLib.2.7.8')
import math 
from System.Collections.Generic import *

clr.AddReference("ProtoGeometry")
from Autodesk.DesignScript.Geometry import *

clr.AddReference('RevitAPI')
import Autodesk
from Autodesk.Revit.DB import *

clr.AddReference('RevitAPIUI')
from Autodesk.Revit.UI import*
from  Autodesk.Revit.UI.Selection import*

clr.AddReference("RevitNodes")
import Revit
clr.ImportExtensions(Revit.Elements)
clr.ImportExtensions(Revit.GeometryConversion)

clr.AddReference("RevitServices")
import RevitServices
from RevitServices.Persistence import DocumentManager
from RevitServices.Transactions import TransactionManager

doc = DocumentManager.Instance.CurrentDBDocument
view = doc.ActiveView
uidoc = DocumentManager.Instance.CurrentUIApplication.ActiveUIDocument

#Preparing input from dynamo to revit
elements = UnwrapElement(IN[0])


OUT = [e.GetEndPoint(0) for e in elements]
# ----------------------------------------
type_2 = Object.Type(object=python_script_9)
code_block_10 = CodeBlock(a=select_edges_2) { [a]; }
DBLineFormLine = Custom[DBLineFormLine](line=code_block_10)  # Converting from a Line object to a DBLine object:
XYZByDBLine = Custom[XYZByDBLine](DBLines=DBLineFormLine)  # Extracting XYZ coordinates from DB.Line.
conversionRtD = Custom[ConversionRtD](Objects=XYZByDBLine)  # Return an object entity that can be displayed on the Dynamo interface.
isolateelements_elementes_3 = Python(IN[1]=python_script_3)  # CPython3; frozen; unwired: IN[0]; same code as isolateelements_elementes_2
boolean_28 = BoolSelector(true)  # frozen
select_model_elements_3 = Python(IN[0]=boolean_28)  # IronPython2; same code as select_model_elements_2
getParameterValueByName = Python(IN[1]=select_model_elements_3)  # "Element.GetParameterValueByName"; CPython3; unwired: IN[0]
# ---------- getParameterValueByName.python (46 lines) ----------
"""Copyright(c) 2019 by: duengocnguyen@gmail.com"""
'https://www.youtube.com/channel/UCt2JhCDDFxpYho575WTMZ4g'
"""________________Welcome to BIM3DM-DYNAMO API___________________"""
import clr 
import sys
sys.path.append(r'C:\Program Files\Autodesk\Revit 2020\AddIns\DynamoForRevit\IronPython.StdLib.2.7.8')
import math 
from System.Collections.Generic import *

clr.AddReference("ProtoGeometry")
from Autodesk.DesignScript.Geometry import *

clr.AddReference('RevitAPI')
import Autodesk
from Autodesk.Revit.DB import *

clr.AddReference('RevitAPIUI')
from Autodesk.Revit.UI import*
from  Autodesk.Revit.UI.Selection import*

clr.AddReference("RevitNodes")
import Revit
clr.ImportExtensions(Revit.Elements)
clr.ImportExtensions(Revit.GeometryConversion)

clr.AddReference("RevitServices")
import RevitServices
from RevitServices.Persistence import DocumentManager
from RevitServices.Transactions import TransactionManager

doc = DocumentManager.Instance.CurrentDBDocument
view = doc.ActiveView
uidoc = DocumentManager.Instance.CurrentUIApplication.ActiveUIDocument

################################################################
elements = UnwrapElement(IN[1])
factorUnit = 304.8
params = []
for element in elements:
    param = element.LookupParameter("Base Offset").AsDouble()
    if (isinstance(param, float) ):
        num = param * factorUnit
        params.append(num)
    

OUT = params
# ----------------------------------------

# group: VS Code
boolean_29 = BoolSelector(true)
python_script_10 = Python(IN[0]=boolean_29)  # IronPython2
# ---------- python_script_10.python (5 lines) ----------
re  = open(r"U:\17_TrainingAdvanceDynamo\2_WORKING\Tool\Dynamo\Training-Dynamo-2024\DesignScript.py", "r")

interpret = re.read()

OUT =  interpret
# ----------------------------------------
python_script_from_string_3 = PythonStringNode(script=python_script_10, IN[1]=select_model_elements_3, IN[2]=getParameterValueByName)  # CPython3; unwired: IN[0]

code_block_11 = CodeBlock { "Mark"; }
getParameterValueByName_2 = Element.GetParameterValueByName(element=select_model_elements_3, parameterName=code_block_11)
code_block_12 = CodeBlock { "Mark"; }
code_block_13 = CodeBlock { ["M1", "M2", "M3"]; }
setParameterByName = Element.SetParameterByName(element=select_model_elements_3, parameterName=code_block_12, value=code_block_13)
code_block_14 = CodeBlock { "Mark"; }
getParameterValueByName_3 = Element.GetParameterValueByName(element=setParameterByName, parameterName=code_block_14)
code_block_15 = CodeBlock { [2,1,3]; [300, 400, 500]; }
boolean_30 = BoolSelector(false)  # frozen
select_model_elements_4 = Python(IN[0]=boolean_30)  # IronPython2; same code as select_model_elements_2
getLocation = Element.GetLocation(element=select_model_elements_4)

# group: VS Code
boolean_31 = BoolSelector(false)  # frozen
python_script_11 = Python(IN[0]=boolean_31)  # IronPython2; same code as python_script_10
python_script_from_string_4 = PythonStringNode(script=python_script_11, IN[0]=getLocation)  # CPython3

code_block_16 = CodeBlock { 0; }
getItemAtIndex = List.GetItemAtIndex(list=python_script_from_string_4@L2, index=code_block_16)
getItemAtIndex_2 = List.GetItemAtIndex(list=select_model_elements_4, index=getItemAtIndex)
