# Dynamo graph velinedancheo.dyn (Dynamo 2.10.1.3976)

code_block = CodeBlock { n=12; }
code_block_2 = CodeBlock(n=code_block) { 1..n..1; }
number = DoubleInput(0)
code_block_3 = CodeBlock(y1=number) { y1; }
number_2 = DoubleInput(2)
code_block_4 = CodeBlock(z=number_2) { z; }
byCoordinates = Point.ByCoordinates(x=code_block_2, y=code_block_3, z=code_block_4)
number_3 = DoubleInput(1)
code_block_5 = CodeBlock(y2=number_3) { y2; }
byCoordinates_2 = Point.ByCoordinates(x=code_block_2, y=code_block_5, z=code_block_4)
code_block_6 = CodeBlock { 1; }
dropItems = List.DropItems(list=byCoordinates_2, amount=code_block_6)
byStartPointEndPoint = Line.ByStartPointEndPoint(startPoint=byCoordinates, endPoint=dropItems)
dropItems_2 = List.DropItems(list=byCoordinates, amount=code_block_6)
byStartPointEndPoint_2 = Line.ByStartPointEndPoint(startPoint=byCoordinates_2, endPoint=dropItems_2)
number_4 = DoubleInput(2)
code_block_7 = CodeBlock(y3=number_4) { y3; }
byCoordinates_3 = Point.ByCoordinates(x=code_block_2, y=code_block_7, z=code_block_4)
dropItems_3 = List.DropItems(list=byCoordinates_3, amount=code_block_6)
byStartPointEndPoint_3 = Line.ByStartPointEndPoint(startPoint=byCoordinates_2, endPoint=dropItems_3)
byStartPointEndPoint_4 = Line.ByStartPointEndPoint(startPoint=byCoordinates_3, endPoint=dropItems)
code_block_8 = CodeBlock { 1; 12; }
byCoordinates_4 = Point.ByCoordinates(x=code_block_8.out0)
firstItem = List.FirstItem(list=byCoordinates)
byStartPointEndPoint_5 = Line.ByStartPointEndPoint(startPoint=byCoordinates_4, endPoint=firstItem)
byCoordinates_5 = Point.ByCoordinates(x=code_block_8.out1)
lastItem = List.LastItem(list=byCoordinates)
byStartPointEndPoint_6 = Line.ByStartPointEndPoint(startPoint=byCoordinates_5, endPoint=lastItem)
code_block_9 = CodeBlock { 1; 12; }
code_block_10 = CodeBlock { 2; }
byCoordinates_6 = Point.ByCoordinates(x=code_block_9.out0, y=code_block_10)
firstItem_2 = List.FirstItem(list=byCoordinates_3)
byStartPointEndPoint_7 = Line.ByStartPointEndPoint(startPoint=byCoordinates_6, endPoint=firstItem_2)
lastItem_2 = List.LastItem(list=byCoordinates_3)
byCoordinates_7 = Point.ByCoordinates(x=code_block_9.out1, y=code_block_10)
byStartPointEndPoint_8 = Line.ByStartPointEndPoint(startPoint=lastItem_2, endPoint=byCoordinates_7)
